# Grasshopper definition 00_UR_basicSettings.ghx (Grasshopper 1.0.7)

number_slider = Slider(5, range=0..50)
number_slider_2 = Slider(19, range=0..50)
addition = Addition(A="-37.97", B=number_slider_2)
addition_2 = Addition(A="-38.40", B=number_slider_2)
addition_3 = Addition(A="-37.66", B=number_slider_2)
subtraction = Subtraction(A=addition, B=number_slider)
subtraction_2 = Subtraction(A=addition_3, B=number_slider)
subtraction_3 = Subtraction(A=addition_2, B=number_slider)

# ---- group: Ori Pt
# Calibration
# UR10 Calibration Points & Work Area
# 
# Tool tip should just touch the ruler!!!
# 
# You should feel it's hardly to move the ruler
panel = Panel("515.00")
panel_2 = Panel("-251.25")
pt = ConstructPoint(XCoordinate=panel, YCoordinate="-180.00", ZCoordinate=subtraction)

# ---- group: xAxis_pt
pt_2 = ConstructPoint(XCoordinate="765.00", YCoordinate="-180.00", ZCoordinate=subtraction_3)

# ---- group: yAxis_pt
pt_3 = ConstructPoint(XCoordinate="515.00", YCoordinate="380.00", ZCoordinate=subtraction_2)

# ---- group: Safe_pt
pt_4 = ConstructPoint(XCoordinate="515.00", YCoordinate="-180.00", ZCoordinate="-54")

# ----
panel_3 = Panel("-251.14")
panel_4 = Panel("-251.61")

# ----
# Slicing Parameters
layer_height = Slider(12, range=0.5..300)
layer_count = Slider(2, range=1..10)
seg_length = Slider(25, range=0.1..200)
offset_distance = Slider(7, range=0.5..50)

# ----
# Robot Parameters
velocity = Slider(200, range=0..999)
acceleration = Slider(300, range=0..500)

# ----
# Input Geo
brep = Brep(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)

# ----
# Test Geometry
list = ValueList({"Without ribs": 0, "Ribs": 1}, selected="Without ribs")
list_2 = ValueList({"Spike": 0, "Chamfer": 1}, selected="Spike")
crv = Curve(<curve referenced from the Rhino model>)
crv_2 = Curve(<curve referenced from the Rhino model>)
infill_offset = Slider(-13, range=-50..50)
infill_zoffset = Slider(0, range=-10..100)
chamfer_wid = Slider(40, range=0..100)
end_gap = Slider(10, range=0..100)
divide_interval = Slider(50, range=0..100)
rib_span = Slider(240, range=20..2000)
pathgenerator = GhPythonScript(
    crv=crv_2,
    shell_typ=list,
    rib_span=rib_span,
    rib_wid=Slider(50, range=0..100),
    rib_dep=Slider(50, range=0..100),
    infill_typ=list_2,
    infill_span=Slider(200, range=20..2000),
    infill_div=Slider(37.1, range=0..100),
    infill_offset=infill_offset,
    chamfer_wid=chamfer_wid,
    end_gap=end_gap,
    divide_interval=divide_interval)  # -> seg1dir, segNormal, crv_segs, vis_pts, vis_attr; inputs crv: Curve, shell_typ: Int32, infill_typ: Int32, infill_span: Int32
# ---------- pathgenerator: Python ----------
__author__ = "Fen"
__spacing__= "-----ʕ•ᴥ•ʔ-----"
import Rhino.Geometry as rg
import ghpythonlib.components as ghc
import ghpythonlib.treehelpers as th
from  itertools import izip_longest, chain

def zip2Lists_flatten(list1, list2):
    """
    list1 = [1,1,1]
    list2 = [2,2,2,'A','A','A']
    result = [1, 2, 1, 2, 1, 2, 'A', 'A', 'A']
    """
    mapList = map(list, izip_longest(list1,list2, fillvalue=None))
    zipList = [i for sublist in mapList for i in sublist if i is not None]
    return zipList

def divide_crv(crv, divide_interval, endInc):
    crv_length = crv.GetLength()
    count = int(crv_length/divide_interval)
    params = crv.DivideByCount(count, endInc)
    points = [crv.PointAt(p) for p in params]
    tangents = [crv.TangentAt(p) for p in params]
    normals = [rg.Vector3d.CrossProduct(t, rg.Vector3d.ZAxis) for t in tangents]
    return points, normals

def swapPositions(list, pos1, pos2):
    list[pos1], list[pos2] = list[pos2], list[pos1]
    return list

def sortCrvs_xy(crvs):
    for i,crv in enumerate(crvs):
        crv.Domain =rg.Interval(0,1)

    mids=[crv.PointAt(0.5) for crv in crvs]
    ptsX = [pt.X for pt in mids]
    ptsY = [pt.Y for pt in mids]
    data = zip(ptsX, ptsY, crvs)
    data.sort()
    if data[1][1]>data[2][1]:
        swap = True
        #print "swap"
    else:
        swap = False
        #print "No swap"
    sorted_crvs = [crv for x,y,crv in data]
    if swap:
        sorted_crvs = swapPositions(sorted_crvs, 1, 2)
    sorted_crvs = swapPositions(sorted_crvs, 2, 3)
    return sorted_crvs

def pt2_ribPts(param,normal, crv, rib_wid, rib_dep):
    rib_pts = []
    rib_pts.append(crv.PointAt(param-rib_wid/2))
    rib_pts.append(crv.PointAt(param-rib_wid/2) + n*rib_dep)
    rib_pts.append(crv.PointAt(param+rib_wid/2) + n*rib_dep)
    rib_pts.append(crv.PointAt(param+rib_wid/2))
    return rib_pts


"""Sort edges order"""
bb = crv.GetBoundingBox(rg.Plane.WorldXY)
bb_edges = bb.GetEdges()
bb_segs = []
for i,seg in enumerate(bb_edges):
    if i<4:
        seg=rg.Line.ToNurbsCurve(seg)
        bb_segs.append(seg)
bb_segs= sortCrvs_xy(bb_segs)

"""Check crv direction"""
crv_segs = crv.DuplicateSegments()
crv_segs = sortCrvs_xy(crv_segs)
seg1= crv_segs[0]
start = seg1.PointAt(0.0)
end = seg1.PointAt(1.0)
seg1dir = end -start
segNormal = rg.Vector3d.CrossProduct(rg.Vector3d.XAxis,seg1dir)
reverseCrv = False
if segNormal.Z >0:
    reverseCrv = True
    print "need toreverse"
if reverseCrv:
    for crv in crv_segs:
        crv.Reverse()
        print "reversed"



crv_segs[3].Reverse()

top_crv = crv_segs[3]
top_crv.Domain = rg.Interval(0, top_crv.GetLength())
bot_crv = crv_segs[1]
bot_crv.Domain = rg.Interval(0, bot_crv.GetLength())

"""Check if input curve has curvature"""
straight = None
check = [seg.Degree for seg in crv_segs]
if sum(check) > len(crv_segs):
    straight = False
elif sum(check) == len(crv_segs):
    straight = True
"""----------------------------------"""

wayPt_nlist=[]
for i,seg in enumerate(crv_segs):
    pts=[]
    if straight:
        if i ==0:
            v = seg.PointAtEnd - seg.PointAtStart
            v.Unitize()
            pts.append(seg.PointAtStart+v*end_gap)
        elif i==1:
            pts.append(seg.PointAtStart)
        elif i==2:
            pts.append(seg.PointAtStart)
        elif i ==len(crv_segs)-1:
            seg.Reverse()
            pts.append(seg.PointAtStart)
            v = seg.PointAtStart-seg.PointAtEnd
            v.Unitize()
            pts.append(seg.PointAtEnd+v*end_gap)
    else:
        if seg.Degree==1:
            if i==0:
                v = seg.PointAtEnd - seg.PointAtStart
                v.Unitize()
                pts.append(seg.PointAtStart+v*end_gap)
                pts.append(seg.PointAtEnd)
            else:
                pts.append(seg.PointAtStart)
        else:
            if i==1:
                pts,_ = divide_crv(seg, divide_interval, False)
            else:
                pts,_ = divide_crv(seg, divide_interval, True)
                pts.pop(0)
    wayPt_nlist.append(pts)


"""Add ribs if necessary"""
if shell_typ ==1:
    rib_count = int(top_crv.GetLength()/rib_span)*2
    if rib_count%2!=0:
        rib_count +=1
        
    top_rib_params = top_crv.DivideByCount(rib_count, True)
    top_rib_params = top_rib_params[1:-1]
    top_rib_tangents = [top_crv.TangentAt(p) for i,p in enumerate(top_rib_params)]
    top_rib_normals = [rg.Vector3d.CrossProduct(t, rg.Vector3d.ZAxis) for t in top_rib_tangents]
    top_rib_pts =[]
    for i,(p,n) in enumerate(zip(top_rib_params,top_rib_normals)):
        top_rib_pts.extend(pt2_ribPts(p,n, top_crv, rib_wid, rib_dep))
    wayPt_nlist[3].extend(top_rib_pts)
    wayPt_nlist[3].append(wayPt_nlist[3].pop(1))
    
    bot_rib_params = bot_crv.DivideByCount(rib_count, True)
    bot_rib_params = bot_rib_params[1:-1]
    bot_rib_tangents = [bot_crv.TangentAt(p) for i,p in enumerate(bot_rib_params)]
    bot_rib_normals = [rg.Vector3d.CrossProduct(t, rg.Vector3d.ZAxis) for t in bot_rib_tangents]

    bot_rib_pts =[]
    for i,(p,n) in enumerate(zip(bot_rib_params,bot_rib_normals)):
        bot_rib_pts.extend(pt2_ribPts(p,n, bot_crv, rib_wid, rib_dep))
    wayPt_nlist[1].extend(bot_rib_pts)

WayPtAttribute_nlist = []
for pts in wayPt_nlist:
    l = []
    for pt in pts:
        l.append('shell')
    WayPtAttribute_nlist.append(l)

"""Drawing intersect lines from top edge"""
top_bb = bb_segs[3]
infill_count = int(top_bb.GetLength()/infill_span)*2
if infill_count%2!=0:
    infill_count +=1
infill_params = top_bb.DivideByCount(infill_count, True)
top_bb_pts = [top_bb.PointAt(p) for p in infill_params]
inter_ls = [rg.Line(rg.Point3d(pt.X, pt.Y+100000, pt.Z), rg.Vector3d.YAxis*-1000000) for pt in top_bb_pts]
inter_ls = [l.ToNurbsCurve() for l in inter_ls]


top_pts = []
bot_pts = []
for i,l in enumerate(inter_ls):
    if infill_typ == 0:
        if i%2==0:
            top_inter = rg.Intersect.Intersection.CurveCurve(top_crv, l, 0.01, 0.01)[0]
            pt = top_inter.PointA
            if i ==0:
                top_pts.append(pt)
            elif i==len(inter_ls)-1:
                top_pts.append(pt)
            else:
                p = top_inter.ParameterA
                v = rg.Vector3d.CrossProduct(top_crv.TangentAt(p), rg.Vector3d.ZAxis)
                v.Unitize()
                top_pts.append(pt+v*infill_offset*1)
        elif i%2==1:
            bot_inter = rg.Intersect.Intersection.CurveCurve(bot_crv, l, 0.01, 0.01)[0]
            pt = bot_inter.PointA
            p = bot_inter.ParameterA
            v = rg.Vector3d.CrossProduct(bot_crv.TangentAt(p), rg.Vector3d.ZAxis)
            v.Unitize()
            bot_pts.append(pt+v*infill_offset*1)

    elif infill_typ == 1:
        if i%2==0:
            top_inter = rg.Intersect.Intersection.CurveCurve(top_crv, l, 0.01, 0.01)[0]
            if i == 0:
                top_pts.append([top_inter.PointA])
            elif i ==len(inter_ls)-1:
                top_pts.append([top_inter.PointA])
            else:
                
                p0 = top_inter.ParameterA - chamfer_wid/2
                pt0 = top_crv.PointAt(p0)
                p1 = top_inter.ParameterA + chamfer_wid/2
                pt1 = top_crv.PointAt(p1)
                
                v0 = rg.Vector3d.CrossProduct(top_crv.TangentAt(p0), rg.Vector3d.ZAxis)
                v0.Unitize()
                v1 = rg.Vector3d.CrossProduct(top_crv.TangentAt(p1), rg.Vector3d.ZAxis)
                v1.Unitize()
                pts = [pt0+v0*infill_offset*1, pt1+v1*infill_offset*1]
                top_pts.append(pts)
        elif i%2==1:
            bot_inter = rg.Intersect.Intersection.CurveCurve(bot_crv, l, 0.01, 0.01)[0]
            p0 = bot_inter.ParameterA + chamfer_wid/2
            pt0 = bot_crv.PointAt(p0)
            p1 = bot_inter.ParameterA - chamfer_wid/2
            pt1 = bot_crv.PointAt(p1)
            
            v0 = rg.Vector3d.CrossProduct(bot_crv.TangentAt(p0), rg.Vector3d.ZAxis)
            v0.Unitize()
            v1 = rg.Vector3d.CrossProduct(bot_crv.TangentAt(p1), rg.Vector3d.ZAxis)
            v1.Unitize()
            pts = [pt0+v0*infill_offset*1, pt1+v1*infill_offset*1]
            bot_pts.append(pts)

if infill_typ == 0:
    infillPts = zip2Lists_flatten(top_pts,bot_pts)
elif infill_typ == 1:
    infillPts = zip2Lists_flatten(top_pts,bot_pts)
    infillPts = [i for sublist in infillPts for i in sublist]

infillPts_update = []
infillPts_attributes = []
if infill_typ == 0:
    for i,pt in enumerate(infillPts):
        if i!= len(infillPts)-1:
            v = infillPts[i+1] - pt
            d = v.Length
            v.Unitize()
            if i==0:
                infillPts_update.append(pt.Clone()+v*end_gap)
                infillPts_attributes.append('shell')
            else:
                infillPts_update.append(pt)
                infillPts_attributes.append('infill_corner')

#            infillPts_update.append(pt.Clone()+v*infill_div)
#            infillPts_attributes.append('infill_quar')
#            infillPts_update.append(pt.Clone()+v*d/2)
#            infillPts_attributes.append('infill_mid')
#            infillPts_update.append(pt.Clone()+v*(d-infill_div))
#            infillPts_attributes.append('infill_quar')
        else:
            infillPts_update.append(pt)
            infillPts_attributes.append('shell')
elif infill_typ == 1:
    for i,pt in enumerate(infillPts):
        if i!= len(infillPts)-1:
            v = infillPts[i+1] - pt
            d = v.Length
            v.Unitize()
            if i%2 ==0:
                if i==0:
                    infillPts_update.append(pt.Clone()+v*end_gap)
                    infillPts_attributes.append('shell')
                else:
                    infillPts_update.append(pt)
                    infillPts_attributes.append('infill_corner')
#                infillPts_update.append(pt.Clone()+v*infill_div)
#                infillPts_attributes.append('infill_quar')
#                infillPts_update.append(pt.Clone()+v*d/2)
#                infillPts_attributes.append('infill_mid')
#                infillPts_update.append(pt.Clone()+v*(d-infill_div))
#                infillPts_attributes.append('infill_quar')
            elif i%2 ==1:
                infillPts_update.append(pt)
                infillPts_attributes.append('infill_corner')
        else:
            infillPts_update.append(pt)
            infillPts_attributes.append('shell')

"""outline---infill---outline"""
infillPts_update.reverse()
infillPts_attributes.reverse()

wayPt_nlist.append(infillPts_update)
WayPtAttribute_nlist.append(infillPts_attributes)

vis_pts = th.list_to_tree(wayPt_nlist)
vis_attr = th.list_to_tree(WayPtAttribute_nlist)


divide_interval
# ---------- end pathgenerator ----------
python = GhPythonScript(pts=flatten(pathgenerator.vis_pts), seg_length=seg_length)  # -> newPts; inputs pts: list of Point3d
# ---------- python: Python ----------
__author__ = "Fen"
import Rhino.Geometry as rg
"-------Import Personal Library-------"
from compas_rhino import unload_modules
unload_modules('e2e_pathSlicer')
import e2e_pathSlicer as ps
"-------------------------------------"

newPts = []

for i,pt in enumerate(pts):
    if  i != len(pts)-1:
        dis = pt.DistanceTo(pts[i+1])
        line = rg.Line(pt, pts[i+1])
        line = line.ToNurbsCurve()
        #print dis, type(line)
        if dis >= seg_length:
            extraPts,_ = ps.divide_crv(line, seg_length, False)
            #print "Order: ",i, len(extraPts)
            newPts.append(pt)
            newPts.extend(extraPts)
    else:
        newPts.append(pt)
# ---------- end python ----------
pline = PolyLine(Vertices=python, Closed=False)
bbox = BoundingBox(Content=pline, Plane=PlaneXY(0, 0, 0))  # -> Box, Box_2
box = EvaluateBox(Box=bbox.Box, UParameter=0.5, VParameter=0.5, WParameter=0.5)  # -> Plane, Point, Include
python_2 = GhPythonScript(object_height=Slider(200, range=0..300), layer_height=layer_height, pts=python, mirrorPt=box.Point)  # -> out, targetPoint_nList; inputs pts: list of Point3d, mirrorPt: Point3d
# ---------- python_2: Python ----------
__author__ = "Fen"
import Rhino.Geometry as rg
import ghpythonlib.components as ghc
import ghpythonlib.treehelpers as th
import math as m
from compas_ghpython import ghtree_to_list, list_to_ghtree 
from scriptcontext import sticky
"-------Import Personal Library-------"
from compas_rhino import unload_modules
unload_modules('data_structure')
import data_structure as ds
"-------------------------------------"

layer_count = m.ceil(object_height/layer_height)
layer_count = int(layer_count)
print layer_count

targetPoint_nList = []
for i in range(layer_count+1):
    T = rg.Transform.Translation(0,0,layer_height*i)
    moved_pts = [pt.Clone() for pt in pts]
    for pt in moved_pts:
        pt.Transform(T)
        if i%2==1:
            M = rg.Transform.Mirror(mirrorPt, rg.Vector3d.XAxis)
            pt.Transform(M)
            
#    print len(moved_pts), type(moved_pts[2]), layer_height*i
    targetPoint_nList.append(moved_pts)
# ---------- end python_2 ----------
order = PointOrder(Points=python)
geo = Geometry(python)

panel_5 = Panel("40")

# ----
# End-effector installation position
robot_joint_angles = Panel("""-180.00
-55.00
125.00
-260.00
-90.00
180.00""")

# ---- group: Select Target Pt
list_3 = ValueList({"Origin Point": 0, "X Axis Point": 1, "Y Axis Point": 2, "Safe Point": 3}, selected="Y Axis Point")
filter = StreamFilter(Gate=list_3, Stream0=pt, Stream1=pt_2, Stream2=pt_3, Stream3=pt_4)

# ----
# Slicing + Support
contour = GhPythonScript(brep=brep, layer_height=layer_height, offset_distance=offset_distance, layer_count=layer_count)  # -> contourCrvs, vis_contourCrvs, contourCrv_nList; inputs brep: Brep, layer_count: Int32
# ---------- contour: Python ----------
__author__ = "Fen"
import Rhino.Geometry as rg
import ghpythonlib.components as ghc
import ghpythonlib.treehelpers as th
from compas_ghpython import ghtree_to_list, list_to_ghtree 
"-------Import Library-------"
from compas_rhino import unload_modules
unload_modules('e2e_pathSlicer')
import e2e_pathSlicer as ps
"-------------------------------------"

# get contour curves from a brep
contourCrvs = ps.contour_XY(brep, layer_height, True)

contourCrv_nList =[]

bbcs=[]

if layer_count==1:
    contourCrv_nList = [[crv] for crv in contourCrvs]
elif layer_count !=1:
    for crv in contourCrvs:
        crvs = []
        for j in range(layer_count):
            if j ==0:
                crvs.append(crv)
            else:
                bb = crv.GetBoundingBox(rg.Vector3d(0,0,1))
                #to check curve center
                bbcs.append(bb.Center)
                offset_crv = crv.Offset(bb.Center, rg.Vector3d(0,0,1), offset_distance*-j, 0.01, rg.CurveOffsetCornerStyle.Sharp)[0]
                print type(offset_crv)
                crvs.append(offset_crv)
        contourCrv_nList.append(crvs)

vis_contourCrvs = list_to_ghtree(contourCrv_nList)
# ---------- end contour ----------
crv_3 = Curve(contour.contourCrvs)

dividecrvs = GhPythonScript(contourCrv_nList=contour.contourCrv_nList, seg_length=seg_length)  # -> simplify(vis_targetPoints), targetPoint_nList; inputs contourCrv_nList: list
# ---------- dividecrvs: Python ----------
__author__ = "Fen"
import Rhino.Geometry as rg
import ghpythonlib.components as ghc
import ghpythonlib.treehelpers as th
from compas_ghpython import ghtree_to_list, list_to_ghtree 
from scriptcontext import sticky
"-------Import Personal Library-------"
from compas_rhino import unload_modules
unload_modules('e2e_pathSlicer')
import e2e_pathSlicer as ps
"-------------------------------------"

"""
check if there's only a single path on each layer, 
if not, reverse every second layer
"""
check = [crv for list in contourCrv_nList for crv in list]
if len(contourCrv_nList) == len(check):
    # one curve on each layer
    pass
else:
    # multiple curves on each layer
    for i,layer in enumerate(contourCrv_nList):
        if i%2==1:
            layer.reverse()
            
"""
creat robot target points
"""
targetPoint_nList=[]
for crvs in contourCrv_nList:
    targetPoints = []
    for crv in crvs:
        print crv
        pts,_ = ps.divide_crv(crv, seg_length, True)
    targetPoint_nList.append(pts)





vis_targetPoints = list_to_ghtree(targetPoint_nList)
# ---------- end dividecrvs ----------

# ----
# IO on/off
io_on = BooleanToggle(False)

pl = GhPythonScript(pt=filter)  # -> plane; inputs pt: Point3d
# ---------- pl: Python ----------
import Rhino.Geometry as rg

plane = rg.Plane(pt, rg.Vector3d.XAxis, rg.Vector3d.YAxis)
# ---------- end pl ----------

# ----
# Robot TCP Adjustment
tcp_h = Slider(410, range=0..500)

# ----
# Set robot to installation position
# BEFOR or AFTER printing.
installation = Button()

# ----
# Move robot to a certain point
send = Button()

send_to = GhPythonScript(joints=robot_joint_angles, target_plane=pl, tcp_height=tcp_h, io_on=io_on, installationPos=installation, send=send)  # -> script; inputs joints: list, target_plane: Plane, io_on: Boolean, installationPos: Boolean
# ---------- send_to: Python ----------
from compas_rhino import unload_modules
unload_modules('simple_ur_script')
unload_modules('simple_comm')
import simple_comm as c
import simple_ur_script as ur
import Rhino.Geometry as rg
import math as m

# End-effector dimension
ed_x = 0
ed_y = 80.00
ed_z = 95.75

T = rg.Transform.Translation(0,0,tcp_height)
target_plane.Transform(T)
velocity = 0.10
acceleration = 0.05
blend_redious = 0.005

if installationPos:
    joints = [m.radians(joints[i]) for i in range(len(joints))]
    script = ""
    script += ur.move_j(joints, acceleration, velocity)
    script = c.concatenate_script("def sendToSafePos():",script)
    c.send_script(script,"192.168.10.10")

elif send:
    script = ""
    if io_on:
        script += ur.set_digital_out(0, True)
        script += ur.set_standard_analog_out(0,0.28)

    else:
        script += ur.set_digital_out(0, False)
        script += ur.set_standard_analog_out(0,0)

    #script += ur.set_tcp_by_angles(ed_x, ed_y, ed_z, m.radians(-180.0), m.radians(0.0), m.radians(-90.0))
    
    script += ur.set_tcp_by_angles(0, 0, 0, m.radians(-90.0), m.radians(0.0), m.radians(-90.0))#BIG!!!!
    script += ur.move_l(target_plane, acceleration, velocity)
#    script += ur.sleep(10.0)
#    script += ur.set_digital_out(0, False)
#    script += ur.set_standard_analog_out(0,0)
    script = c.concatenate_script("def sendToPt():",script)
    c.send_script(script,"192.168.10.10")
# ---------- end send_to ----------

# ---- group: Select Target Pt
list_4 = ValueList({"Slicing Brep": 0, "Test infill": 1}, selected="Test infill")
# Modify Geometry
filter_2 = StreamFilter(Gate=list_4, Stream0=dividecrvs.targetPoint_nList, Stream1=python_2.targetPoint_nList)

# ----
# Fabrication Data
python_3 = GhPythonScript(ori_pt=pt, xAxis_pt=pt_2, yAxis_pt=pt_3, targetPoint_nList=filter_2, velocity=velocity, acceleration=acceleration)  # -> vis, targetPlane_nList, vel_nList, accel_nList, blend_nList, extr_nList; inputs ori_pt: Point3d, xAxis_pt: Point3d, yAxis_pt: Point3d, targetPoint_nList: list
# ---------- python_3: Python ----------
__author__ = "Fen"
import Rhino.Geometry as rg
import ghpythonlib.components as ghc
import ghpythonlib.treehelpers as th
from compas_ghpython import ghtree_to_list, list_to_ghtree 
from scriptcontext import sticky
"-------Import Personal Library-------"
from compas_rhino import unload_modules
unload_modules('e2e_pathSlicer')
import e2e_pathSlicer as ps
import utils as ut
"-------------------------------------"

def set_robot_basePlane(ori_pt, xAxis_pt, yAxis_pt):
    """ This function constructs the robot base plane form 3 calibrated points.
    """
    robot_basePlane = rg.Plane(ori_pt, xAxis_pt - ori_pt, yAxis_pt - ori_pt)
    return robot_basePlane

def rhino_to_robot_space(rhino_plane, rhino_basePlane, robot_basePlane):
    """ this function translates planes from the rhino cordinate system to
        the robot cordinate system.
        It uses "inputBase_pt", which should use the bottom left corner point(from top view in Rhino)
        to construct a "rhino plane",
        and get a transform matrix from it to the "robot base plane"
    """
    robot_plane = rhino_plane.Clone()
    _matrix = rg.Transform.PlaneToPlane(rhino_basePlane, robot_basePlane)
    robot_plane.Transform(_matrix)
    return robot_plane


velocity = velocity/1000
acceleration = acceleration/1000

"""Here we create robot way planes"""
rhino_basePlane = rg.Plane.WorldXY
robot_basePlane = rg.Plane(ori_pt, xAxis_pt - ori_pt, yAxis_pt - ori_pt)

targetPlane_nList = []
vis = []
for pts in targetPoint_nList:
    rhino_planes = [rg.Plane(pt, rg.Vector3d.ZAxis) for pt in pts]
    target_planes = [rhino_to_robot_space(rhino_plane, rhino_basePlane, robot_basePlane) for rhino_plane in rhino_planes]
    targetPlane_nList.append(target_planes)
    vis.extend(target_planes)
    

"""Here we create other parameters for robot"""
vel_nList =[]
accel_nList =[]
blend_nList =[]
extr_nList =[]
for i,pts in enumerate(targetPoint_nList):
    vels = []
    accels = []
    blends = ps.calc_blendRadius(pts, buffer=0.001*0.9)
    blends = []
    extrs = []
    if i==0:
        for pt in pts:
            vels.append(velocity)
            accels.append(acceleration)
            extrs.append(True)
            #blends.append(15*0.001)
    else:
        for pt in pts:
            vels.append(velocity)
            accels.append(acceleration)
            extrs.append(True)
            #blends.append(15*0.001)
    vel_nList.append(vels)
    accel_nList.append(accels)
    blend_nList.append(blends)
    extr_nList.append(extrs)
    
    
print blend_nList[0]
# ---------- end python_3 ----------

# ----
# Simulation
pt_5 = Point(python_3.vis)
pline_2 = PolyLine(Vertices=pt_5, Closed=False)
points = PointList(Points=pt_5, Size=Slider(2.3, range=0.5..5))

# ----
# Run test print
send_2 = Button()

# ----
# Add a note to the name
panel_6 = Panel("infillBox")

# ----
# Export fab data as a json file
export = Button()

toggle = BooleanToggle(False)

# ----
# Send to UR
test_print = GhPythonScript(
    targetPlane_nList=python_3.targetPlane_nList,
    vel_nList=python_3.vel_nList,
    accel_nList=python_3.accel_nList,
    blend_nList=python_3.blend_nList,
    extr_nList=python_3.extr_nList,
    send=send_2)  # -> out, script; inputs targetPlane_nList: list, vel_nList: list, accel_nList: list, blend_nList: list, extr_nList: list, send: Boolean
# ---------- test_print: Python ----------
from compas_rhino import unload_modules
unload_modules('simple_ur_script')
unload_modules('simple_comm')
import simple_comm as c
import simple_ur_script as ur
import Rhino.Geometry as rg
import math as m

ed_x = 0
ed_y = 80.00
ed_z = 95.75
tcp_height =10
T = rg.Transform.Translation(0,0,tcp_height)

if send:
    script = ""
    script += ur.set_tcp_by_angles(0, 0, 0, m.radians(-90.0), m.radians(0.0), m.radians(-90.0))#BIG!!!!

    for i,(planes,vels,accels,blends,extrs) in enumerate(zip(targetPlane_nList,vel_nList,accel_nList,blend_nList,extr_nList)):
        for j,(plane,vel,accel,blend,extr) in enumerate(zip(planes,vels,accels,blends,extrs)):
            if i==0 and j ==0:
                planeTo = plane.Clone()
                safeT = rg.Transform.Translation(0,100,0)
                planeTo.Transform(safeT)
                script += ur.move_l(planeTo, 0.05, 0.2)
                script += ur.sleep(0.2)
                script += ur.move_l_blend(plane, accel, vel, blend)
                script += ur.textmsg("ur is at the safe point", "!!!")
                
            else:
                script += ur.move_l_blend(plane, accel, vel, blend)
    script = c.concatenate_script("def ClayPrint():",script)
    c.send_script(script,"192.168.10.10")
# ---------- end test_print ----------

# ----
# Export as Json
# Json to UR
export_json = GhPythonScript(
    targetPlane_nList=python_3.targetPlane_nList,
    vel_nList=python_3.vel_nList,
    accel_nList=python_3.accel_nList,
    blend_nList=python_3.blend_nList,
    extr_nList=python_3.extr_nList,
    note=panel_6,
    export=export)  # -> attri, json_name, file_path; inputs targetPlane_nList: list, vel_nList: list, accel_nList: list, blend_nList: list, extr_nList: list
# ---------- export_json: Python ----------
import Rhino.Geometry as rg
import json
import os
from datetime import datetime

""" TCP configuration needs to be implemented """
ed_x = 0
ed_y = 80.00
ed_z = 95.75
tcp_height =10
T = rg.Transform.Translation(0,0,tcp_height)


""" generating fabrication data """
data = {}
count = 0
for i,(planes,vels,accels,blends,extrs) in enumerate(zip(targetPlane_nList,vel_nList,accel_nList,blend_nList,extr_nList)):
    for j,(plane,vel,accel,blend,extr) in enumerate(zip(planes,vels,accels,blends,extrs)):
        point = {
        'frame' : {
            'point' : [plane.OriginX, plane.OriginY, plane.OriginZ],
            'xAxis' : [1.0, 0.0, 0.0],
            'yAxis' : [0.0, 1.0, 0.0]
            },
        'velocity' : vel,
        'acceleration' : accel,
        'blend_radus' : blend,
        'extruder_toggle': extr,
        'layer' : i,
        'item' :j
        }
        data[count] = point
        count+=1

""" get location of GH fle"""
ghComp = ghenv.Component
ghDoc = ghComp.OnPingDocument()

""" the full path of the folder to save gh file """
current_path = ghDoc.FilePath
""" the target directory to dump json """
folder_path = os.path.abspath(os.path.join(current_path,"..","..","03_fabrication_data"))

""" add time to the name """
now = datetime.today()
currentDate = now.strftime("%y%m%d_")
currentTime = now.strftime("%H%M")
print "time hhmm: ",currentTime

""" add a note to the name """
addNote = bool(note and not note.isspace())
if addNote:
    attri =  "%s_"%(note) + currentDate + currentTime
else:
    attri = currentDate + currentTime

""" combining directory with file name """
json_name = 'e2e_printpoints_%s.json'%(attri)
print "json name: ", json_name
file_path = os.path.join(folder_path, json_name)
print "file path and name: ",file_path

""" exort json"""
if export:
    with open(file_path, 'w') as f:
            f.write(json.dumps(data, indent=3, sort_keys=True))
# ---------- end export_json ----------
panel_7 = Panel(export_json.attri)
panel_8 = Panel(export_json.file_path)
panel_9 = Panel(export_json.json_name)
py = PythonScript()  # -> folder_path
# ---------- py: Python ----------
import sys
import os

ghComp = ghenv.Component
ghDoc = ghComp.OnPingDocument()

# the full path of the gh file
current_path = ghDoc.FilePath
# the current directory 
folder_path = os.path.abspath(os.path.join(current_path,"..","..","03_fabrication_data"))

print folder_path
# ---------- end py ----------
x = Slider(133, range=-1000..1000)
y = Slider(300, range=-1000..1000)
z = Slider(-5, range=-1000..1000)
panel_10 = Panel(py)
merge = Merge(Data1=x, Data2=y, Data3=z)

panel_11 = Panel(test_print.script)
planes = Plane([Plane(origin=(-592.9740624, -240.7581164, 579.9648411), x=(-1, 0, 0), y=(0, -1, 0)), Plane(origin=(-592.9740624, -240.7581164, 393.8883092), x=(-1, 0, 0), y=(0, -1, 0)), Plane(origin=(-592.9740624, -240.7581164, 107.9994828), x=(-1, 0, 0), y=(0, -1, 0))])
send_3 = Button()

# ---- group: Create UR script from Json
python_4 = GhPythonScript(
    recompute=Button(),
    json_name=panel_9,
    folder_path=py,
    world_origin=merge,
    travel_velocity=Slider(30, range=0..100),
    send=send_3)  # -> out, script; inputs world_origin: list, travel_velocity: Int32, send: Boolean
# ---------- python_4: Python ----------
import os
import json
import Rhino.Geometry as rg
import math as m
import simple_comm as c
import simple_ur_script as ur
from compas.geometry import Frame

def compasFrame_toRhinoPlane(data):
    x=data['frame']['point'][0]
    y=data['frame']['point'][1]
    z=data['frame']['point'][2]
    return rg.Plane(rg.Point3d(x,y,z), rg.Vector3d.ZAxis)


filename = os.path.join(folder_path,json_name)
print filename

with open(filename, 'r') as f:
    fabrication_data = json.load(f)
    
#script, print_frames = ur_script.create_script(data, world_origin, travel_velocity)



ed_x = 0
ed_y = 80.00
ed_z = 95.75
tcp_height =10
T = rg.Transform.Translation(0,0,tcp_height)
#target_plane.Transform(T)


if not send:
    script = ""
    script += ur.set_tcp_by_angles(0, 0, 0, m.radians(-90.0), m.radians(0.0), m.radians(-90.0))
    
    for i in range(len(fabrication_data)):
        pl_data = fabrication_data[str(i)]
        if i ==0:
            """ construct a rhino target plane """
            plane = compasFrame_toRhinoPlane(pl_data)
            """ construct a safe plane """
            safe_plane = plane.Clone()
            safeT = rg.Transform.Translation(0,100,0)
            safe_plane.Transform(safeT)
            """ move to safe plane """
            script += ur.move_l_blend(safe_plane, pl_data['acceleration'],  pl_data['velocity'],pl_data['blend_radus'])
            """ move to target plane """
            script += ur.move_l_blend(plane, pl_data['acceleration'],  pl_data['velocity'],pl_data['blend_radus'])
        else:
            """ construct a rhino target plane """
            plane = compasFrame_toRhinoPlane(pl_data)
            """ move to target plane """
            script += ur.move_l_blend(plane, pl_data['acceleration'],  pl_data['velocity'],pl_data['blend_radus'])
            
            
            if i != len(fabrication_data)-1:
                current_item = pl_data['item']
                next_item = fabrication_data[str(i+1)]['item']
                if next_item < current_item:
                    script += ur.textmsg(int(pl_data['layer']), ' layer is finished')
            elif i == len(fabrication_data)-1:
                    script += ur.textmsg(int(pl_data['layer']), ' layer is finished, print is DONE')
                    """ move to safe config """
    
    script = c.concatenate_script("def testPrint():",script)
#    c.send_script(script,"192.168.10.10")
# ---------- end python_4 ----------

# ----
Y = UnitY(Factor=1)  # disabled
Z = UnitZ(Factor=1)  # disabled
X = UnitX(Factor=1)  # disabled
panel_12 = Panel("-1")  # disabled
multiplication = Multiplication(A=Z, B=panel_12)  # disabled
multiplication_2 = Multiplication(A=X, B=panel_12)  # disabled
multiplication_3 = Multiplication(A=Y, B=panel_12)  # disabled
vec = Vector(multiplication_2)  # disabled
vec_2 = Vector(multiplication_3)  # disabled
pt_6 = Point(<point referenced from the Rhino model>)  # disabled
pt_7 = Point(<point referenced from the Rhino model>)  # disabled
pt_8 = Point(<point referenced from the Rhino model>)  # disabled
pl_2 = ConstructPlane(Origin=pt_7, XAxis=vec, YAxis=vec_2)  # disabled
pl_3 = ConstructPlane(Origin=pt_6, XAxis=vec, YAxis=vec_2)  # disabled
pl_4 = ConstructPlane(Origin=pt_8, XAxis=vec, YAxis=vec_2)  # disabled
panel_13 = Panel("1")  # disabled
toggle_2 = BooleanToggle(False)  # disabled
panel_14 = Panel(python_4.script)

# ----
# ROS Connection
# Load Robot from urdf
py_2 = GhPythonScript()  # -> urdf_source; disabled
# ---------- py_2: Python ----------
import os
import sys

filepath = ghenv.Component.Attributes.Owner.OnPingDocument().FilePath
path = os.path.abspath(os.path.join(filepath, "..", ".."))
print(path)

urdf_source = os.path.abspath(os.path.join(path,"..","docs","robot_description"))
# ---------- end py_2 ----------
panel_15 = Panel(py_2)  # disabled
robot_name = ValueList({"ur10_2m"}, selected="ur10_2m")  # disabled
list_5 = ValueList({"simulation": 0, "real_robot": 1}, selected="simulation")  # disabled
connect = Button()  # disabled
disconnect = Button()  # disabled
restart = Button()  # disabled
ros = PythonScript(restart=restart, ip=list_5)  # -> ros_client; disabled
# ---------- ros: Python ----------
import time
import logging
import scriptcontext as sc

from compas_fab.backends import RosClient
from System import TimeSpan
from System.Threading import ManualResetEventSlim


LOGGER = logging.getLogger('roslibpy')

guid = str(ghenv.Component.InstanceGuid)
ros_client_key = "rosclient_" + guid

previous_client = sc.sticky.get(ros_client_key, None)
if previous_client:
    previous_client.terminate()

if ip == 0: #local
    ros_client = RosClient('127.0.0.1', 9090) #local, own laptop
elif ip == 1: #real robot
    ros_client = RosClient('127.0.0.1', 9090) #place holder

waitLock = ManualResetEventSlim(False)
ros_client.on_ready(lambda: waitLock.Set())

if not waitLock.Wait(TimeSpan.FromSeconds(5)):
    raise Exception('Unable to connect to ROS')

LOGGER.info('Connected to ROS')
# ---------- end ros ----------
path = PythonScript(path=panel_15, robot_name=robot_name)  # -> urdf_source; disabled
# ---------- path: Python ----------
import os

urdf_source = os.path.join(os.path.abspath(path), robot_name)

assert(os.path.isdir(urdf_source))
#print urdf_source
# ---------- end path ----------
units = ValueList({"m": 1, "mm": 1000}, selected="mm")  # disabled
load = BooleanToggle(True)  # disabled
connect_2 = PythonScript(ros_client=ros, connect=connect, disconnect=disconnect)  # -> out, ros_client; disabled
# ---------- connect_2: Python ----------
import logging
from System import TimeSpan
from System.Threading import ManualResetEventSlim

LOGGER = logging.getLogger('roslibpy')

if connect:
    if not ros_client.is_connected:
        LOGGER.debug('Connecting...')
        waitLock = ManualResetEventSlim(False)
        ros_client.on_ready(lambda: waitLock.Set())
        ros_client.connect()

        if not waitLock.Wait(TimeSpan.FromSeconds(5)):
            raise Exception('Unable to connect to ROS')
        LOGGER.debug('Reconnected')

if disconnect:
    if ros_client.is_connected:
        ros_client.terminate()
        LOGGER.debug('Terminated')
# ---------- end connect_2 ----------
panel_16 = Panel(path)  # disabled
robot = PythonScript(urdf_source=path, ros_client=connect_2.ros_client, scale_factor=units, load=load)  # -> out, robot; disabled
# ---------- robot: Python ----------
import os
from scriptcontext import sticky as st
import compas


from compas.robots import RobotModel
from compas.robots import LocalPackageMeshLoader
from compas_fab.ghpython import RobotArtist
from compas_fab.robots import RobotSemantics as RobotSemantics

from compas_fab.robots import Robot as Robot
from compas_fab.backends import RosClient

# Set high precision to import meshes defined in meters
compas.PRECISION = '12f'

# store data in component
guid = str(ghenv.Component.InstanceGuid)
robot_key = "robot_" + guid


if robot_key not in st:
    st[robot_key] = None


if ros_client and ros_client.is_connected and load == True:
    
    model = RobotModel.from_urdf_file(os.path.join(urdf_source, 'robot_description.urdf'))
    model.load_geometry(LocalPackageMeshLoader(urdf_source, 'robot_description'))
    semantics = RobotSemantics.from_srdf_file(os.path.join(urdf_source, 'robot_description.srdf'), model)
    artist = RobotArtist(model)
    robot = Robot(model, artist, semantics)
    
    robot.scale(scale_factor)
    st[robot_key] = robot

robot = st[robot_key]

if robot:
    robot.client = ros_client

print os.path.join(urdf_source, 'robot_description.urdf')
# ---------- end robot ----------
info = PythonScript(robot=robot.robot)  # -> out, main_group_name; disabled
# ---------- info: Python ----------
if robot:
    robot.info()
    main_group_name = robot.main_group_name
# ---------- end info ----------
main_planning_group = Text(info.main_group_name)  # disabled
show = ValueList({"scan_pose": 0, "safe_pose": 1, "slider": 2}, selected="scan_pose")  # disabled
state = ValueList({"forward_kinematics": 0, "plan_cartesian_motion": 1}, selected="plan_cartesian_motion")  # disabled
show_end_effector_frame = BooleanToggle(True)  # disabled
show_visual = BooleanToggle(True)  # disabled
show_axes = BooleanToggle(False)  # disabled
colour_swatch = ColourSwatch(SwatchColor=RGB(105, 105, 105))  # disabled

panel_17 = Panel(connect_2.ros_client)  # disabled
panel_18 = Panel(main_planning_group)  # disabled

# ----
# Configuration
j1 = Slider(9, range=-360..360)  # disabled
j2 = Slider(-95, range=-360..360)  # disabled
j3 = Slider(160, range=-360..360)  # disabled
j4 = Slider(115, range=-360..360)  # disabled
j5 = Slider(-100, range=-360..360)  # disabled
j6 = Slider(0, range=-360..360)  # disabled
forward_kinematics = PythonScript(robot=robot.robot, group=main_planning_group, show=show, j1=j1, j2=j2, j3=j3, j4=j4, j5=j5, j6=j6)  # -> configuration; disabled
# ---------- forward_kinematics: Python ----------
import math
from compas_fab.robots import Configuration

if robot:
    if show == 0:
        joint_positions = [-10 + math.degrees(3.14159), -105, 165, 120, -80, 0]
    if show == 1:
        joint_positions = [35 + math.degrees(3.14159), -35, 125, 90, -90, 0]
    if show == 2:
        joint_positions = [j1 + math.degrees(3.14159), j2, j3, j4, j5, j6]
    joint_positions = [math.radians(a) for a in joint_positions]
    types = robot.get_configurable_joint_types(group)
    configuration = Configuration(joint_positions, types)
    print configuration
# ---------- end forward_kinematics ----------

# ---- group: cartesian motion
# Plan Cartesian Motion
list_6 = ValueList({"0", "1"}, selected="0")  # disabled
py_3 = PythonScript(robot=robot.robot)  # -> configuration; disabled
# ---------- py_3: Python ----------
from compas_fab.robots import Configuration

if robot:
    types = robot.get_configurable_joint_types()
    values = [0] * len(types)

    configuration = Configuration(values, types)
    print configuration
# ---------- end py_3 ----------
start_configuration = Data(forward_kinematics)  # disabled
planes_2 = Plane([pl_2, pl_4, pl_3])  # disabled
compute = BooleanToggle(True)  # disabled
filter_3 = StreamFilter(Gate=list_6, Stream0=start_configuration, Stream1=py_3)  # disabled
plan_cartesian_motion = PythonScript(
    robot=robot.robot,
    group=main_planning_group,
    start_configuration=filter_3,
    planes=planes_2,
    iteration=panel_13,
    reverse_list=toggle_2,
    max_step=10,
    compute=compute)  # -> out, robot, group, trajectory; inputs planes: list of Plane, iteration: Int32, reverse_list: Boolean; disabled
# ---------- plan_cartesian_motion: Python ----------
import logging
import scriptcontext as sc
from compas.geometry import Frame
from compas.geometry import Translation
import math
from compas_fab.robots import Configuration

guid = str(ghenv.Component.InstanceGuid)
response_key = "response_" + guid
translation_vector_key = "translation_vector" + guid
if response_key not in sc.sticky:
    sc.sticky[response_key] = None

if robot:
    if robot.client:
        if robot.client.is_connected:
            if start_configuration and compute:
                
                joint_positions = [math.radians(a) for a in [0, 0, 0, 0, 0, 0]]
                types = robot.get_configurable_joint_types(group)
                configuration = Configuration(joint_positions, types)
                frames_temp = robot.transformed_frames(configuration, group)
                f1 = frames_temp[8]
                f2 = frames_temp[9]
                translation_vector = [f1[0][1] - f2[0][1], 0, f1[0][2] - f2[0][2]]
                sc.sticky["translation_vector_key"] = translation_vector
                
                frames = []
                
                for i in range(iteration):
                    if reverse_list and i > 0:
                        planes.reverse()
                    for plane in planes:
                        frame = Frame(plane.Origin, plane.ZAxis, -plane.XAxis)
                        x = Translation.from_vector(frame.xaxis.unitized() * -translation_vector[0])
                        z = Translation.from_vector(frame.zaxis.unitized() * translation_vector[2])
                        t_frame = frame.transformed(x)
                        t_frame.transform(z)
                        frames.append(t_frame)
                
                options = {'max_step':float(max_step)}
                response = robot.plan_cartesian_motion(frames, start_configuration=start_configuration, group=group, options=options)
                sc.sticky[response_key] = response
        else:
            print("Robot is not connected")
            sc.sticky[response_key] = None

trajectory = sc.sticky[response_key]
# ---------- end plan_cartesian_motion ----------
vis = PythonScript(trajectory=plan_cartesian_motion.trajectory)  # -> P, V, A, time; disabled
# ---------- vis: Python ----------
from compas_ghpython import list_to_ghtree

if trajectory:

    positions = []
    velocities = []
    accelerations = []
    time_from_start = []

    for p in trajectory.points:
        positions.append(p.positions)
        velocities.append(p.velocities)
        accelerations.append(p.accelerations)
        time_from_start.append(p.time_from_start.seconds)

    P = list_to_ghtree(list(zip(*positions)))
    V = list_to_ghtree(list(zip(*velocities)))
    A = list_to_ghtree(list(zip(*accelerations)))
    time = time_from_start[-1]
# ---------- end vis ----------
panel_19 = Panel(plan_cartesian_motion.out)  # disabled
py_4 = PythonScript(robot=plan_cartesian_motion.robot, group=plan_cartesian_motion.group, trajectory=plan_cartesian_motion.trajectory)  # -> start_configuration, configurations, full_configurations, frames, planes, fraction; disabled
# ---------- py_4: Python ----------
from compas_ghpython import draw_frame

joint_positions = []

if trajectory:
    configurations = trajectory.points
    start_configuration = trajectory.start_configuration
    fraction = trajectory.fraction
    time = trajectory.time_from_start
    full_configurations = [robot.merge_group_with_full_configuration(c, trajectory.start_configuration, group) for c in configurations]
    frames = [robot.forward_kinematics(c, group, options=dict(solver='model')) for c in full_configurations]
    planes = [draw_frame(frame) for frame in frames]
    P = [plane.Origin for plane in planes]
# ---------- end py_4 ----------
prismatic = QuickGraph(vis.P, SortOrder=0)  # disabled
panel_20 = Panel("positions")  # disabled
colour_swatch_2 = ColourSwatch(SwatchColor=RGB(59, 137, 161))  # disabled
fraction = Panel(py_4.fraction)  # disabled
graph = QuickGraph(vis.A, SortOrder=0)  # disabled
panel_21 = Panel("accelerations")  # disabled
scale = Scale(Geometry=py_4.planes, Center=Point(0, 0, 0), Factor=0.001)  # -> Geometry, Transform; disabled
preview = CustomPreview(Geometry=scale.Geometry, Material=colour_swatch_2)  # disabled
start = Button()  # disabled
reset = Button()  # disabled
step = Button()  # disabled
panel_22 = Panel("velocities")  # disabled
graph_2 = QuickGraph(vis.V, SortOrder=0)  # disabled
pline_3 = PolyLine(Vertices=scale.Geometry, Closed=False)  # disabled
counter = CountThroughList(L=py_4.full_configurations, start=start, step=step, reset=reset)  # -> item; inputs L: list, start: Boolean; disabled
# ---------- counter: Python ----------
from scriptcontext import sticky as st
from compas_ghpython.utilities import update_component


interval = 1

# store data in component
guid = str(ghenv.Component.InstanceGuid)
counter_key = "counter_" + guid
running_key = "running_" + guid

if counter_key not in st:
    st[counter_key] = 0

if running_key not in st:
    st[running_key] = False

if start:
    st[running_key] = True

if step:
    if st[counter_key] < len(L) - 1:
        st[counter_key] += 1
    
if len(L):
    item = L[st[counter_key]]

if st[running_key]:
    if st[counter_key] < len(L) - 1:
        st[counter_key] += 1
        update_component(ghenv, interval)
    else:
        st[counter_key] = 0
        st[running_key] = False
# ---------- end counter ----------

# ----
multiplication_4 = Multiplication(A=vis.time, B=4.25)  # disabled
filter_4 = StreamFilter(Gate=state, Stream0=forward_kinematics, Stream1=counter)  # disabled
visualize = PythonScript(
    mode=list_5,
    robot=robot.robot,
    robot_name=robot_name,
    configuration=filter_4,
    group=main_planning_group,
    scale_factor=units,
    show_visual=show_visual,
    show_axes=show_axes,
    show_end_effector_frame=show_end_effector_frame)  # -> visual, axes, axes_color, ee_frame_vis, ee_color, ee_frame, ee_plane; disabled
# ---------- visualize: Python ----------
from System.Drawing import Color
from compas_ghpython.utilities import draw_pipes
from compas_ghpython import draw_frame
from compas.geometry import Point
from compas.geometry import Vector
from compas.geometry import Translation

frames = []

size = .200 * scale_factor 
size_w = 2 * scale_factor 
radius = .008 * scale_factor
radius_w = .018 * scale_factor 

red = Color.FromArgb(255, 0, 0)
green = Color.FromArgb(0, 255, 0)
blue = Color.FromArgb(0, 0, 255)

frame_colors = [red, green, blue]


def pipes_from_frame(frame, size, radius): 
    pipes = []
    for axis in [frame.xaxis, frame.yaxis, frame.zaxis]:
        pipe = {}
        pipe['points'] = [list(frame.point), list(Point(*frame.point) + Vector(*axis) * size)]
        pipe['radius'] = radius
        pipes.append(pipe)
    return pipes


if robot and configuration and mode == 0:
    robot.update(configuration, visual=show_visual, collision=False)
    if show_visual:
        visual = robot.artist.draw_visual()
    if show_axes:
        pipes = []
        axes_color = []
        frames = robot.transformed_frames(configuration, group)
        for frame in frames:
            pipes += pipes_from_frame(frame, size, radius)
            axes_color += frame_colors
        axes = draw_pipes(pipes, cap=1)
    
    
    if show_end_effector_frame:
        frames = robot.transformed_frames(configuration, group)
        print len(frames)
        ee_frame = frames[5]
        ee_plane = draw_frame(ee_frame)
        print("End-effector", ee_frame)

        #Draw
        ee_pipes = pipes_from_frame(ee_frame, size, radius)
        ee_frame_vis = draw_pipes(ee_pipes, cap=1)
        ee_color = frame_colors
# ---------- end visualize ----------
preview_2 = CustomPreview(Geometry=visualize.ee_frame_vis, Shader=visualize.ee_color)  # disabled
preview_3 = CustomPreview(Geometry=visualize.visual, Shader=colour_swatch)  # disabled
preview_4 = CustomPreview(Geometry=visualize.axes, Shader=visualize.axes_color)  # disabled

# ---- group: cartesian motion (continued)
time_sec = Panel(multiplication_4)  # disabled

# ----
division = Division(A=time_sec, B=60)  # disabled
time_min = Panel(division)  # disabled
