# Grasshopper definition exportHeader.ghx (Grasshopper 1.0.7)

panel = Panel("""#define dirPin 2
#define stepPin 3
#define relay_1 4
#define relay_2 7
#define relay_3 8
#define relay_4 12""")
python = GhPythonScript(define="#define ", ur_vel="20")  # -> out, urVel_header, extrVel_header; inputs ur_vel: Int32
# ---------- python: Python ----------
__author__ = "Fen"
import Rhino.Geometry as rg
import ghpythonlib.components as ghc
import ghpythonlib.treehelpers as th
from compas_ghpython import ghtree_to_list, list_to_ghtree 

ur_vel = ur_vel/1000
urVel_header = define + str("ur_vel ") +str(ur_vel)
# ---------- end python ----------
merge = Merge(Data1=panel, Data2=python.urVel_header)
join = TextJoin(Text=panel)
lng = ListLength(List=panel)
path = FilePath("C:\Users\Fen\Documents\03_USI_AAM\00_WinterSchool_EarthToEarth\Script_Files\E2E_controller\E2E_controller\test.h")
panel_2 = Panel(merge)
panel_3 = Panel(lng)
panel_4 = Panel(join)
c_script = CSharpScript(save=Button(), path=path, data=merge)  # inputs save: Boolean, path: String, data: list of String
# ---------- c_script: C# ----------
    if(save){
      var fileinfo = new System.IO.FileInfo(path);
      if(!fileinfo.Directory.Exists){
        fileinfo.Directory.Create();
      }
      var sw = fileinfo.CreateText();
      for(int i = 0; i < data.Count; i++){

        string row = data[i];

        if(i < data.Count - 1){
          sw.WriteLine(row);

        }
        else{
          sw.Write(row);
        }
      }
      sw.Flush();
      sw.Close();
    }
# ---------- end c_script ----------
