# Grasshopper definition 00_UR_basicSettings.ghx (Grasshopper 1.0.7)
# plug-ins: Human

geo = Geometry(<point referenced from the Rhino model>)
number_slider = Slider(-1000, range=-1000..2000.001)  # disabled
number_slider_2 = Slider(1000, range=0..1000)  # disabled
geo_2 = Geometry(Point(30000, 0, 0))  # disabled

print_pt_dist = Slider(20, range=0..1000)  # disabled
gap_length = Slider(30, range=0..1000)  # disabled
step_width = Slider(360, range=0..1000)  # disabled
support_width = Slider(100, range=0..1000)  # disabled
step_height = Slider(110, range=0..1000)  # disabled
support_height = Slider(32, range=0..1000)  # disabled
bridge_width = Slider(50, range=0..1000)  # disabled
step_length = Slider(500, range=0..1000)  # disabled
layer_height = Slider(8, range=0..20)  # disabled
gap_width = Slider(50, range=0..1000)  # disabled
xy = XYPlane(Origin=geo)  # disabled
simple_step_generator = GhPythonScript(
    origin_plane=xy,
    step_width=step_width,
    support_width=support_width,
    step_height=step_height,
    support_height=support_height,
    bridge_width=bridge_width,
    gap_width=gap_width,
    step_length=step_length,
    layer_height=layer_height,
    print_pt_dist=print_pt_dist)  # -> out, print_pts_array_dense, all_print_pts_dense, temp_geom, real_layer_height, no_layers, real_no_support_layers, no_support_layers; inputs origin_plane: Plane, step_width: Int32, support_width: Int32, step_height: Int32, bridge_width: Int32, gap_width: Int32, step_length: Int32, layer_height: Int32, print_pt_dist: Int32; disabled
# ---------- simple_step_generator: Python ----------
__author__ = "jend"
__version__ = "2023.01.20"

import Rhino.Geometry as rg
import math as m
debug = False

temp_geom = []

op = origin_plane
vx = op.XAxis
vy = op.YAxis
vz = op.ZAxis


# base pts
pt_1 = op.Origin
pt_2 = pt_1 + vx * step_width
pt_3 = pt_2 + vy * (step_length/2 - bridge_width/2)
pt_4 = pt_3 + vx * gap_width
pt_5 = pt_2 + vx * gap_width
pt_6 = pt_5 + vx * (support_width - gap_width)
pt_7 = pt_6 + vy * step_length
pt_8 = pt_7 - vx * (support_width - gap_width)
pt_9 = pt_8 - vy * (step_length/2 - bridge_width/2)
pt_10 = pt_9 - vx * gap_width
pt_11 = pt_8 - vx * gap_width
pt_12 = pt_1 + vy * step_length

base_pts = [pt_1, pt_2, pt_3, pt_4, pt_5, pt_6, pt_7, pt_8, pt_9, pt_10, pt_11, pt_12]

pline_pts = base_pts
pline_pts.append(pline_pts[0])
base_pline = rg.Curve.CreateInterpolatedCurve(pline_pts, 1)

temp_geom.extend(base_pts)
temp_geom.append(base_pline)


# layer heights and numbers
total_height = step_height + support_height

if debug:
    print total_height
    print total_height/layer_height
    print m.floor(total_height/layer_height)
    print total_height/m.floor(total_height/layer_height)

no_layers = int(m.floor(total_height/layer_height))
real_layer_height = total_height / no_layers

if debug:
    print m.floor(step_height / real_layer_height)

real_no_support_layers = step_height / real_layer_height
no_support_layers = int(m.floor(step_height / real_layer_height))


# print pts
# no_layers, no_support_layers, real_layer_height


support_layer_pts = [pt_2, pt_3, pt_4, pt_5, pt_6, pt_7, pt_8, pt_9, pt_10, pt_11, pt_12, pt_1, pt_2]
layer_pts = [pt_2, pt_11, pt_12, pt_1, pt_2]

print_pts_array = []
for i in range(no_layers):
    print_pts = []
    temp_height = i * real_layer_height
    if i < no_support_layers:
        for j,pt in enumerate(support_layer_pts):
            temp_pt = rg.Point3d(pt)
            temp_pt.Z = temp_height
            print_pts.append(temp_pt)
    else:
        for j,pt in enumerate(layer_pts):
            temp_pt = rg.Point3d(pt)
            temp_pt.Z = temp_height
            print_pts.append(temp_pt)
    temp_geom.extend(print_pts)
    temp_geom.append(rg.Curve.CreateInterpolatedCurve(print_pts, 1))
    print_pts_array.append(print_pts)


# for robot path
all_print_pts_dense = []
print_pts_array_dense = []

for i,print_pts in enumerate(print_pts_array):
    temp_print_pts = []
    for j,print_pt in enumerate(print_pts):
        if j < len(print_pts)-1:
            temp_line_crv = rg.LineCurve(print_pt, print_pts[j+1])
            temp_params = temp_line_crv.DivideByLength(print_pt_dist, True)
            if temp_params == None:
                count = 1
            else:
                count = len(temp_params)
            temp_params = temp_line_crv.DivideByCount(count, True)
            temp_pts = [temp_line_crv.PointAt(p) for p in temp_params]
            temp_pts.pop(0)
            temp_print_pts.extend(temp_pts)
    all_print_pts_dense.extend(temp_print_pts)
    print_pts_array_dense.append(temp_print_pts)
# ---------- end simple_step_generator ----------
idx = Slider(15, range=0..100)  # disabled
geo_3 = Geometry(simple_step_generator.all_print_pts_dense)  # disabled
layer_visu = GhPythonScript(print_pts_array=simple_step_generator.print_pts_array_dense, idx=idx)  # -> out, layer_pts; inputs print_pts_array: list, idx: Int32; disabled
# ---------- layer_visu: Python ----------
"""
"""

__author__ = "jend"
__version__ = "2023.01.20"

layer_pts = print_pts_array[idx]
# ---------- end layer_visu ----------
panel = Panel(simple_step_generator.print_pts_array_dense)  # disabled
geo_4 = Geometry(layer_visu.layer_pts)  # disabled
no_layers = Panel(simple_step_generator.no_layers)  # disabled
real_no_support_layers = Panel(simple_step_generator.real_no_support_layers)  # disabled
real_layer_height = Panel(simple_step_generator.real_layer_height)  # disabled
no_support_layers = Panel(simple_step_generator.no_support_layers)  # disabled
pline = PolyLine(Vertices=geo_4, Closed=False)  # disabled
geo_5 = Geometry(simple_step_generator.temp_geom)  # disabled

geo_6 = Geometry(Point(30000, 0, 0))  # disabled

# ---- group: simple step finger joint connection left
print_pt_dist_2 = Slider(20, range=0..1000)
gap_length_2 = Slider(30, range=0..1000)
geo_7 = Geometry(Point(30000, 0, 0))
support_width_2 = Slider(100, range=0..1000)
support_height_2 = Slider(32, range=0..1000)
gap_width_2 = Slider(50, range=0..1000)
step_width_2 = Slider(360, range=0..1000)
step_height_2 = Slider(110, range=0..1000)
bridge_width_2 = Slider(50, range=0..1000)
step_length_2 = Slider(250, range=0..1000)
layer_height_2 = Slider(8, range=0..1000)
finger_dist = Slider(250, range=0..1000)
xy_2 = XYPlane(Origin=geo)
simple_step_generator_2 = GhPythonScript(
    origin_plane=xy_2,
    step_width=step_width_2,
    support_width=support_width_2,
    step_height=step_height_2,
    support_height=support_height_2,
    bridge_width=bridge_width_2,
    gap_width=gap_width_2,
    step_length=step_length_2,
    layer_height=layer_height_2,
    finger_dist=finger_dist,
    print_pt_dist=print_pt_dist_2)  # -> out, print_pts_array_dense, all_print_pts_dense, temp_geom, real_layer_height, no_layers, real_no_support_layers, no_support_layers; inputs origin_plane: Plane, step_width: Int32, support_width: Int32, step_height: Int32, bridge_width: Int32, gap_width: Int32, step_length: Int32, layer_height: Int32, finger_dist: Int32, print_pt_dist: Int32
# ---------- simple_step_generator_2: Python ----------
__author__ = "jend"
__version__ = "2023.01.20"

import Rhino.Geometry as rg
import math as m
debug = False

temp_geom = []

op = origin_plane
vx = op.XAxis
vy = op.YAxis
vz = op.ZAxis


# base pts
pt_1 = op.Origin
pt_2 = pt_1 + vx * step_width
pt_3 = pt_2 + vy * step_length
pt_4 = pt_1 + vy * step_length

base_pts = [pt_1, pt_2, pt_3, pt_4]

pline_pts = base_pts
pline_pts.append(pline_pts[0])
base_pline = rg.Curve.CreateInterpolatedCurve(pline_pts, 1)

temp_geom.extend(base_pts)
#temp_geom.append(base_pline)

# generate fingers
finger_width = finger_dist / 2
temp_line_crv = rg.LineCurve(base_pts[1],base_pts[2])
temp_geom.append(temp_line_crv)

temp_params = temp_line_crv.DivideByLength(finger_dist, True)
if temp_params == None:
    count = 1
else:
    count = len(temp_params)

temp_params = temp_line_crv.DivideByCount(count, True)
temp_pts = [temp_line_crv.PointAt(p) for p in temp_params]

finger_pts = []
for i,pt in enumerate(temp_pts):
    if i == 0 or i == len(temp_pts)-1:
        None
    elif i > 0:
        temp_pt_1 = pt - finger_width/2 * vy
        temp_pt_2 = temp_pt_1 + support_width * vx
        temp_pt_3 = temp_pt_2 + finger_width/2 * vy
        temp_pt_4 = temp_pt_3 - support_width * vx
        
        finger_pts.extend([temp_pt_1, temp_pt_2, temp_pt_3, temp_pt_4])

temp_geom.extend(temp_pts)
temp_geom.extend(finger_pts)

# layer heights and numbers
total_height = step_height + support_height

if debug:
    print total_height
    print total_height/layer_height
    print m.floor(total_height/layer_height)
    print total_height/m.floor(total_height/layer_height)

no_layers = int(m.floor(total_height/layer_height))
real_layer_height = total_height / no_layers

if debug:
    print m.floor(step_height / real_layer_height)

real_no_support_layers = step_height / real_layer_height
no_support_layers = int(m.floor(step_height / real_layer_height))


# print pts
# no_layers, no_support_layers, real_layer_height
# new base pts

support_layer_pts = [pt_2] + finger_pts + [pt_3, pt_4, pt_1, pt_2]
layer_pts = [pt_2, pt_3, pt_4, pt_1, pt_2]

print_pts_array = []
for i in range(no_layers):
    print_pts = []
    temp_height = i * real_layer_height
    if i < no_support_layers:
        for j,pt in enumerate(support_layer_pts):
            temp_pt = rg.Point3d(pt)
            temp_pt.Z = temp_height
            print_pts.append(temp_pt)
    else:
        for j,pt in enumerate(layer_pts):
            temp_pt = rg.Point3d(pt)
            temp_pt.Z = temp_height
            print_pts.append(temp_pt)
    temp_geom.extend(print_pts)
    temp_geom.append(rg.Curve.CreateInterpolatedCurve(print_pts, 1))
    print_pts_array.append(print_pts)


# for robot path
all_print_pts_dense = []
print_pts_array_dense = []

"""
for i,print_pts in enumerate(print_pts_array):
    temp_print_pts = []
    for j,print_pt in enumerate(print_pts):
        if j < len(print_pts)-1:
            temp_line_crv = rg.LineCurve(print_pt, print_pts[j+1])
            temp_params = temp_line_crv.DivideByLength(print_pt_dist, True)
            if temp_params == None:
                count = 1
            else:
                count = len(temp_params)
            temp_params = temp_line_crv.DivideByCount(count, True)
            temp_pts = [temp_line_crv.PointAt(p) for p in temp_params]
            temp_pts.pop(0)
            temp_print_pts.extend(temp_pts)
    all_print_pts_dense.extend(temp_print_pts)
    print_pts_array_dense.append(temp_print_pts)
"""

# rounded
for i,print_pts in enumerate(print_pts_array):
    temp_print_pts = []
    for j,print_pt in enumerate(print_pts):
        if i < no_support_layers:
            if j < len(print_pts)-1 and j == len(print_pts)-4:
                temp_center = (print_pt + print_pts[j+1]) / 2
                temp_center_plane = rg.Plane(temp_center, vx, vy)
                
                tv = vx
                nv = vy
                offset_value = temp_center.DistanceTo(print_pt)
                offset_pt = temp_center + offset_value * nv
                
                temp_curve = rg.Curve.CreateInterpolatedCurve([print_pt,offset_pt,print_pts[j+1]],3,rg.CurveKnotStyle.Uniform,-tv,-tv)
                
                TS = rg.Transform.Scale(temp_center_plane, 1, .3, 1)
                temp_curve.Transform(TS)
                temp_geom.append(temp_curve)
                
                temp_geom.append(temp_curve)
                
                temp_params = temp_curve.DivideByLength(print_pt_dist, True)
                if temp_params == None:
                    count = 1
                else:
                    count = len(temp_params)
                temp_params = temp_curve.DivideByCount(count, True)
                temp_pts = [temp_curve.PointAt(p) for p in temp_params]
                temp_pts.pop(0)
                temp_print_pts.extend(temp_pts)
            elif j < len(print_pts)-1 and j != len(print_pts)-4:
                temp_line_crv = rg.LineCurve(print_pt, print_pts[j+1])
                temp_params = temp_line_crv.DivideByLength(print_pt_dist, True)
                if temp_params == None:
                    count = 1
                else:
                    count = len(temp_params)
                temp_params = temp_line_crv.DivideByCount(count, True)
                temp_pts = [temp_line_crv.PointAt(p) for p in temp_params]
                temp_pts.pop(0)#add
                temp_print_pts.extend(temp_pts)
        else:
            if j < len(print_pts)-1 and j == 1:
                temp_center = (print_pt + print_pts[j+1]) / 2
                temp_center_plane = rg.Plane(temp_center, vx, vy)
                
                tv = vx
                nv = vy
                offset_value = temp_center.DistanceTo(print_pt)
                offset_pt = temp_center + offset_value * nv
                
                temp_curve = rg.Curve.CreateInterpolatedCurve([print_pt,offset_pt,print_pts[j+1]],3,rg.CurveKnotStyle.Uniform,-tv,-tv)
                
                TS = rg.Transform.Scale(temp_center_plane, 1, .3, 1)
                temp_curve.Transform(TS)
                temp_geom.append(temp_curve)
                
                temp_geom.append(temp_curve)
                
                temp_params = temp_curve.DivideByLength(print_pt_dist, True)
                if temp_params == None:
                    count = 1
                else:
                    count = len(temp_params)
                temp_params = temp_curve.DivideByCount(count, True)
                temp_pts = [temp_curve.PointAt(p) for p in temp_params]
                temp_pts.pop(0)
                temp_print_pts.extend(temp_pts)
            elif j < len(print_pts)-1 and j != 1:
                temp_line_crv = rg.LineCurve(print_pt, print_pts[j+1])
                temp_params = temp_line_crv.DivideByLength(print_pt_dist, True)
                if temp_params == None:
                    count = 1
                else:
                    count = len(temp_params)
                temp_params = temp_line_crv.DivideByCount(count, True)
                temp_pts = [temp_line_crv.PointAt(p) for p in temp_params]
                temp_pts.pop(0)
                temp_print_pts.extend(temp_pts)
    all_print_pts_dense.extend(temp_print_pts)
    print_pts_array_dense.append(temp_print_pts)
# ---------- end simple_step_generator_2 ----------
idx_2 = Slider(3, range=0..100)
geo_8 = Geometry(simple_step_generator_2.all_print_pts_dense)
layer_visu_2 = GhPythonScript(print_pts_array=simple_step_generator_2.print_pts_array_dense, idx=idx_2)  # -> out, layer_pts; inputs print_pts_array: list, idx: Int32; same code as layer_visu
panel_2 = Panel(simple_step_generator_2.print_pts_array_dense)
geo_9 = Geometry(layer_visu_2.layer_pts)
real_layer_height_2 = Panel(simple_step_generator_2.real_layer_height)
no_layers_2 = Panel(simple_step_generator_2.no_layers)
real_no_support_layers_2 = Panel(simple_step_generator_2.real_no_support_layers)
no_support_layers_2 = Panel(simple_step_generator_2.no_support_layers)
pline_2 = PolyLine(Vertices=geo_9, Closed=False)
geo_10 = Geometry(simple_step_generator_2.temp_geom)

# ----
X = UnitX(Factor=number_slider)  # disabled
move = Move(Geometry=geo, Motion=X)  # -> Geometry, Transform; disabled
xy_3 = XYPlane(Origin=move.Geometry)  # disabled
X_2 = UnitX(Factor=number_slider_2)  # disabled
move_2 = Move(Geometry=geo, Motion=X_2)  # -> Geometry, Transform; disabled
xy_4 = XYPlane(Origin=move_2.Geometry)  # disabled

# ---- group: simple step finger joint connection right
simple_step_generator_3 = GhPythonScript(
    origin_plane=xy_4,
    step_width=step_width_2,
    support_width=support_width_2,
    step_height=step_height_2,
    support_height=support_height_2,
    bridge_width=bridge_width_2,
    gap_width=gap_width_2,
    step_length=step_length_2,
    layer_height=layer_height_2,
    finger_dist=finger_dist,
    print_pt_dist=print_pt_dist_2)  # -> out, print_pts_array_dense, all_print_pts_dense, temp_geom, real_layer_height, no_layers, real_no_support_layers, no_support_layers; inputs origin_plane: Plane, step_width: Int32, support_width: Int32, step_height: Int32, bridge_width: Int32, gap_width: Int32, step_length: Int32, layer_height: Int32, finger_dist: Int32, print_pt_dist: Int32; disabled
# ---------- simple_step_generator_3: Python ----------
__author__ = "jend"
__version__ = "2023.01.20"

import Rhino.Geometry as rg
import math as m
debug = False

temp_geom = []

op = origin_plane
vx = op.XAxis
vy = op.YAxis
vz = op.ZAxis


# base pts
pt_1 = op.Origin
pt_2 = pt_1 + vx * step_width
pt_3 = pt_2 + vy * step_length
pt_4 = pt_1 + vy * step_length

base_pts = [pt_1, pt_2, pt_3, pt_4]

pline_pts = base_pts
pline_pts.append(pline_pts[0])
base_pline = rg.Curve.CreateInterpolatedCurve(pline_pts, 1)

temp_geom.extend(base_pts)
#temp_geom.append(base_pline)

# generate fingers
finger_width = finger_dist / 2
temp_line_crv = rg.LineCurve(base_pts[1],base_pts[2])
temp_geom.append(temp_line_crv)

temp_params = temp_line_crv.DivideByLength(finger_dist, True)
if temp_params == None:
    count = 1
else:
    count = len(temp_params)

temp_params = temp_line_crv.DivideByCount(count, True)
temp_pts = [temp_line_crv.PointAt(p) for p in temp_params]

finger_pts = []
for i,pt in enumerate(temp_pts):
    if i == 0 or i == len(temp_pts)-1:
        None
    elif i > 0:
        temp_pt_1 = pt - finger_width/2 * vy
        temp_pt_2 = temp_pt_1 + support_width * vx
        temp_pt_3 = temp_pt_2 + finger_width/2 * vy
        temp_pt_4 = temp_pt_3 - support_width * vx
        
        finger_pts.extend([temp_pt_1, temp_pt_2, temp_pt_3, temp_pt_4])

temp_geom.extend(temp_pts)
temp_geom.extend(finger_pts)

# layer heights and numbers
total_height = step_height + support_height

if debug:
    print total_height
    print total_height/layer_height
    print m.floor(total_height/layer_height)
    print total_height/m.floor(total_height/layer_height)

no_layers = int(m.floor(total_height/layer_height))
real_layer_height = total_height / no_layers

if debug:
    print m.floor(step_height / real_layer_height)

real_no_support_layers = step_height / real_layer_height
no_support_layers = int(m.floor(step_height / real_layer_height))


# print pts
# no_layers, no_support_layers, real_layer_height
# new base pts

support_layer_pts = [pt_2] + finger_pts + [pt_3, pt_4, pt_1, pt_2]
layer_pts = [pt_2, pt_3, pt_4, pt_1, pt_2]

print_pts_array = []
for i in range(no_layers):
    print_pts = []
    temp_height = i * real_layer_height
    if i < no_support_layers:
        for j,pt in enumerate(support_layer_pts):
            temp_pt = rg.Point3d(pt)
            temp_pt.Z = temp_height
            print_pts.append(temp_pt)
    else:
        for j,pt in enumerate(layer_pts):
            temp_pt = rg.Point3d(pt)
            temp_pt.Z = temp_height
            print_pts.append(temp_pt)
    temp_geom.extend(print_pts)
    temp_geom.append(rg.Curve.CreateInterpolatedCurve(print_pts, 1))
    print_pts_array.append(print_pts)


# for robot path
all_print_pts_dense = []
print_pts_array_dense = []

"""
for i,print_pts in enumerate(print_pts_array):
    temp_print_pts = []
    for j,print_pt in enumerate(print_pts):
        if j < len(print_pts)-1:
            temp_line_crv = rg.LineCurve(print_pt, print_pts[j+1])
            temp_params = temp_line_crv.DivideByLength(print_pt_dist, True)
            if temp_params == None:
                count = 1
            else:
                count = len(temp_params)
            temp_params = temp_line_crv.DivideByCount(count, True)
            temp_pts = [temp_line_crv.PointAt(p) for p in temp_params]
            temp_pts.pop(0)
            temp_print_pts.extend(temp_pts)
    all_print_pts_dense.extend(temp_print_pts)
    print_pts_array_dense.append(temp_print_pts)
"""

# rounded
for i,print_pts in enumerate(print_pts_array):
    temp_print_pts = []
    for j,print_pt in enumerate(print_pts):
        if i < no_support_layers:
            if j < len(print_pts)-1 and j == len(print_pts)-2:
                temp_center = (print_pt + print_pts[j+1]) / 2
                temp_center_plane = rg.Plane(temp_center, vx, vy)
                
                tv = vx
                nv = vy
                offset_value = temp_center.DistanceTo(print_pt)
                offset_pt = temp_center + offset_value * nv
                
                temp_curve = rg.Curve.CreateInterpolatedCurve([print_pt,offset_pt,print_pts[j+1]],3,rg.CurveKnotStyle.Uniform,tv,tv)
                
                TS = rg.Transform.Scale(temp_center_plane, 1, .3, 1)
                temp_curve.Transform(TS)
                temp_geom.append(temp_curve)
                
                temp_geom.append(temp_curve)
                
                temp_params = temp_curve.DivideByLength(print_pt_dist, True)
                if temp_params == None:
                    count = 1
                else:
                    count = len(temp_params)
                temp_params = temp_curve.DivideByCount(count, True)
                temp_pts = [temp_curve.PointAt(p) for p in temp_params]
                temp_pts.pop(0)
                temp_print_pts.extend(temp_pts)
            elif j < len(print_pts)-1 and j != len(print_pts)-2:
                temp_line_crv = rg.LineCurve(print_pt, print_pts[j+1])
                temp_params = temp_line_crv.DivideByLength(print_pt_dist, True)
                if temp_params == None:
                    count = 1
                else:
                    count = len(temp_params)
                temp_params = temp_line_crv.DivideByCount(count, True)
                temp_pts = [temp_line_crv.PointAt(p) for p in temp_params]
                temp_pts.pop(0)
                temp_print_pts.extend(temp_pts)
        else:
            if j < len(print_pts)-1 and j == 3:
                temp_center = (print_pt + print_pts[j+1]) / 2
                temp_center_plane = rg.Plane(temp_center, vx, vy)
                
                tv = vx
                nv = vy
                offset_value = temp_center.DistanceTo(print_pt)
                offset_pt = temp_center + offset_value * nv
                
                temp_curve = rg.Curve.CreateInterpolatedCurve([print_pt,offset_pt,print_pts[j+1]],3,rg.CurveKnotStyle.Uniform,tv,tv)
                
                TS = rg.Transform.Scale(temp_center_plane, 1, .3, 1)
                temp_curve.Transform(TS)
                temp_geom.append(temp_curve)
                
                temp_geom.append(temp_curve)
                
                temp_params = temp_curve.DivideByLength(print_pt_dist, True)
                if temp_params == None:
                    count = 1
                else:
                    count = len(temp_params)
                temp_params = temp_curve.DivideByCount(count, True)
                temp_pts = [temp_curve.PointAt(p) for p in temp_params]
                temp_pts.pop(0)
                temp_print_pts.extend(temp_pts)
            elif j < len(print_pts)-1 and j != 3:
                temp_line_crv = rg.LineCurve(print_pt, print_pts[j+1])
                temp_params = temp_line_crv.DivideByLength(print_pt_dist, True)
                if temp_params == None:
                    count = 1
                else:
                    count = len(temp_params)
                temp_params = temp_line_crv.DivideByCount(count, True)
                temp_pts = [temp_line_crv.PointAt(p) for p in temp_params]
                temp_pts.pop(0)
                temp_print_pts.extend(temp_pts)
    all_print_pts_dense.extend(temp_print_pts)
    print_pts_array_dense.append(temp_print_pts)
# ---------- end simple_step_generator_3 ----------
idx_3 = Slider(3, range=0..100)  # disabled
geo_11 = Geometry(simple_step_generator_3.all_print_pts_dense)  # disabled
layer_visu_3 = GhPythonScript(print_pts_array=simple_step_generator_3.print_pts_array_dense, idx=idx_3)  # -> out, layer_pts; inputs print_pts_array: list, idx: Int32; disabled; same code as layer_visu
panel_3 = Panel(simple_step_generator_3.print_pts_array_dense)  # disabled
geo_12 = Geometry(layer_visu_3.layer_pts)  # disabled
no_layers_3 = Panel(simple_step_generator_3.no_layers)  # disabled
real_no_support_layers_3 = Panel(simple_step_generator_3.real_no_support_layers)  # disabled
real_layer_height_3 = Panel(simple_step_generator_3.real_layer_height)  # disabled
no_support_layers_3 = Panel(simple_step_generator_3.no_support_layers)  # disabled
pline_3 = PolyLine(Vertices=geo_12, Closed=False)  # disabled
geo_13 = Geometry(simple_step_generator_3.temp_geom)  # disabled

simple_step_generator_4 = GhPythonScript(
    origin_plane=xy_3,
    step_width=step_width_2,
    support_width=support_width_2,
    step_height=step_height_2,
    support_height=support_height_2,
    bridge_width=bridge_width_2,
    gap_width=gap_width_2,
    step_length=step_length_2,
    layer_height=layer_height_2,
    finger_dist=finger_dist,
    print_pt_dist=print_pt_dist_2)  # -> out, print_pts_array_dense, all_print_pts_dense, temp_geom, real_layer_height, no_layers, real_no_support_layers, no_support_layers; inputs origin_plane: Plane, step_width: Int32, support_width: Int32, step_height: Int32, bridge_width: Int32, gap_width: Int32, step_length: Int32, layer_height: Int32, finger_dist: Int32, print_pt_dist: Int32; disabled
# ---------- simple_step_generator_4: Python ----------
__author__ = "jend"
__version__ = "2023.01.20"

import Rhino.Geometry as rg
import math as m
debug = False

temp_geom = []

op = origin_plane
vx = op.XAxis
vy = op.YAxis
vz = op.ZAxis


# base pts
pt_1 = op.Origin
pt_2 = pt_1 + vx * step_width
pt_3 = pt_2 + vy * step_length
pt_4 = pt_1 + vy * step_length

base_pts = [pt_1, pt_2, pt_3, pt_4]

pline_pts = base_pts
pline_pts.append(pline_pts[0])
base_pline = rg.Curve.CreateInterpolatedCurve(pline_pts, 1)

temp_geom.extend(base_pts)
#temp_geom.append(base_pline)

# generate fingers
finger_width = finger_dist / 2
temp_line_crv = rg.LineCurve(base_pts[1],base_pts[2])
temp_geom.append(temp_line_crv)

temp_params = temp_line_crv.DivideByLength(finger_dist, True)
if temp_params == None:
    count = 1
else:
    count = len(temp_params)

temp_params = temp_line_crv.DivideByCount(count, True)
temp_pts = [temp_line_crv.PointAt(p) for p in temp_params]

finger_pts = []
for i,pt in enumerate(temp_pts):
    if i == 0 or i == len(temp_pts)-1:
        None
    elif i > 0:
        temp_pt_1 = pt - finger_width * 0.7 * vy
        temp_pt_2 = temp_pt_1 + support_width * vx
        temp_pt_3 = temp_pt_2 + finger_width * 0.7 * vy
        temp_pt_4 = temp_pt_3 - support_width * vx
        
        finger_pts.extend([temp_pt_1, temp_pt_2, temp_pt_3, temp_pt_4])

temp_geom.extend(temp_pts)
temp_geom.extend(finger_pts)

# layer heights and numbers
total_height = step_height + support_height

if debug:
    print total_height
    print total_height/layer_height
    print m.floor(total_height/layer_height)
    print total_height/m.floor(total_height/layer_height)

no_layers = int(m.floor(total_height/layer_height))
real_layer_height = total_height / no_layers

if debug:
    print m.floor(step_height / real_layer_height)

real_no_support_layers = step_height / real_layer_height
no_support_layers = int(m.floor(step_height / real_layer_height))


# print pts
# no_layers, no_support_layers, real_layer_height
# new base pts

support_layer_pts = [pt_2] + finger_pts + [pt_3, pt_4, pt_1, pt_2]
layer_pts = [pt_2, pt_3, pt_4, pt_1, pt_2]

print_pts_array = []
for i in range(no_layers):
    print_pts = []
    temp_height = i * real_layer_height
    if i < no_support_layers:
        for j,pt in enumerate(support_layer_pts):
            temp_pt = rg.Point3d(pt)
            temp_pt.Z = temp_height
            print_pts.append(temp_pt)
    else:
        for j,pt in enumerate(layer_pts):
            temp_pt = rg.Point3d(pt)
            temp_pt.Z = temp_height
            print_pts.append(temp_pt)
    temp_geom.extend(print_pts)
    temp_geom.append(rg.Curve.CreateInterpolatedCurve(print_pts, 1))
    print_pts_array.append(print_pts)


# for robot path
all_print_pts_dense = []
print_pts_array_dense = []

"""
for i,print_pts in enumerate(print_pts_array):
    temp_print_pts = []
    for j,print_pt in enumerate(print_pts):
        if j < len(print_pts)-1:
            temp_line_crv = rg.LineCurve(print_pt, print_pts[j+1])
            temp_params = temp_line_crv.DivideByLength(print_pt_dist, True)
            if temp_params == None:
                count = 1
            else:
                count = len(temp_params)
            temp_params = temp_line_crv.DivideByCount(count, True)
            temp_pts = [temp_line_crv.PointAt(p) for p in temp_params]
            temp_pts.pop(0)
            temp_print_pts.extend(temp_pts)
    all_print_pts_dense.extend(temp_print_pts)
    print_pts_array_dense.append(temp_print_pts)
"""

# rounded
for i,print_pts in enumerate(print_pts_array):
    temp_print_pts = []
    for j,print_pt in enumerate(print_pts):
        if i < no_support_layers:
            if j < len(print_pts)-1 and j == len(print_pts)-2:
                temp_center = (print_pt + print_pts[j+1]) / 2
                temp_center_plane = rg.Plane(temp_center, vx, vy)
                
                tv = vx
                nv = vy
                offset_value = temp_center.DistanceTo(print_pt)
                offset_pt = temp_center + offset_value * nv
                
                temp_curve = rg.Curve.CreateInterpolatedCurve([print_pt,offset_pt,print_pts[j+1]],3,rg.CurveKnotStyle.Uniform,tv,tv)
                
                TS = rg.Transform.Scale(temp_center_plane, 1, .3, 1)
                temp_curve.Transform(TS)
                temp_geom.append(temp_curve)
                
                temp_geom.append(temp_curve)
                
                temp_params = temp_curve.DivideByLength(print_pt_dist, True)
                if temp_params == None:
                    count = 1
                else:
                    count = len(temp_params)
                temp_params = temp_curve.DivideByCount(count, True)
                temp_pts = [temp_curve.PointAt(p) for p in temp_params]
                temp_pts.pop(0)
                temp_print_pts.extend(temp_pts)
            elif j < len(print_pts)-1 and j == len(print_pts)-3:
                temp_line_crv = rg.LineCurve(print_pt, print_pts[j+1])
                temp_params = temp_line_crv.DivideByLength(print_pt_dist, True)
                if temp_params == None:
                    count = 1
                else:
                    count = len(temp_params)
                temp_params = temp_line_crv.DivideByCount(count, True)
                temp_pts = [temp_line_crv.PointAt(p) for p in temp_params]
                
                if i%2 == 0:
                    for k,pt in enumerate(temp_pts):
                        if k%2 == 0:
                            pt.Transform(rg.Transform.Translation(0,0,5))
                if i%2 != 0:
                    for k,pt in enumerate(temp_pts):
                        if k%2 != 0:
                            pt.Transform(rg.Transform.Translation(0,0,5))
                temp_pts.pop(0)
                temp_print_pts.extend(temp_pts)
            elif j < len(print_pts)-1 and j != len(print_pts)-2 and j != len(print_pts)-3:
                temp_line_crv = rg.LineCurve(print_pt, print_pts[j+1])
                temp_params = temp_line_crv.DivideByLength(print_pt_dist, True)
                if temp_params == None:
                    count = 1
                else:
                    count = len(temp_params)
                temp_params = temp_line_crv.DivideByCount(count, True)
                temp_pts = [temp_line_crv.PointAt(p) for p in temp_params]
                temp_pts.pop(0)
                temp_print_pts.extend(temp_pts)
        else:
            if j < len(print_pts)-1 and j == 3:
                temp_center = (print_pt + print_pts[j+1]) / 2
                temp_center_plane = rg.Plane(temp_center, vx, vy)
                
                tv = vx
                nv = vy
                offset_value = temp_center.DistanceTo(print_pt)
                offset_pt = temp_center + offset_value * nv
                
                temp_curve = rg.Curve.CreateInterpolatedCurve([print_pt,offset_pt,print_pts[j+1]],3,rg.CurveKnotStyle.Uniform,tv,tv)
                
                TS = rg.Transform.Scale(temp_center_plane, 1, .3, 1)
                temp_curve.Transform(TS)
                temp_geom.append(temp_curve)
                
                temp_geom.append(temp_curve)
                
                temp_params = temp_curve.DivideByLength(print_pt_dist, True)
                if temp_params == None:
                    count = 1
                else:
                    count = len(temp_params)
                temp_params = temp_curve.DivideByCount(count, True)
                temp_pts = [temp_curve.PointAt(p) for p in temp_params]
                temp_pts.pop(0)
                temp_print_pts.extend(temp_pts)
                
            elif j < len(print_pts)-1 and j == len(print_pts)-3:
                temp_line_crv = rg.LineCurve(print_pt, print_pts[j+1])
                temp_params = temp_line_crv.DivideByLength(print_pt_dist, True)
                if temp_params == None:
                    count = 1
                else:
                    count = len(temp_params)
                temp_params = temp_line_crv.DivideByCount(count, True)
                temp_pts = [temp_line_crv.PointAt(p) for p in temp_params]
                
                if i%2 == 0:
                    for k,pt in enumerate(temp_pts):
                        if k%2 == 0:
                            pt.Transform(rg.Transform.Translation(0,0,5))
                if i%2 != 0:
                    for k,pt in enumerate(temp_pts):
                        if k%2 != 0:
                            pt.Transform(rg.Transform.Translation(0,0,5))
                temp_pts.pop(0)
                temp_print_pts.extend(temp_pts)
                
            elif j < len(print_pts)-1 and j != 3:
                temp_line_crv = rg.LineCurve(print_pt, print_pts[j+1])
                temp_params = temp_line_crv.DivideByLength(print_pt_dist, True)
                if temp_params == None:
                    count = 1
                else:
                    count = len(temp_params)
                temp_params = temp_line_crv.DivideByCount(count, True)
                temp_pts = [temp_line_crv.PointAt(p) for p in temp_params]
                temp_pts.pop(0)
                temp_print_pts.extend(temp_pts)
    all_print_pts_dense.extend(temp_print_pts)
    print_pts_array_dense.append(temp_print_pts)
# ---------- end simple_step_generator_4 ----------
idx_4 = Slider(0, range=0..100)  # disabled
geo_14 = Geometry(simple_step_generator_4.all_print_pts_dense)  # disabled
layer_visu_4 = GhPythonScript(print_pts_array=simple_step_generator_4.print_pts_array_dense, idx=idx_4)  # -> out, layer_pts; inputs print_pts_array: list, idx: Int32; disabled; same code as layer_visu
panel_4 = Panel(simple_step_generator_4.print_pts_array_dense)  # disabled
geo_15 = Geometry(layer_visu_4.layer_pts)  # disabled
no_layers_4 = Panel(simple_step_generator_4.no_layers)  # disabled
real_no_support_layers_4 = Panel(simple_step_generator_4.real_no_support_layers)  # disabled
real_layer_height_4 = Panel(simple_step_generator_4.real_layer_height)  # disabled
no_support_layers_4 = Panel(simple_step_generator_4.no_support_layers)  # disabled
pline_4 = PolyLine(Vertices=geo_15, Closed=False)  # disabled
geo_16 = Geometry(simple_step_generator_4.temp_geom)  # disabled

# ---- group: ori_pt
# Calibration
# UR10 Calibration Points & Work Area
# 
# Tool tip should just touch the ruler!!!
# 
# You should feel it's hardly to move the ruler
panel_5 = Panel("570")
panel_6 = Panel("-282-4")
ori_pt = ConstructPoint(XCoordinate=panel_5, YCoordinate="-260", ZCoordinate=panel_6)

# ---- group: xAxis_pt
xaxis_pt = ConstructPoint(XCoordinate="1170", YCoordinate="-260", ZCoordinate=panel_6)

# ---- group: yAxis_pt
yaxis_pt = ConstructPoint(XCoordinate="570", YCoordinate="260", ZCoordinate=panel_6)

# ---- group: diag_pt
diag_pt = ConstructPoint(XCoordinate="1170", YCoordinate="260", ZCoordinate=panel_6)

# ----
# Input Geo
brep = Brep(<brep referenced from the Rhino model>)

sin_brep = Brep(<brep referenced from the Rhino model>)

# ----
# Print Adjustment
number_slider_3 = Slider(454.4, range=0..500)

# ----
# Slicing Parameters
layer_height_3 = Slider(8, range=0.5..300)
offset_distance = Slider(7, range=0.5..50)
layer_count = Slider(1, range=1..10)
seg_length = Slider(25, range=5..200)

# ----
# Robot Parameters
velocity = Slider(140, range=0..999)
firstlayer_velocity = Slider(100, range=0..999)
travel_velocity = Slider(110, range=0..999)
acceleration = Slider(300, range=0..500)

pt = Point(<point referenced from the Rhino model>)

# ----
# Test Geometry
list = ValueList({"Without ribs": 0, "Ribs": 1}, selected="Without ribs")
list_2 = ValueList({"No Infill": 0, "Spike": 1, "Chamfer": 2}, selected="Chamfer")
crv = Curve(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)
infill_offset = Slider(-13, range=-50..50)
infill_zoffset = Slider(0, range=-10..100)
end_gap = Slider(0, range=0..100)
crv_2 = Curve(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)
rib_span = Slider(217, range=20..2000)
chamfer_wid = Slider(40, range=0..100)
divide_interval = Slider(50, range=0..100)
pathgenerator = GhPythonScript(
    crv=crv_2,
    shell_typ=list,
    rib_span=rib_span,
    rib_wid=Slider(92.4, range=0..100),
    rib_dep=Slider(50, range=0..100),
    infill_typ=list_2,
    infill_span=Slider(200, range=20..2000),
    infill_div=Slider(30.8, range=0..100),
    infill_offset=infill_offset,
    chamfer_wid=chamfer_wid,
    end_gap=end_gap,
    divide_interval=divide_interval)  # -> seg1dir, inter_ls, segNormal, crv_segs, vis_pts, vis_attr; inputs crv: Curve, shell_typ: Int32, infill_typ: Int32, infill_span: Int32
# ---------- pathgenerator: Python ----------
__author__ = "Fen"
__spacing__= "-----ʕ•ᴥ•ʔ-----"
import Rhino.Geometry as rg
import ghpythonlib.components as ghc
import ghpythonlib.treehelpers as th
from  itertools import izip_longest, chain

def zip2Lists_flatten(list1, list2):
    """
    list1 = [1,1,1]
    list2 = [2,2,2,'A','A','A']
    result = [1, 2, 1, 2, 1, 2, 'A', 'A', 'A']
    """
    mapList = map(list, izip_longest(list1,list2, fillvalue=None))
    zipList = [i for sublist in mapList for i in sublist if i is not None]
    return zipList

def divide_crv(crv, divide_interval, endInc):
    crv_length = crv.GetLength()
    count = int(crv_length/divide_interval)
    params = crv.DivideByCount(count, endInc)
    points = [crv.PointAt(p) for p in params]
    tangents = [crv.TangentAt(p) for p in params]
    normals = [rg.Vector3d.CrossProduct(t, rg.Vector3d.ZAxis) for t in tangents]
    return points, normals

def swapPositions(list, pos1, pos2):
    list[pos1], list[pos2] = list[pos2], list[pos1]
    return list

def sortCrvs_xy(crvs):
    for i,crv in enumerate(crvs):
        crv.Domain =rg.Interval(0,1)

    mids=[crv.PointAt(0.5) for crv in crvs]
    ptsX = [pt.X for pt in mids]
    ptsY = [pt.Y for pt in mids]
    data = zip(ptsX, ptsY, crvs)
    data.sort()
    if data[1][1]>data[2][1]:
        swap = True
        #print "swap"
    else:
        swap = False
        #print "No swap"
    sorted_crvs = [crv for x,y,crv in data]
    if swap:
        sorted_crvs = swapPositions(sorted_crvs, 1, 2)
    sorted_crvs = swapPositions(sorted_crvs, 2, 3)
    return sorted_crvs

#def pt2_ribPts(param,normal, crv, rib_wid, rib_dep):
#    rib_pts = []
#    rib_pts.append(crv.PointAt(param-rib_wid/2))
#    rib_pts.append(crv.PointAt(param-rib_wid/2) + n*rib_dep)
#    rib_pts.append(crv.PointAt(param+rib_wid/2) + n*rib_dep)
#    rib_pts.append(crv.PointAt(param+rib_wid/2))
#    return rib_pts

def pt2_ribPts(param,normal, crv, rib_wid, rib_dep):
    rib_pts = []
    rib_pts.append(crv.PointAt(param-rib_wid/2))
    rib_pts.append(crv.PointAt(param) + n*rib_dep)
    rib_pts.append(crv.PointAt(param+rib_wid/2))
    return rib_pts


"""Sort edges order"""
bb = crv.GetBoundingBox(rg.Plane.WorldXY)
bb_edges = bb.GetEdges()
bb_segs = []
for i,seg in enumerate(bb_edges):
    if i<4:
        seg=rg.Line.ToNurbsCurve(seg)
        bb_segs.append(seg)
bb_segs= sortCrvs_xy(bb_segs)

"""Check crv direction"""
crv_segs = crv.DuplicateSegments()
crv_segs = sortCrvs_xy(crv_segs)
seg1= crv_segs[0]
start = seg1.PointAt(0.0)
end = seg1.PointAt(1.0)
seg1dir = end -start
segNormal = rg.Vector3d.CrossProduct(rg.Vector3d.XAxis,seg1dir)
reverseCrv = False
if segNormal.Z >0:
    reverseCrv = True
    print "need toreverse"
if reverseCrv:
    for crv in crv_segs:
        crv.Reverse()
        print "reversed"

crv_segs[3].Reverse()

top_crv = crv_segs[3]
top_crv.Domain = rg.Interval(0, top_crv.GetLength())
bot_crv = crv_segs[1]
bot_crv.Domain = rg.Interval(0, bot_crv.GetLength())

"""Check if input curve has curvature"""
straight = None
check = [seg.Degree for seg in crv_segs]
if sum(check) > len(crv_segs):
    straight = False
elif sum(check) == len(crv_segs):
    straight = True
"""----------------------------------"""

wayPt_nlist=[]
for i,seg in enumerate(crv_segs):
    pts=[]
    if straight:
        if i ==0:
            v = seg.PointAtEnd - seg.PointAtStart
            v.Unitize()
            pts.append(seg.PointAtStart+v*end_gap)
        elif i==1:
            pts.append(seg.PointAtStart)
        elif i==2:
            pts.append(seg.PointAtStart)
        elif i ==len(crv_segs)-1:
            seg.Reverse()
            pts.append(seg.PointAtStart)
            v = seg.PointAtStart-seg.PointAtEnd
            v.Unitize()
            pts.append(seg.PointAtEnd+v*end_gap)
    else:
        if seg.Degree==1:
            if i==0:
                v = seg.PointAtEnd - seg.PointAtStart
                v.Unitize()
                pts.append(seg.PointAtStart+v*end_gap)
                pts.append(seg.PointAtEnd)
            else:
                pts.append(seg.PointAtStart)
        else:
            if i==1:
                pts,_ = divide_crv(seg, divide_interval, False)
            else:
                pts,_ = divide_crv(seg, divide_interval, True)
                pts.pop(0)
    wayPt_nlist.append(pts)


"""Add ribs if necessary"""
if shell_typ ==1:
    rib_count = int(top_crv.GetLength()/rib_span)*2
    if rib_count%2!=0:
        rib_count +=1
        
    top_rib_params = top_crv.DivideByCount(rib_count, True)
    top_rib_params = top_rib_params[1:-1]
    top_rib_tangents = [top_crv.TangentAt(p) for i,p in enumerate(top_rib_params)]
    top_rib_normals = [rg.Vector3d.CrossProduct(t, rg.Vector3d.ZAxis) for t in top_rib_tangents]
    top_rib_pts =[]
    for i,(p,n) in enumerate(zip(top_rib_params,top_rib_normals)):
        top_rib_pts.extend(pt2_ribPts(p,n, top_crv, rib_wid, rib_dep))
    wayPt_nlist[3].extend(top_rib_pts)
    wayPt_nlist[3].append(wayPt_nlist[3].pop(1))
    
    bot_rib_params = bot_crv.DivideByCount(rib_count, True)
    bot_rib_params = bot_rib_params[1:-1]
    bot_rib_tangents = [bot_crv.TangentAt(p) for i,p in enumerate(bot_rib_params)]
    bot_rib_normals = [rg.Vector3d.CrossProduct(t, rg.Vector3d.ZAxis) for t in bot_rib_tangents]

    bot_rib_pts =[]
    for i,(p,n) in enumerate(zip(bot_rib_params,bot_rib_normals)):
        bot_rib_pts.extend(pt2_ribPts(p,n, bot_crv, rib_wid, rib_dep))
    wayPt_nlist[1].extend(bot_rib_pts)

WayPtAttribute_nlist = []
for pts in wayPt_nlist:
    l = []
    for pt in pts:
        l.append('shell')
    WayPtAttribute_nlist.append(l)

"""Drawing intersect lines from top edge"""
top_bb = bb_segs[3]
infill_count = int(top_bb.GetLength()/infill_span)*2
if infill_count%2!=0:
    infill_count +=1
infill_params = top_bb.DivideByCount(infill_count, True)
top_bb_pts = [top_bb.PointAt(p) for p in infill_params]
inter_ls = [rg.Line(rg.Point3d(pt.X, pt.Y+100000, pt.Z), rg.Vector3d.YAxis*-1000000) for pt in top_bb_pts]
inter_ls = [l.ToNurbsCurve() for l in inter_ls]


top_pts = []
bot_pts = []
for i,l in enumerate(inter_ls):
    if infill_typ ==0:
        if i%2==0:
            top_inter = rg.Intersect.Intersection.CurveCurve(top_crv, l, 0.01, 0.01)[0]
            pt = top_inter.PointA
            if i ==0:
                top_pts.append(pt)
            elif i==len(inter_ls)-1:
                top_pts.append(pt)
            else:
                p = top_inter.ParameterA
                v = rg.Vector3d.CrossProduct(top_crv.TangentAt(p), rg.Vector3d.ZAxis)
                v.Unitize()
                top_pts.append(pt+v*infill_offset*1)
    elif infill_typ == 1:
        if i%2==0:
            top_inter = rg.Intersect.Intersection.CurveCurve(top_crv, l, 0.01, 0.01)[0]
            pt = top_inter.PointA
            if i ==0:
                top_pts.append(pt)
            elif i==len(inter_ls)-1:
                top_pts.append(pt)
            else:
                p = top_inter.ParameterA
                v = rg.Vector3d.CrossProduct(top_crv.TangentAt(p), rg.Vector3d.ZAxis)
                v.Unitize()
                top_pts.append(pt+v*infill_offset*1)
        elif i%2==1:
            bot_inter = rg.Intersect.Intersection.CurveCurve(bot_crv, l, 0.01, 0.01)[0]
            pt = bot_inter.PointA
            p = bot_inter.ParameterA
            v = rg.Vector3d.CrossProduct(bot_crv.TangentAt(p), rg.Vector3d.ZAxis)
            v.Unitize()
            bot_pts.append(pt+v*infill_offset*1)

    elif infill_typ == 2:
        if i%2==0:
            top_inter = rg.Intersect.Intersection.CurveCurve(top_crv, l, 0.01, 0.01)[0]
            if i == 0:
                top_pts.append([top_inter.PointA])
            elif i ==len(inter_ls)-1:
                top_pts.append([top_inter.PointA])
            else:
                
                p0 = top_inter.ParameterA - chamfer_wid/2
                pt0 = top_crv.PointAt(p0)
                p1 = top_inter.ParameterA + chamfer_wid/2
                pt1 = top_crv.PointAt(p1)
                
                v0 = rg.Vector3d.CrossProduct(top_crv.TangentAt(p0), rg.Vector3d.ZAxis)
                v0.Unitize()
                v1 = rg.Vector3d.CrossProduct(top_crv.TangentAt(p1), rg.Vector3d.ZAxis)
                v1.Unitize()
                pts = [pt0+v0*infill_offset*1, pt1+v1*infill_offset*1]
                top_pts.append(pts)
        elif i%2==1:
            bot_inter = rg.Intersect.Intersection.CurveCurve(bot_crv, l, 0.01, 0.01)[0]
            p0 = bot_inter.ParameterA + chamfer_wid/2
            pt0 = bot_crv.PointAt(p0)
            p1 = bot_inter.ParameterA - chamfer_wid/2
            pt1 = bot_crv.PointAt(p1)
            
            v0 = rg.Vector3d.CrossProduct(bot_crv.TangentAt(p0), rg.Vector3d.ZAxis)
            v0.Unitize()
            v1 = rg.Vector3d.CrossProduct(bot_crv.TangentAt(p1), rg.Vector3d.ZAxis)
            v1.Unitize()
            pts = [pt0+v0*infill_offset*1, pt1+v1*infill_offset*1]
            bot_pts.append(pts)


if infill_typ ==0:
    pass
elif infill_typ == 1:
    infillPts = zip2Lists_flatten(top_pts,bot_pts)
elif infill_typ == 2:
    infillPts = zip2Lists_flatten(top_pts,bot_pts)
    infillPts = [i for sublist in infillPts for i in sublist]

infillPts_update = []
infillPts_attributes = []
if infill_typ == 0:
    pass
elif infill_typ == 1:
    for i,pt in enumerate(infillPts):
        if i!= len(infillPts)-1:
            v = infillPts[i+1] - pt
            d = v.Length
            v.Unitize()
            if i==0:
                infillPts_update.append(pt.Clone()+v*end_gap)
                infillPts_attributes.append('shell')
            else:
                infillPts_update.append(pt)
                infillPts_attributes.append('infill_corner')

#            infillPts_update.append(pt.Clone()+v*infill_div)
#            infillPts_attributes.append('infill_quar')
#            infillPts_update.append(pt.Clone()+v*d/2)
#            infillPts_attributes.append('infill_mid')
#            infillPts_update.append(pt.Clone()+v*(d-infill_div))
#            infillPts_attributes.append('infill_quar')
        else:
            infillPts_update.append(pt)
            infillPts_attributes.append('shell')
elif infill_typ == 2:
    for i,pt in enumerate(infillPts):
        if i!= len(infillPts)-1:
            v = infillPts[i+1] - pt
            d = v.Length
            v.Unitize()
            if i%2 ==0:
                if i==0:
                    infillPts_update.append(pt.Clone()+v*end_gap)
                    infillPts_attributes.append('shell')
                else:
                    infillPts_update.append(pt)
                    infillPts_attributes.append('infill_corner')
#                infillPts_update.append(pt.Clone()+v*infill_div)
#                infillPts_attributes.append('infill_quar')
#                infillPts_update.append(pt.Clone()+v*d/2)
#                infillPts_attributes.append('infill_mid')
#                infillPts_update.append(pt.Clone()+v*(d-infill_div))
#                infillPts_attributes.append('infill_quar')
            elif i%2 ==1:
                infillPts_update.append(pt)
                infillPts_attributes.append('infill_corner')
        else:
            infillPts_update.append(pt)
            infillPts_attributes.append('shell')

"""outline---infill---outline"""
if infill_typ != 0:
    infillPts_update.reverse()
    infillPts_attributes.reverse()
    
    wayPt_nlist.append(infillPts_update)
    WayPtAttribute_nlist.append(infillPts_attributes)
    

elif infill_typ == 0:
    pass

vis_pts = th.list_to_tree(wayPt_nlist)
vis_attr = th.list_to_tree(WayPtAttribute_nlist)
# ---------- end pathgenerator ----------
python = GhPythonScript(pts=flatten(pathgenerator.vis_pts), seg_length=seg_length)  # -> newPts; inputs pts: list of Point3d
# ---------- python: Python ----------
__author__ = "Fen"
import Rhino.Geometry as rg
"-------Import Personal Library-------"
from compas_rhino import unload_modules
unload_modules('e2e_pathSlicer')
import e2e_pathSlicer as ps
"-------------------------------------"

newPts = []

for i,pt in enumerate(pts):
    if  i != len(pts)-1:
        dis = pt.DistanceTo(pts[i+1])
        line = rg.Line(pt, pts[i+1])
        line = line.ToNurbsCurve()
        #print dis, type(line)
        if dis >= seg_length:
            extraPts,_ = ps.divide_crv(line, seg_length, False)
            #print "Order: ",i, len(extraPts)
            newPts.append(pt)
            newPts.extend(extraPts)
    else:
        newPts.append(pt)
# ---------- end python ----------
pline_5 = PolyLine(Vertices=python, Closed=False)
bbox = BoundingBox(Content=pline_5, Plane=PlaneXY(0, 0, 0))  # -> Box, Box_2
mirror = BooleanToggle(True)
box = EvaluateBox(Box=bbox.Box, UParameter=0.5, VParameter=0.5, WParameter=0.5)  # -> Plane, Point, Include
order = PointOrder(Points=python)
geo_17 = Geometry(python)
python_2 = GhPythonScript(object_height=Slider(100, range=0..500), layer_height=layer_height_3, pts=python, mirrorPt=box.Point, mirror=mirror)  # -> out, targetPoint_nList; inputs pts: list of Point3d, mirrorPt: Point3d, mirror: Boolean
# ---------- python_2: Python ----------
__author__ = "Fen"
import Rhino.Geometry as rg
import ghpythonlib.components as ghc
import ghpythonlib.treehelpers as th
import math as m
from compas_ghpython import ghtree_to_list, list_to_ghtree 
from scriptcontext import sticky
"-------Import Personal Library-------"
from compas_rhino import unload_modules
unload_modules('data_structure')
import data_structure as ds
"-------------------------------------"

layer_count = m.ceil(object_height/layer_height)
layer_count = int(layer_count)
print layer_count

targetPoint_nList = []
for i in range(layer_count+1):
    T = rg.Transform.Translation(0,0,layer_height*i)
    moved_pts = [pt.Clone() for pt in pts]
    for pt in moved_pts:
        pt.Transform(T)
        if mirror:
            if i%2==1:
                M = rg.Transform.Mirror(mirrorPt, rg.Vector3d.XAxis)
                pt.Transform(M)
        else:
            pass
#    print len(moved_pts), type(moved_pts[2]), layer_height*i
    targetPoint_nList.append(moved_pts)
# ---------- end python_2 ----------

boundary = PolyLine(Vertices=[ori_pt, xaxis_pt, diag_pt, yaxis_pt], Closed=True)
python_3 = GhPythonScript(ori=ori_pt, print_boundary=boundary, input_brep=brep, x_adjustment=number_slider_3, y_adjustment=Slider(0, range=0..500))  # -> out, rhino_boundary, moved_brep, T_rhino2UR, rhino_oriPt; inputs ori: Point3d, print_boundary: Curve, input_brep: Brep
# ---------- python_3: Python ----------
__author__ = "Fen"
import Rhino.Geometry as rg
# rg.Transform.PlaneToPlane(rhino_basePlane, robot_basePlane)
rhino_boundary = print_boundary.Duplicate()
T_rhino2UR = rg.Point3d(ori.X,ori.Y+1500,0) - ori
rhino_boundary.Translate(T_rhino2UR)
rhino_boundary_bb = rhino_boundary.GetBoundingBox( rg.Plane.WorldXY)
rhino_oriPt = rhino_boundary_bb.Min


input_bb = rg.Brep.GetBoundingBox(input_brep, rg.Plane.WorldXY)
print type(rhino_boundary_bb.Min)

T = rg.Point3d(rhino_oriPt.X+x_adjustment, rhino_oriPt.Y+y_adjustment, rhino_oriPt.Z) - input_bb.Min
moved_brep = input_brep.Duplicate()
moved_brep.Translate(T)
# ---------- end python_3 ----------

# ---- group: simple step finger joint
geo_18 = Geometry(python_3.rhino_oriPt)
gap_width_3 = Slider(30, range=0..1000)
layer_height_4 = Slider(8, range=0..1000)
finger_dist_2 = Slider(200, range=0..1000)
bridge_width_3 = Slider(0, range=0..1000)
step_width_3 = Slider(360, range=0..1000)
step_height_3 = Slider(177, range=0..1000)
step_length_3 = Slider(250, range=0..1000)
support_width_3 = Slider(80, range=0..1000)
support_height_3 = Slider(20, range=0..1000)
xy_5 = XYPlane(Origin=pt)
simple_step_generator_5 = GhPythonScript(
    origin_plane=xy_5,
    step_width=step_width_3,
    support_width=support_width_3,
    step_height=step_height_3,
    support_height=support_height_3,
    bridge_width=bridge_width_3,
    gap_width=gap_width_3,
    step_length=step_length_3,
    layer_height=layer_height_4,
    finger_dist=finger_dist_2)  # -> out, simplify(vis), print_crvs_temp, print_crvs_array, no_layers, no_support_layers; inputs origin_plane: Plane, step_width: Int32, support_width: Int32, step_height: Int32, bridge_width: Int32, gap_width: Int32, step_length: Int32, layer_height: Int32, finger_dist: Int32, print_pt_dist: Int32
# ---------- simple_step_generator_5: Python ----------
__author__ = "jend"
__version__ = "2023.01.20"
from compas_ghpython import ghtree_to_list, list_to_ghtree 
import Rhino.Geometry as rg
import math as m
debug = False

temp_geom = []
print_crvs_temp = [] 

op = origin_plane
vx = op.XAxis
vy = op.YAxis
vz = op.ZAxis

# layer heights and numbers
total_height = step_height + support_height
no_layers = int(m.floor(total_height/layer_height))
real_layer_height = total_height / no_layers

real_no_support_layers = step_height / real_layer_height
no_support_layers = int(m.floor(step_height / real_layer_height))

# base pts
pt_1 = op.Origin
pt_2 = pt_1 + vx * step_width
pt_3 = pt_2 + vy * step_length
pt_4 = pt_1 + vy * step_length

base_pts = [pt_1, pt_2, pt_3, pt_4]
print_crvs_temp.extend(base_pts)

# generate fingers
finger_width = finger_dist / 2
temp_line_crv = rg.LineCurve(base_pts[1],base_pts[2])
temp_geom.append(temp_line_crv)

temp_params = temp_line_crv.DivideByLength(finger_dist, True)
if temp_params == None:
    count = 1
else:
    count = len(temp_params)

temp_params = temp_line_crv.DivideByCount(count, True)
temp_pts = [temp_line_crv.PointAt(p) for p in temp_params]
print  (temp_pts)
finger_pts = []
for i,pt in enumerate(temp_pts):
    if i == 0 or i == len(temp_pts)-1:
        None
    elif i > 0:
        temp_pt_1 = pt - finger_width/2 * vy
        temp_pt_2 = temp_pt_1 + support_width * vx
        temp_pt_3 = temp_pt_2 + finger_width/2 * vy
        temp_pt_4 = temp_pt_3 - support_width * vx
        
        finger_pts.extend([temp_pt_1, temp_pt_2, temp_pt_3, temp_pt_4])

print_crvs_temp.extend(finger_pts)

support_layer_pts = [pt_2] + finger_pts + [pt_3, pt_4, pt_1, pt_2]
layer_pts = [pt_2, pt_3, pt_4, pt_1, pt_2]

# print pts array
print_pts_array = []
for i in range(no_layers):
    print_pts = []
    temp_height = i * real_layer_height
    if i < no_support_layers:
        for j,pt in enumerate(support_layer_pts):
            temp_pt = rg.Point3d(pt)
            temp_pt.Z = temp_height
            print_pts.append(temp_pt)
    else:
        for j,pt in enumerate(layer_pts):
            temp_pt = rg.Point3d(pt)
            temp_pt.Z = temp_height
            print_pts.append(temp_pt)
    temp_geom.extend(print_pts)
    temp_geom.append(rg.Curve.CreateInterpolatedCurve(print_pts, 1))
    print_pts_array.append(print_pts)


print_crvs_array = []
for i,print_pts in enumerate(print_pts_array):
    temp_print_crvs = []
    for j,print_pt in enumerate(print_pts):
        if j < len(print_pts)-1:
            temp_line_crv = rg.LineCurve(print_pt, print_pts[j+1])
            temp_print_crvs.append(temp_line_crv)
    print_crvs_array.append(temp_print_crvs)


vis = list_to_ghtree(print_crvs_array)

# for robot path
all_print_pts_dense = []
print_pts_array_dense = []


"""
for i,print_pts in enumerate(print_pts_array):
    temp_print_pts = []
    for j,print_pt in enumerate(print_pts):
        if j < len(print_pts)-1:
            temp_line_crv = rg.LineCurve(print_pt, print_pts[j+1])
            temp_params = temp_line_crv.DivideByLength(print_pt_dist, True)
            if temp_params == None:
                count = 1
            else:
                count = len(temp_params)
            temp_params = temp_line_crv.DivideByCount(count, True)
            temp_pts = [temp_line_crv.PointAt(p) for p in temp_params]
            temp_pts.pop(0)
            temp_print_pts.extend(temp_pts)
    all_print_pts_dense.extend(temp_print_pts)
    print_pts_array_dense.append(temp_print_pts)
"""
# ---------- end simple_step_generator_5 ----------
no_support_layers_5 = Panel(simple_step_generator_5.no_support_layers)
no_layers_5 = Panel(simple_step_generator_5.no_layers)

# ----
python_4 = GhPythonScript()  # -> out, a
# ---------- python_4: Python ----------
__author__ = "Fen"
import Rhino.Geometry as rg
import ghpythonlib.components as ghc
import ghpythonlib.treehelpers as th
from compas_ghpython import ghtree_to_list, list_to_ghtree 
from scriptcontext import sticky
"-------Import Personal Library-------"
from compas_rhino import unload_modules
unload_modules('data_structure')
import data_structure as ds
"-------------------------------------"
# ---------- end python_4 ----------

# ----
# End-effector installation position
robot_joint_angles = Panel("""-207.15
-19.71
44.50
-24.7
62.73
-0.32""")

# ----
# Slicing + Support
contour = GhPythonScript(
    brep=python_3.moved_brep,
    layer_height=layer_height_3,
    offset_distance=offset_distance,
    layer_count=layer_count,
    reverse=Toggle(False))  # -> vis_contourCrvs, contourCrv_nList; inputs brep: Brep, layer_count: Int32, reverse: Boolean
# ---------- contour: Python ----------
__author__ = "Fen"
import Rhino.Geometry as rg
import ghpythonlib.components as ghc
import ghpythonlib.treehelpers as th
from compas_ghpython import ghtree_to_list, list_to_ghtree 
"-------Import Library-------"
from compas_rhino import unload_modules
unload_modules('e2e_pathSlicer')
import e2e_pathSlicer as ps
"-------------------------------------"

# get contour curves from a brep
contourCrvs = ps.contour_XY(brep, layer_height, True)

contourCrv_nList =[]

bbcs=[]

if layer_count==1:
    for i,crv in enumerate(contourCrvs):
        if reverse:
            if i%2==1:
                crv.Reverse()
    contourCrv_nList = [[crv] for crv in contourCrvs]
elif layer_count !=1:
    for crv in contourCrvs:
        crvs = []
        for j in range(layer_count):
            if j ==0:
                crvs.append(crv)
            else:
                bb = crv.GetBoundingBox(rg.Vector3d(0,0,1))
                #to check curve center
                bbcs.append(bb.Center)
                offset_crv = crv.Offset(bb.Center, rg.Vector3d(0,0,1), offset_distance*-j, 0.01, rg.CurveOffsetCornerStyle.Sharp)[0]
                print type(offset_crv)
                crvs.append(offset_crv)
        contourCrv_nList.append(crvs)

vis_contourCrvs = list_to_ghtree(contourCrv_nList)
# ---------- end contour ----------
crv_3 = Curve(contour.vis_contourCrvs)

geo_19 = Geometry(simple_step_generator_5.vis)
j = GhPythonScript(joints=robot_joint_angles)  # -> joints; inputs joints: list
# ---------- j: Python ----------
__author__ = "Fen"
import math as m

print "brfore: ", joints
joints = [m.radians(joints[i]) for i in range(len(joints))]
print "after: ", joints
# ---------- end j ----------
geo_20 = Geometry(pathgenerator.inter_ls)
branch = TreeBranch(Tree=geo_19, Path=Slider(3, range=0..10), MaintainPaths=True)
# Data to be visualized
cluster = Cluster(G=ori_pt, G_2=xaxis_pt, T=python_3.T_rhino2UR, G_3=yaxis_pt)  # -> txt_2, D_2, swatch_3, D, swatch_4, panel, R
python_5 = GhPythonScript()  # -> out, layer_revealed_idxs
# ---------- python_5: Python ----------
__author__ = "jend"
__version__ = "2023.01.26"


layer_revealed_idxs = [2]
# ---------- end python_5 ----------
python_6 = GhPythonScript()  # -> out, support_layer_revealed_idxs
# ---------- python_6: Python ----------
__author__ = "jend"
__version__ = "2023.01.26"

support_layer_revealed_idxs = [18]
# ---------- end python_6 ----------
dividecrvs = GhPythonScript(contourCrv_nList=contour.contourCrv_nList, seg_length=seg_length)  # -> simplify(vis_targetPoints), targetPoint_nList; inputs contourCrv_nList: list
# ---------- dividecrvs: Python ----------
__author__ = "Fen"
import Rhino.Geometry as rg
import ghpythonlib.components as ghc
import ghpythonlib.treehelpers as th
from compas_ghpython import ghtree_to_list, list_to_ghtree 
from scriptcontext import sticky
"-------Import Personal Library-------"
from compas_rhino import unload_modules
unload_modules('e2e_pathSlicer')
import e2e_pathSlicer as ps
"-------------------------------------"

"""
check if there's only a single path on each layer, 
if not, reverse every second layer
"""
check = [crv for list in contourCrv_nList for crv in list]
if len(contourCrv_nList) == len(check):
    # one curve on each layer
    pass
else:
    # multiple curves on each layer
    for i,layer in enumerate(contourCrv_nList):
        if i%2==1:
            layer.reverse()
            
"""
creat robot target points
"""
targetPoint_nList=[]
for crvs in contourCrv_nList:
    targetPoints = []
    for crv in crvs:
        print crv
        pts,_ = ps.divide_crv(crv, seg_length, True)
    targetPoint_nList.append(pts)





vis_targetPoints = list_to_ghtree(targetPoint_nList)
# ---------- end dividecrvs ----------
idx_5 = Slider(0, range=0..100)
previewlw = CustomPreviewLineweights(Geometry=python_3.rhino_boundary, Shader=cluster.swatch_4, Thickness=4, Absolute=False)
previewlw_2 = CustomPreviewLineweights(Geometry=boundary, Shader=cluster.swatch_3, Thickness=4, Absolute=False)
screentext = ScreenOrientedText(
    Text=cluster.txt_2,
    Font=cluster.panel,
    Justification=8,
    Location=cluster.R,
    SizeFactor=10,
    Color=[cluster.D_2, cluster.D],
    Depth=5,
    Absolute=False)
print_pt_dist_3 = Slider(20, range=0..1000)
layer_visu_5 = GhPythonScript(print_crvs_array=simple_step_generator_5.print_crvs_array, idx=idx_5)  # -> out, layer_crvs; inputs print_crvs_array: list, idx: Int32
# ---------- layer_visu_5: Python ----------
"""
"""

__author__ = "jend"
__version__ = "2023.01.20"

layer_crvs = print_crvs_array[idx]
# ---------- end layer_visu_5 ----------
panel_7 = Panel(simple_step_generator_5.print_crvs_array)
python_7 = GhPythonScript(
    print_crvs_array=simple_step_generator_5.print_crvs_array,
    layer_revealed_idxs=python_5.layer_revealed_idxs,
    support_layer_revealed_idxs=python_6.support_layer_revealed_idxs,
    no_layers=simple_step_generator_5.no_layers,
    no_support_layers=simple_step_generator_5.no_support_layers,
    print_pt_dist=print_pt_dist_3)  # -> out, all_print_pts, print_pts_array; inputs print_crvs_array: list, layer_revealed_idxs: list, support_layer_revealed_idxs: list, no_layers: Int32, no_support_layers: Int32, print_pt_dist: Int32
# ---------- python_7: Python ----------
__author__ = "jend"
__version__ = "2023.01.26"

import Rhino.Geometry as rg

all_print_pts = []
print_pts_array = []

for i,print_crvs in enumerate(print_crvs_array):
    temp_print_pts = []
    for j,print_crv in enumerate(print_crvs):
        # here you can add patterns for support layers
        if i < no_support_layers and j in support_layer_revealed_idxs:
            print i,j
            temp_params = print_crv.DivideByLength(print_pt_dist, True)
            if temp_params == None:
                count = 1
            else:
                count = len(temp_params)
            temp_params = print_crv.DivideByCount(count, True)
            temp_pts = [print_crv.PointAt(p) for p in temp_params]
            temp_pts.pop(0)
#            temp_print_pts.extend(temp_pts)
        # here is without pattern for support layers
        elif i < no_support_layers and j not in support_layer_revealed_idxs:
            temp_params = print_crv.DivideByLength(print_pt_dist, True)
            if temp_params == None:
                count = 1
            else:
                count = len(temp_params)
            temp_params = print_crv.DivideByCount(count, True)
            temp_pts = [print_crv.PointAt(p) for p in temp_params]
            temp_pts.pop(0)
            temp_print_pts.extend(temp_pts)
        # here you can add patterns for last layers
        elif i >= no_support_layers and j in layer_revealed_idxs:
            print i,j
            temp_params = print_crv.DivideByLength(print_pt_dist, True)
            if temp_params == None:
                count = 1
            else:
                count = len(temp_params)
            temp_params = print_crv.DivideByCount(count, True)
            temp_pts = [print_crv.PointAt(p) for p in temp_params]
            temp_pts.pop(0)
            temp_print_pts.extend(temp_pts)
        # here is without pattern for last layers
        elif i >= no_support_layers and j not in layer_revealed_idxs:
            temp_params = print_crv.DivideByLength(print_pt_dist, True)
            if temp_params == None:
                count = 1
            else:
                count = len(temp_params)
            temp_params = print_crv.DivideByCount(count, True)
            temp_pts = [print_crv.PointAt(p) for p in temp_params]
            temp_pts.pop(0)
            temp_print_pts.extend(temp_pts)
    all_print_pts.extend(temp_print_pts)
    print_pts_array.append(temp_print_pts)
# ---------- end python_7 ----------

# ---- group: Select Target Pt
list_3 = ValueList({"Slicing Brep": 0, "Test infill": 1, "David's": 2}, selected="Slicing Brep")
filter = StreamFilter(Gate=list_3, Stream0=dividecrvs.targetPoint_nList, Stream1=python_2.targetPoint_nList, Stream2=python_7.print_pts_array)

# ----
end_layer = Slider(4, range=0..30)
slice = BooleanToggle(False)
start_layer = Slider(0, range=0..30)

lift_distance = Slider(10, range=0..15)
list_4 = ValueList({"no filter", "wait", "movement", "velocity", "combined"}, selected="movement")
wait_time = Slider(0.48, range=0..2)

# ----
# Add pattern and slice data
reset = Button()

geo_21 = Geometry(layer_visu_5.layer_crvs)

# ---- group: Select Target Pt
list_5 = ValueList({"Origin Point": 0, "X Axis Point": 1, "Y Axis Point": 2, "Diagonal Point": 3, "Safe Point": 4}, selected="X Axis Point")
filter_2 = StreamFilter(Gate=list_5, Stream0=ori_pt, Stream1=xaxis_pt, Stream2=yaxis_pt, Stream3=diag_pt)

# ----
# TCP ADJ
# Blend Ra CCHECK!
# Fabrication Data
# Add Pattern
fabrication_data = GhPythonScript(
    targetPoint_nList=filter,
    rhino_oriPt=python_3.rhino_oriPt,
    ori_pt=ori_pt,
    xAxis_pt=xaxis_pt,
    yAxis_pt=yaxis_pt,
    safe_joints=j,
    velocity=velocity,
    acceleration=acceleration,
    firstLayer_velocity=firstlayer_velocity,
    travel_velocity=travel_velocity,
    slice=slice,
    start_layer=start_layer,
    end_layer=end_layer,
    reset=reset)  # -> targetPoint_nList; inputs targetPoint_nList: list, rhino_oriPt: Point3d, ori_pt: Point3d, xAxis_pt: Point3d, yAxis_pt: Point3d, safe_joints: list, slice: Boolean, start_layer: Int32, end_layer: Int32, reset: Boolean
# ---------- fabrication_data: Python ----------
__author__ = "Fen"
import Rhino.Geometry as rg
import ghpythonlib.components as ghc
import ghpythonlib.treehelpers as th
from compas_ghpython import ghtree_to_list, list_to_ghtree 
"-------Import Personal Library-------"
from compas_rhino import unload_modules
unload_modules('e2e_pathSlicer')
unload_modules('e2e_data_structure')
import e2e_pathSlicer as ps
import e2e_data_structure as ds
unload_modules('fab_data')
from scriptcontext import sticky as fab_data
"-------------------------------------"

def rhino_to_robot_space(rhino_plane, rhino_basePlane, robot_basePlane):
    """ this function translates planes from the rhino cordinate system to
        the robot cordinate system.
        It uses "inputBase_pt", which should use the bottom left corner point(from top view in Rhino)
        to construct a "rhino plane",
        and get a transform matrix from it to the "robot base plane"
    """
    robot_plane = rhino_plane.Clone()
    _matrix = rg.Transform.PlaneToPlane(rhino_basePlane, robot_basePlane)
    robot_plane.Transform(_matrix)
    return robot_plane

""" Change volicity unit from m to mm """
velocity = velocity/1000
acceleration = acceleration/1000
firstLayer_velocity = firstLayer_velocity/1000
travel_velocity = travel_velocity/1000

#""" Here we create a robot base plane """
#rhino_basePlane = rg.Plane(rhino_basePt, rg.Vector3d.ZAxis)
#robot_basePlane = rg.Plane(ori_pt, xAxis_pt - ori_pt, yAxis_pt - ori_pt)

""" Slice if needed """
if slice:
    targetPoint_nList = targetPoint_nList[start_layer:end_layer]
else:
    pass

#""" Create print planes from points """
#targetPlane_nList = []
#vis = []
#for pts in targetPoint_nList:
#    rhino_planes = [rg.Plane(pt, rg.Vector3d.ZAxis) for pt in pts]
#    target_planes = [rhino_to_robot_space(rhino_plane, rhino_basePlane, robot_basePlane) for rhino_plane in rhino_planes]
#    targetPlane_nList.append(target_planes)
#    vis.extend(target_planes)

if reset:
    fab_data.clear()
else:
    fab_data['planes'] = []
    fab_data['waits'] = []
    fab_data['velocities'] = []
    fab_data['accelerations'] =[]
    fab_data['blend_radiuses'] =[]
    
    fab_data['ed_x'] = 0
    fab_data['ed_y'] = 0
    fab_data['ed_z'] = 0
    fab_data['safe_joints'] = safe_joints
    fab_data['robot_points'] = [ori_pt, xAxis_pt, yAxis_pt]
    fab_data['rhino_points'] = [rhino_oriPt]
    fab_data['firstLayer_velocity'] = [firstLayer_velocity]
    fab_data['travel_velocity'] = [travel_velocity]

""" Here we create other parameters for robot """
for i,pts in enumerate(targetPoint_nList):
    vels = []
    accels = []
    if i==0:
        for pt in pts:
            vels.append(fab_data['firstLayer_velocity'][0])
            accels.append(acceleration)
    else:
        for pt in pts:
            vels.append(velocity)
            accels.append(acceleration)
    fab_data['velocities'].append(vels)
    fab_data['accelerations'].append(accels)

    
#print fab_data['travel_velocity']
# ---------- end fabrication_data ----------
pattern_filter = GhPythonScript(targetPoint_nList=fabrication_data, type=list_4, wait_time=wait_time, lift_distance=lift_distance)  # -> targetPoint_nList, vis, wait_nlist; inputs targetPoint_nList: list
# ---------- pattern_filter: Python ----------
__author__ = "Fen"
import Rhino.Geometry as rg
import ghpythonlib.components as ghc
import ghpythonlib.treehelpers as th
from compas_ghpython import ghtree_to_list, list_to_ghtree 

"-------Import Personal Library-------"
from compas_rhino import unload_modules
unload_modules('data_structure')
import e2e_data_structure as ds
unload_modules('fab_data')
from scriptcontext import sticky as fab_data
unload_modules('e2e_pathSlicer')
import e2e_pathSlicer as ps
"-------------------------------------"

def rhino_to_robot_space(rhino_plane, rhino_basePlane, robot_basePlane):
    """ this function translates planes from the rhino cordinate system to
        the robot cordinate system.
        It uses "inputBase_pt", which should use the bottom left corner point(from top view in Rhino)
        to construct a "rhino plane",
        and get a transform matrix from it to the "robot base plane" """
    robot_plane = rhino_plane.Clone()
    _matrix = rg.Transform.PlaneToPlane(rhino_basePlane, robot_basePlane)
    robot_plane.Transform(_matrix)
    return robot_plane

        
#if reset:
#    fab_data.clear()
#    fab_data['planes'] = None
#else:
#    fab_data['planes'] = targetPlane_nList
#    fab_data['waits'] = []
#    fab_data['velocities'] = []
#    fab_data['accelerations'] =[]
#    fab_data['blend_radiuses'] =[]

""" Here we create a robot base plane """
rhino_basePlane = rg.Plane(fab_data['rhino_points'][0], rg.Vector3d.ZAxis)
robot_basePlane = rg.Plane(fab_data['robot_points'][0], fab_data['robot_points'][1] - fab_data['robot_points'][0], fab_data['robot_points'][2] - fab_data['robot_points'][0])
#""" Create print planes from points """
#targetPlane_nList = []
#vis = []
#for pts in targetPoint_nList:
#    rhino_planes = [rg.Plane(pt, rg.Vector3d.ZAxis) for pt in pts]
#    target_planes = [rhino_to_robot_space(rhino_plane, rhino_basePlane, robot_basePlane) for rhino_plane in rhino_planes]
#    targetPlane_nList.append(target_planes)
#    vis.extend(target_planes)

if type =="no filter":
    print "No pattern"
    fab_data['waits'] = ds.duplicateData_nlist(targetPoint_nList, 0)
    vis = []
    for i,pts in enumerate(targetPoint_nList):
        blends = ps.calc_blendRadius(pts, buffer=0.001*0.4)
        fab_data['blend_radiuses'].append(blends)
        rhino_planes = [rg.Plane(pt, rg.Vector3d.ZAxis) for pt in pts]
        target_planes = [rhino_to_robot_space(rhino_plane, rhino_basePlane, robot_basePlane) for rhino_plane in rhino_planes]
        fab_data['planes'].append(target_planes)
        vis.extend(target_planes)

elif type =="wait":
    print "pattern from delaying"
    vis = []
    for i, pts in enumerate(targetPoint_nList):
        blends = ps.calc_blendRadius(pts, buffer=0.001*0.4)
        fab_data['blend_radiuses'].append(blends)
        rhino_planes = [rg.Plane(pt, rg.Vector3d.ZAxis) for pt in pts]
        target_planes = [rhino_to_robot_space(rhino_plane, rhino_basePlane, robot_basePlane) for rhino_plane in rhino_planes]
        fab_data['planes'].append(target_planes)
        vis.extend(target_planes)
        
        waits = []
        for j,pt in enumerate(pts):
            if i==0:
                waits.append(0)
            else:
                if i%2==1:
                    if j%2==0:
                        waits.append(wait_time)
                    else:
                        waits.append(0)
                elif i%2==0:
                    if j%2==0:
                        waits.append(0)
                    else:
                        waits.append(wait_time)
        fab_data['waits'] = [].append(waits)
    
elif type == "movement":
    print "pattern from movement"
    
    new_targetPoint_nList = []
    for i, pts in enumerate(targetPoint_nList):
        new_pts = []
        for j,pt in enumerate(pts):
            if i==0 or i==1:
                new_pts.append(pt)
            else :
                if i%2==1:
                    if j%2==0:
                        new_pts.append(pt+rg.Vector3d(0,0,-lift_distance))
                    else:
                        new_pts.append(pt+rg.Vector3d(0,0,lift_distance))
                elif i%2==0:
                    if j%2==0:
                        new_pts.append(pt+rg.Vector3d(0,0,lift_distance))
                    else:
                        new_pts.append(pt+rg.Vector3d(0,0,-lift_distance))

        new_targetPoint_nList.append(new_pts)
    
    fab_data['waits'] = ds.duplicateData_nlist(targetPoint_nList, 0)
    vis = []
    for i,pts in enumerate(new_targetPoint_nList):
        blends = ps.calc_blendRadius(pts, buffer=0.001*0.4)
        fab_data['blend_radiuses'].append(blends)
        rhino_planes = [rg.Plane(pt, rg.Vector3d.ZAxis) for pt in pts]
        target_planes = [rhino_to_robot_space(rhino_plane, rhino_basePlane, robot_basePlane) for rhino_plane in rhino_planes]
        fab_data['planes'].append(target_planes)
    
    vis=list_to_ghtree (fab_data['planes'])

elif type == "velocity":
    print "pattern from velocity"
    pass
else:
    pass
# ---------- end pattern_filter ----------

idx_6 = Slider(0, range=0..100)
layer_visu_6 = GhPythonScript(print_pts_array=python_7.print_pts_array, idx=idx_6)  # -> out, layer_pts; inputs print_pts_array: list, idx: Int32; same code as layer_visu
pl = GhPythonScript(pt=filter_2)  # -> plane; inputs pt: Point3d
# ---------- pl: Python ----------
import Rhino.Geometry as rg

plane = rg.Plane(pt, rg.Vector3d.XAxis, rg.Vector3d.YAxis)
# ---------- end pl ----------

# ----
# Robot TCP Adjustment
tcp_h = Slider(74.51, range=0..500)

# ----
# Set robot to installation position
# BEFOR or AFTER printing.
installation = Button()

# ----
# Move robot to a certain point
send = Button()

pattern_filter_2 = GhPythonScript(targetPoint_nList=fabrication_data, type=list_4, wait_time=wait_time, lift_distance=lift_distance)  # -> targetPoint_nList, vis, wait_nlist; inputs targetPoint_nList: list; disabled
# ---------- pattern_filter_2: Python ----------
__author__ = "Fen"
import Rhino.Geometry as rg
import ghpythonlib.components as ghc
import ghpythonlib.treehelpers as th
from compas_ghpython import ghtree_to_list, list_to_ghtree 

"-------Import Personal Library-------"
from compas_rhino import unload_modules
unload_modules('data_structure')
import e2e_data_structure as ds
unload_modules('fab_data')
from scriptcontext import sticky as fab_data
unload_modules('e2e_pathSlicer')
import e2e_pathSlicer as ps
"-------------------------------------"

def rhino_to_robot_space(rhino_plane, rhino_basePlane, robot_basePlane):
    """ this function translates planes from the rhino cordinate system to
        the robot cordinate system.
        It uses "inputBase_pt", which should use the bottom left corner point(from top view in Rhino)
        to construct a "rhino plane",
        and get a transform matrix from it to the "robot base plane" """
    robot_plane = rhino_plane.Clone()
    _matrix = rg.Transform.PlaneToPlane(rhino_basePlane, robot_basePlane)
    robot_plane.Transform(_matrix)
    return robot_plane

        
#if reset:
#    fab_data.clear()
#    fab_data['planes'] = None
#else:
#    fab_data['planes'] = targetPlane_nList
#    fab_data['waits'] = []
#    fab_data['velocities'] = []
#    fab_data['accelerations'] =[]
#    fab_data['blend_radiuses'] =[]

""" Here we create a robot base plane """
rhino_basePlane = rg.Plane(fab_data['rhino_points'][0], rg.Vector3d.ZAxis)
robot_basePlane = rg.Plane(fab_data['robot_points'][0], fab_data['robot_points'][1] - fab_data['robot_points'][0], fab_data['robot_points'][2] - fab_data['robot_points'][0])
#""" Create print planes from points """
#targetPlane_nList = []
#vis = []
#for pts in targetPoint_nList:
#    rhino_planes = [rg.Plane(pt, rg.Vector3d.ZAxis) for pt in pts]
#    target_planes = [rhino_to_robot_space(rhino_plane, rhino_basePlane, robot_basePlane) for rhino_plane in rhino_planes]
#    targetPlane_nList.append(target_planes)
#    vis.extend(target_planes)

if type =="no filter":
    print "No pattern"
    fab_data['waits'] = ds.duplicateData_nlist(targetPoint_nList, 0)
    vis = []
    for i,pts in enumerate(targetPoint_nList):
        blends = ps.calc_blendRadius(pts, buffer=0.001*0.4)
        fab_data['blend_radiuses'].append(blends)
        rhino_planes = [rg.Plane(pt, rg.Vector3d.ZAxis) for pt in pts]
        target_planes = [rhino_to_robot_space(rhino_plane, rhino_basePlane, robot_basePlane) for rhino_plane in rhino_planes]
        fab_data['planes'].append(target_planes)
        vis.extend(target_planes)

elif type =="wait":
    print "pattern from delaying"
    vis = []
    for i, pts in enumerate(targetPoint_nList):
        blends = ps.calc_blendRadius(pts, buffer=0.001*0.4)
        fab_data['blend_radiuses'].append(blends)
        rhino_planes = [rg.Plane(pt, rg.Vector3d.ZAxis) for pt in pts]
        target_planes = [rhino_to_robot_space(rhino_plane, rhino_basePlane, robot_basePlane) for rhino_plane in rhino_planes]
        fab_data['planes'].append(target_planes)
        vis.extend(target_planes)
        
        waits = []
        for j,pt in enumerate(pts):
            if i==0:
                waits.append(0)
            else:
                if i%2==1:
                    if j%2==0:
                        waits.append(wait_time)
                    else:
                        waits.append(0)
                elif i%2==0:
                    if j%2==0:
                        waits.append(0)
                    else:
                        waits.append(wait_time)
        fab_data['waits'] = [].append(waits)
    
elif type == "movement":
    print "pattern from movement"
    
    new_targetPoint_nList = []
    for i, pts in enumerate(targetPoint_nList):
        new_pts = []
        for j,pt in enumerate(pts):
            if i==0:
                new_pts.append(pt)
            elif 0< i <len(targetPoint_nList)-3 :
                if 42 < j < 55:
                    if i%2==1:
                        if j%2==0:
                            new_pts.append(pt+rg.Vector3d(0,0,lift_distance))
                        else:
#                            new_pts.append(pt)
                            new_pts.append(pt+rg.Vector3d(0,0,-lift_distance))
                    elif i%2==0:
                        if j%2==1:
#                            new_pts.append(pt)
                            new_pts.append(pt+rg.Vector3d(0,0,lift_distance))
                        else:
#                            new_pts.append(pt)
                            new_pts.append(pt+rg.Vector3d(0,0,-lift_distance))
                else:
                    new_pts.append(pt)
            else :
                if 31 < j < 44:
                    if i%2==1:
                        if j%2==0:
                            new_pts.append(pt+rg.Vector3d(0,0,-lift_distance))
                        else:
                            new_pts.append(pt+rg.Vector3d(0,0,lift_distance))
                    elif i%2==0:
                        if j%2==1:
                            new_pts.append(pt+rg.Vector3d(0,0,-lift_distance))
                        else:
#                            new_pts.append(pt)
                            new_pts.append(pt+rg.Vector3d(0,0,lift_distance))
                else:
                    new_pts.append(pt)
        new_targetPoint_nList.append(new_pts)
    
    fab_data['waits'] = ds.duplicateData_nlist(targetPoint_nList, 0)
    vis = []
    for i,pts in enumerate(new_targetPoint_nList):
        blends = ps.calc_blendRadius(pts, buffer=0.001*0.4)
        fab_data['blend_radiuses'].append(blends)
        rhino_planes = [rg.Plane(pt, rg.Vector3d.ZAxis) for pt in pts]
        target_planes = [rhino_to_robot_space(rhino_plane, rhino_basePlane, robot_basePlane) for rhino_plane in rhino_planes]
        fab_data['planes'].append(target_planes)
    
    vis=list_to_ghtree (fab_data['planes'])

elif type == "velocity":
    print "pattern from velocity"
    pass
else:
    pass
# ---------- end pattern_filter_2 ----------
check_data_length = GhPythonScript()  # -> out
# ---------- check_data_length: Python ----------
__author__ = "Fen"
"-------Import Personal Library-------"
from compas_rhino import unload_modules
unload_modules('fab_data')
from scriptcontext import sticky as fab_data
"-------------------------------------"

if  len(fab_data['planes']) == len(fab_data['waits']) == len(fab_data['velocities']) == len(fab_data['accelerations']) == len(fab_data['blend_radiuses']):
    print ("data matches")
else:
    print ("data doesn't match")
    print 'planes:', len(fab_data['planes'])
    print 'waits:', len(fab_data['waits'])
    print 'velocities:', len(fab_data['velocities'])
    print 'accelerations:', len(fab_data['accelerations'])
    print 'blend_radiuses:', len(fab_data['blend_radiuses'])
# ---------- end check_data_length ----------
geo_22 = Geometry(layer_visu_6.layer_pts)
panel_9 = Panel(check_data_length)
pt_2 = Point(pattern_filter.vis)
pline_6 = PolyLine(Vertices=pt_2, Closed=False)
pt_3 = Point()

# ----
# Data to be visualized
number_slider_4 = Slider(4, range=0..100)
slice_2 = BooleanToggle(False)
slicedata = GhPythonScript(targetPlane_nList=fabrication_data, slice=slice_2, start_layer=Slider(0, range=0..100), end_layer=number_slider_4)  # -> out, simulation_plans; inputs targetPlane_nList: list, slice: Boolean, start_layer: Int32, end_layer: Int32
# ---------- slicedata: Python ----------
__author__ = "Fen"

if slice and len(targetPlane_nList)<end_layer:
    raise IndexError("last layer is set out of the range")


if slice:
    sliced_plans = targetPlane_nList[start_layer:end_layer+1]
    simulation_plans = [plane for planes in sliced_plans for plane in planes]
    print ("%s layers of planes will be simulated "%(len(sliced_plans)))
    print ("planes from %s to %s layer will be simulated"%(start_layer, end_layer))
else:
    simulation_plans = [plane for planes in targetPlane_nList for plane in planes]
    print ("all planes will be simulated")
# ---------- end slicedata ----------
panel_10 = Panel(slicedata.out)
pt_4 = Point(slicedata.simulation_plans)
pline_7 = PolyLine(Vertices=pt_4, Closed=False)

points = PointList(Points=pt_2)
move_3 = Move(Geometry=pt_4, Motion="{0,0,4}")  # -> Geometry, Transform

# ----
# Table Outline
crv_4 = Curve(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)

points_2 = PointList(Points=move_3.Geometry, Size=Slider(3, range=0..10))
item = ListItem(List=pt_4, Index=0, Wrap=True)
send_to = GhPythonScript(joints=j, target_plane=pl, tcp_height=tcp_h, installationPos=installation, send=send)  # -> script; inputs joints: list, target_plane: Plane, installationPos: Boolean
# ---------- send_to: Python ----------
from compas_rhino import unload_modules
unload_modules('simple_ur_script')
unload_modules('simple_comm')
import simple_comm as c
import simple_ur_script as ur
import Rhino.Geometry as rg
import math as m

# End-effector dimension
ed_x = 0
ed_y = 0
ed_z = 0

T = rg.Transform.Translation(0,0,tcp_height)
target_plane.Transform(T)
velocity = 0.10
acceleration = 0.05
blend_redious = 0.005

if installationPos:
    script = ""
    script += ur.set_tcp_by_angles(0, 0, 0, m.radians(-90.0), m.radians(0.0), m.radians(-90.0))#BIG!!!!
    script += ur.move_j(joints, acceleration, velocity)
    script = c.concatenate_script("def sendToSafePos():",script)
    c.send_script(script,"192.168.10.10")

elif send:
    script = ""
    script += ur.set_tcp_by_angles(0, 0, 0, m.radians(-90.0), m.radians(0.0), m.radians(-90.0))#BIG!!!!
    script += ur.move_l(target_plane, acceleration, velocity)
    script = c.concatenate_script("def sendToPt():",script)
    c.send_script(script,"192.168.10.10")
# ---------- end send_to ----------

# ----
# Run test print
send_2 = Button()

# ----
# Export fab data as a json file
export = Button()

# ----
# Add a note to the name
panel_11 = Panel("mockUP2")

# ----
# Send to UR
test_print = GhPythonScript(send=send_2)  # -> script; inputs send: Boolean
# ---------- test_print: Python ----------
from compas_rhino import unload_modules
unload_modules('simple_ur_script')
unload_modules('simple_comm')
import simple_comm as c
import simple_ur_script as ur
import Rhino.Geometry as rg
import math as m

from scriptcontext import sticky as fab_data

#ed_x = 0
#ed_y = 80.00
#ed_z = 95.75
tcp_height =10
T = rg.Transform.Translation(0,0,tcp_height)
#target_plane.Transform(T)

if send:
    script = ""
    script += ur.set_tcp_by_angles(fab_data['ed_x'], fab_data['ed_y'], fab_data['ed_z'], m.radians(-90.0), m.radians(0.0), m.radians(-90.0))#BIG!!!!
    
    
    for i,(planes,vels,accels,blends,extrs) in enumerate(zip(fab_data['planes'],fab_data['velocities'],fab_data['accelerations'],fab_data['blend_radiuses'])):
        for j,(plane,vel,accel,blend,extr) in enumerate(zip(planes,vels,accels,blends,extrs)):
            if i==0 and j ==0:
                planeTo = plane.Clone()
                safeT = rg.Transform.Translation(0,-100,0)
                planeTo.Transform(safeT)
                script += ur.move_l(planeTo, 0.03, 0.2)
            else:
                script += ur.move_l_blend(plane, accel, vel, blend)
    
    script += ur.move_j(fab_data['safe_joints'], 0.03, 0.2)
    script = c.concatenate_script("def testPrint():",script)
    c.send_script(script,"192.168.10.10")
# ---------- end test_print ----------

# ----
# Export Json
export_json = GhPythonScript(note="patternTestPat3", export=export)  # -> attri, json_name, file_path
# ---------- export_json: Python ----------
import Rhino.Geometry as rg
import json
import os
from datetime import datetime
from scriptcontext import sticky as fab_data


""" TCP configuration needs to be implemented """
ed_x = 0
ed_y = 80.00
ed_z = 95.75
tcp_height =10
T = rg.Transform.Translation(0,0,tcp_height)


""" generating fabrication data """
data = {}
count = 0
for i,(planes,vels,accels,blends,waits) in enumerate(zip(fab_data['planes'],fab_data['velocities'],fab_data['accelerations'],fab_data['blend_radiuses'],fab_data['waits'])):
    for j,(plane,vel,accel,blend,wait) in enumerate(zip(planes,vels,accels,blends,waits)):
        point = {
        'frame' : {
            'point' : [plane.OriginX, plane.OriginY, plane.OriginZ],
            'xAxis' : [1.0, 0.0, 0.0],
            'yAxis' : [0.0, 1.0, 0.0]
            },
        'velocity' : vel,
        'acceleration' : accel,
        'blend_radus' : blend,
        'waits': wait,
        'layer' : i,
        'item' :j,
        
        'type' : 'print point'
        }
        data[count] = point
        count+=1

""" get location of GH fle"""
ghComp = ghenv.Component
ghDoc = ghComp.OnPingDocument()

""" the full path of the folder to save gh file """
current_path = ghDoc.FilePath
""" the target directory to dump json """
folder_path = os.path.abspath(os.path.join(current_path,"..","..","00_data","json"))

""" add time to the name """
now = datetime.today()
#currentDate = now.strftime("%y%m%d_")
currentDate = now.strftime("%y%m%d")
currentTime = now.strftime("%H%M")
print "time hhmm: ",currentTime

""" add a note to the name """
addNote = bool(note and not note.isspace())
if addNote:
    #attri =  "%s_"%(note) + currentDate + currentTime
    attri =  "%s_"%(note) + currentDate
else:
    #attri = currentDate + currentTime
    attri = currentDate

""" combining directory with file name """
json_name = 'e2e_printpoints_%s.json'%(attri)
print "json name: ", json_name
file_path = os.path.join(folder_path, json_name)
print "file path and name: ",file_path

""" exort json"""
if export:
    with open(file_path, 'w') as f:
            f.write(json.dumps(data, indent=3, sort_keys=True))
# ---------- end export_json ----------
panel_12 = Panel(export_json.attri)
panel_13 = Panel(export_json.file_path)
panel_14 = Panel(export_json.json_name)

# ---- group: Create UR script from Json
# Json to UR
recompute = Button()
py = PythonScript()  # -> folder_path
# ---------- py: Python ----------
import sys
import os

ghComp = ghenv.Component
ghDoc = ghComp.OnPingDocument()

# the full path of the gh file
current_path = ghDoc.FilePath
# the current directory 
folder_path = os.path.abspath(os.path.join(current_path,"..","..","00_data","json"))

print folder_path
# ---------- end py ----------
dam = DataDam(DataUpdate=panel_14, BufferDelay=10000000, BufferMode=0)
send_3 = Button()
panel_15 = Panel(dam)
panel_16 = Panel(py)
python_8 = GhPythonScript(recompute=recompute, json_name=panel_15, folder_path=py, send=send_3)  # -> out, script; inputs send: Boolean
# ---------- python_8: Python ----------
import os
import json
import Rhino.Geometry as rg
import math as m
import simple_comm as c
import simple_ur_script as ur
from compas.geometry import Frame

from scriptcontext import sticky as fab_data

def compasFrame_toRhinoPlane(data):
    x=data['frame']['point'][0]
    y=data['frame']['point'][1]
    z=data['frame']['point'][2]
    return rg.Plane(rg.Point3d(x,y,z), rg.Vector3d.ZAxis)


filename = os.path.join(folder_path,json_name)
print filename

with open(filename, 'r') as f:
    fabrication_data = json.load(f)

#ed_x = 0
#ed_y = 80.00
#ed_z = 95.75
#tcp_height =10
#T = rg.Transform.Translation(0,0,tcp_height)

print fab_data['firstLayer_velocity'][0]
vis=[]


if send:
    script = ""
    script += ur.set_tcp_by_angles(0, 0, 0, m.radians(-90.0), m.radians(0.0), m.radians(-90.0))
    
    for i in range(len(fabrication_data)):
        pl_data = fabrication_data[str(i)]


        if pl_data['layer'] ==0:
            """ first layer will be printed slower """
            if  pl_data['item'] ==0:
                """ construct a rhino target plane """
                plane = compasFrame_toRhinoPlane(pl_data)
                
                vis.append(plane)
                
                """
#                construct a start plane
                start_plane = plane.Clone()
                safeT = rg.Transform.Translation(0,-100,0)#this has to be visualized
                start_plane.Transform(safeT)
#                 move to safe plane
                script += ur.move_l_blend(start_plane, pl_data['acceleration'],  fab_data['travel_velocity'][0],pl_data['blend_radus'])
                """
                
                """ move to the first plane """
                script += ur.move_l_blend(plane, pl_data['acceleration'],  pl_data['velocity'],pl_data['blend_radus'])
            else:
                plane = compasFrame_toRhinoPlane(pl_data)
                """ move to the rest of planes on 1st layer """
                script += ur.move_l_blend(plane, pl_data['acceleration'],  fab_data['firstLayer_velocity'][0],pl_data['blend_radus'])
        else:
            """ the other layers """
            """ construct a rhino target plane """
            plane = compasFrame_toRhinoPlane(pl_data)
            

            """ move to target plane """
            script += ur.move_l_blend(plane, pl_data['acceleration'],  pl_data['velocity'],pl_data['blend_radus'])
            
            if  pl_data['waits'] !=0:
                script += ur.sleep(pl_data['waits'])
            
            if i != len(fabrication_data)-1:
                current_item = pl_data['item']
                next_item = fabrication_data[str(i+1)]['item']
                if next_item < current_item:
                    script += ur.textmsg(int(pl_data['layer']), ' layer is finished')
                    
            elif i == len(fabrication_data)-1:
                    script += ur.textmsg(int(pl_data['layer']), ' layer is finished, print is DONE')
                    script += ur.textmsg('move to safe position! ', 'happy printing!')
                    """ move to safe config """
                    script += ur.move_j(fab_data['safe_joints'], 0.03, 0.2)
    
    script = c.concatenate_script("def testPrint():",script)
    c.send_script(script,"192.168.10.10")
# ---------- end python_8 ----------

# ----
pln = Plane([Plane(origin=(-359.479, -187.941, 353.991), x=(0.01699754403, 0.9998555313, 0), y=(0, 0, -1)), Plane(origin=(-359.479, -187.941, 353.991), x=(0.2752000206, 0.9613869921, 0), y=(0, 0, -1)), Plane(origin=(-359.479, -187.941, 353.991), x=(-0.4071522001, 0.9133603265, 0), y=(0, 0, -1)), Plane(origin=(-359.479, -187.941, 353.991), x=(0.01699754403, 0.9998555313, 0), y=(-0.4225572066, 0.007183472513, -0.906307787)), Plane(origin=(-359.479, -187.941, 353.991), x=(0.2509541948, 0.9617991712, -0.1093816549), y=(-0.4225572066, 0.007183472513, -0.906307787)), Plane(origin=(-359.479, -187.941, 353.991), x=(-0.3675618803, 0.912687291, 0.1786061952), y=(-0.4225572066, 0.007183472513, -0.906307787))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])
X_3 = UnitX(Factor=Slider(150, range=0..500))
item_2 = ListItem(List=pln, Index=0, Wrap=True)
rev = Reverse(Vector=X_3)
move_4 = Move(Geometry=item_2, Motion=rev)  # -> Geometry, Transform
arrlinear = LinearArray(Geometry=move_4.Geometry, Direction=Vector(0, 25, 0), Count=35)  # -> Geometry, Transform

_201211_2m_panel = Curve(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)
end = EndPoints(Curve=_201211_2m_panel)  # -> Start, End
deplane = DeconstructPlane(Plane=move_4.Geometry)  # -> Origin, XAxis, YAxis, ZAxis
vec2pt = Vector2Pt(PointA=end.Start, PointB=deplane.Origin, Unitize=False)  # -> Vector, Length
move_5 = Move(Geometry=_201211_2m_panel, Motion=vec2pt.Vector)  # -> Geometry, Transform
divide = DivideCurve(Curve=move_5.Geometry, Count=100, Kinks=False)  # -> Points, Tangents, Parameters
Y = UnitY(Factor=1)
Z = UnitZ(Factor=1)
rev_2 = Reverse(Vector=Z)
pl_2 = ConstructPlane(Origin=divide.Points, XAxis=Y, YAxis=rev_2)

panel_17 = Panel(python_8.out)

# ----
# ROS Connection
# Robot Simulation
# Load Robot from urdf
py_2 = GhPythonScript()  # -> urdf_source
# ---------- py_2: Python ----------
import os
import sys

filepath = ghenv.Component.Attributes.Owner.OnPingDocument().FilePath
path = os.path.abspath(os.path.join(filepath, "..", ".."))
print(path)

urdf_source = os.path.abspath(os.path.join(path,"01_docs", "robot_description"))
# ---------- end py_2 ----------
panel_18 = Panel(py_2)
robot_name = ValueList({"ur10_2m"}, selected="ur10_2m")
disconnect = Button()
connect = Button()
restart = Button()
list_6 = ValueList({"simulation": 0, "real_robot": 1}, selected="simulation")
path = PythonScript(path=panel_18, robot_name=robot_name)  # -> urdf_source
# ---------- path: Python ----------
import os

urdf_source = os.path.join(os.path.abspath(path), robot_name)

assert(os.path.isdir(urdf_source))
# ---------- end path ----------
ros = PythonScript(restart=restart, ip=list_6)  # -> ros_client
# ---------- ros: Python ----------
import time
import logging
import scriptcontext as sc

from compas_fab.backends import RosClient
from System import TimeSpan
from System.Threading import ManualResetEventSlim


LOGGER = logging.getLogger('roslibpy')

guid = str(ghenv.Component.InstanceGuid)
ros_client_key = "rosclient_" + guid

previous_client = sc.sticky.get(ros_client_key, None)
if previous_client:
    previous_client.terminate()

if ip == 0: #local
    ros_client = RosClient('127.0.0.1', 9090) #local, own laptop
elif ip == 1: #real robot
    ros_client = RosClient('127.0.0.1', 9090) #place holder

waitLock = ManualResetEventSlim(False)
ros_client.on_ready(lambda: waitLock.Set())

if not waitLock.Wait(TimeSpan.FromSeconds(5)):
    raise Exception('Unable to connect to ROS')

LOGGER.info('Connected to ROS')
# ---------- end ros ----------
connect_2 = PythonScript(ros_client=ros, connect=connect, disconnect=disconnect)  # -> out, ros_client
# ---------- connect_2: Python ----------
import logging
from System import TimeSpan
from System.Threading import ManualResetEventSlim

LOGGER = logging.getLogger('roslibpy')

if connect:
    if not ros_client.is_connected:
        LOGGER.debug('Connecting...')
        waitLock = ManualResetEventSlim(False)
        ros_client.on_ready(lambda: waitLock.Set())
        ros_client.connect()

        if not waitLock.Wait(TimeSpan.FromSeconds(5)):
            raise Exception('Unable to connect to ROS')
        LOGGER.debug('Reconnected')

if disconnect:
    if ros_client.is_connected:
        ros_client.terminate()
        LOGGER.debug('Terminated')
# ---------- end connect_2 ----------
load = BooleanToggle(True)
units = ValueList({"m": 1, "mm": 1000}, selected="mm")
robot = PythonScript(urdf_source=path, ros_client=connect_2.ros_client, scale_factor=units, load=load)  # -> out, robot
# ---------- robot: Python ----------
import os
from scriptcontext import sticky as st
import compas


from compas.robots import RobotModel
from compas.robots import LocalPackageMeshLoader
from compas_fab.ghpython import RobotArtist
from compas_fab.robots import RobotSemantics as RobotSemantics

from compas_fab.robots import Robot as Robot
from compas_fab.backends import RosClient

# Set high precision to import meshes defined in meters
compas.PRECISION = '12f'

# store data in component
guid = str(ghenv.Component.InstanceGuid)
robot_key = "robot_" + guid


if robot_key not in st:
    st[robot_key] = None


if ros_client and ros_client.is_connected and load == True:
    
    model = RobotModel.from_urdf_file(os.path.join(urdf_source, 'robot_description.urdf'))
    model.load_geometry(LocalPackageMeshLoader(urdf_source, 'robot_description'))
    semantics = RobotSemantics.from_srdf_file(os.path.join(urdf_source, 'robot_description.srdf'), model)
    artist = RobotArtist(model)
    robot = Robot(model, artist, semantics)
    
    robot.scale(scale_factor)
    st[robot_key] = robot

robot = st[robot_key]

if robot:
    robot.client = ros_client
# ---------- end robot ----------
info = PythonScript(robot=robot.robot)  # -> out, main_group_name
# ---------- info: Python ----------
if robot:
    robot.info()
    main_group_name = robot.main_group_name
# ---------- end info ----------
panel_19 = Panel(info.out)
main_planning_group = Text(info.main_group_name)
iteration = Slider(1, range=0..10)
reverse = BooleanToggle(True)
pln_2 = Plane([Plane(origin=(-359.479, -187.941, 353.991), x=(0.01699754403, 0.9998555313, 0), y=(0, 0, -1)), Plane(origin=(-359.479, -187.941, 353.991), x=(0.2752000206, 0.9613869921, 0), y=(0, 0, -1)), Plane(origin=(-359.479, -187.941, 353.991), x=(-0.4071522001, 0.9133603265, 0), y=(0, 0, -1)), Plane(origin=(-359.479, -187.941, 353.991), x=(0.01699754403, 0.9998555313, 0), y=(-0.4225572066, 0.007183472513, -0.906307787)), Plane(origin=(-359.479, -187.941, 353.991), x=(0.2509541948, 0.9617991712, -0.1093816549), y=(-0.4225572066, 0.007183472513, -0.906307787)), Plane(origin=(-359.479, -187.941, 353.991), x=(-0.3675618803, 0.912687291, 0.1786061952), y=(-0.4225572066, 0.007183472513, -0.906307787))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])
show = ValueList({"scan_pose": 0, "safe_pose": 1, "slider": 2}, selected="slider")
state = ValueList({"forward_kinematics": 0, "plan_cartesian_motion": 1}, selected="plan_cartesian_motion")
show_end_effector_frame = BooleanToggle(True)
show_visual = BooleanToggle(True)
show_axes = BooleanToggle(False)

# ----
# Configuration
j1 = Slider(9, range=-360..360)
j2 = Slider(-95, range=-360..360)
j3 = Slider(160, range=-360..360)
j4 = Slider(115, range=-360..360)
j5 = Slider(-100, range=-360..360)
j6 = Slider(0, range=-360..360)
forward_kinematics = PythonScript(robot=robot.robot, group=main_planning_group, show=show, j1=j1, j2=j2, j3=j3, j4=j4, j5=j5, j6=j6)  # -> configuration
# ---------- forward_kinematics: Python ----------
import math
from compas_fab.robots import Configuration

if robot:
    if show == 0:
        joint_positions = [-10 + math.degrees(3.14159), -105, 165, 120, -80, 0]
    if show == 1:
        joint_positions = [35 + math.degrees(3.14159), -35, 125, 90, -90, 0]
    if show == 2:
        joint_positions = [j1 + math.degrees(3.14159), j2, j3, j4, j5, j6]
    joint_positions = [math.radians(a) for a in joint_positions]
    types = robot.get_configurable_joint_types(group)
    configuration = Configuration(joint_positions, types)
    print configuration
# ---------- end forward_kinematics ----------

# ---- group: cartesian motion
# Plan Cartesian Motion
py_3 = PythonScript(robot=robot.robot)  # -> configuration
# ---------- py_3: Python ----------
from compas_fab.robots import Configuration

if robot:
    types = robot.get_configurable_joint_types()
    values = [0] * len(types)

    configuration = Configuration(values, types)
    print configuration
# ---------- end py_3 ----------
start_configuration = Data(forward_kinematics)
list_7 = ValueList({"0", "1"}, selected="0")
compute = BooleanToggle(True)
filter_3 = StreamFilter(Gate=list_7, Stream0=start_configuration, Stream1=py_3)
planes = Plane(pl_2)
plan_cartesian_motion = PythonScript(
    robot=robot.robot,
    group=main_planning_group,
    start_configuration=filter_3,
    planes=planes,
    iteration=iteration,
    reverse_list=reverse,
    max_step=10,
    compute=compute)  # -> out, robot, group, trajectory; inputs planes: list, iteration: Int32, reverse_list: Boolean
# ---------- plan_cartesian_motion: Python ----------
import logging
import scriptcontext as sc
from compas.geometry import Frame
from compas.geometry import Translation
import math
from compas_fab.robots import Configuration

guid = str(ghenv.Component.InstanceGuid)
response_key = "response_" + guid
translation_vector_key = "translation_vector" + guid
if response_key not in sc.sticky:
    sc.sticky[response_key] = None

if robot:
    if robot.client:
        if robot.client.is_connected:
            if start_configuration and compute:
                
                joint_positions = [math.radians(a) for a in [0, 0, 0, 0, 0, 0]]
                types = robot.get_configurable_joint_types(group)
                configuration = Configuration(joint_positions, types)
                frames_temp = robot.transformed_frames(configuration, group)
                f1 = frames_temp[8]
                f2 = frames_temp[9]
                translation_vector = [f1[0][1] - f2[0][1], 0, f1[0][2] - f2[0][2]]
                sc.sticky["translation_vector_key"] = translation_vector
                
                frames = []
                
                for i in range(iteration):
                    if reverse_list and i > 0:
                        planes.reverse()
                    for plane in planes:
                        frame = Frame(plane.Origin, plane.ZAxis, -plane.XAxis)
                        x = Translation.from_vector(frame.xaxis.unitized() * -translation_vector[0])
                        z = Translation.from_vector(frame.zaxis.unitized() * translation_vector[2])
                        t_frame = frame.transformed(x)
                        t_frame.transform(z)
                        frames.append(t_frame)
                
                options = {'max_step':float(max_step)}
                response = robot.plan_cartesian_motion(frames, start_configuration=start_configuration, group=group, options=options)
                sc.sticky[response_key] = response
        else:
            print("Robot is not connected")
            sc.sticky[response_key] = None

trajectory = sc.sticky[response_key]
# ---------- end plan_cartesian_motion ----------
vis = PythonScript(trajectory=plan_cartesian_motion.trajectory)  # -> P, V, A, time
# ---------- vis: Python ----------
from compas_ghpython import list_to_ghtree

if trajectory:

    positions = []
    velocities = []
    accelerations = []
    time_from_start = []

    for p in trajectory.points:
        positions.append(p.positions)
        velocities.append(p.velocities)
        accelerations.append(p.accelerations)
        time_from_start.append(p.time_from_start.seconds)

    P = list_to_ghtree(list(zip(*positions)))
    V = list_to_ghtree(list(zip(*velocities)))
    A = list_to_ghtree(list(zip(*accelerations)))
    time = time_from_start[-1]
# ---------- end vis ----------
py_4 = PythonScript(robot=plan_cartesian_motion.robot, group=plan_cartesian_motion.group, trajectory=plan_cartesian_motion.trajectory)  # -> start_configuration, configurations, full_configurations, frames, planes, fraction
# ---------- py_4: Python ----------
from compas_ghpython import draw_frame

joint_positions = []

if trajectory:
    configurations = trajectory.points
    start_configuration = trajectory.start_configuration
    fraction = trajectory.fraction
    time = trajectory.time_from_start
    full_configurations = [robot.merge_group_with_full_configuration(c, trajectory.start_configuration, group) for c in configurations]
    frames = [robot.forward_kinematics(c, group, options=dict(solver='model')) for c in full_configurations]
    planes = [draw_frame(frame) for frame in frames]
    P = [plane.Origin for plane in planes]
# ---------- end py_4 ----------
panel_20 = Panel(plan_cartesian_motion.out)
prismatic = QuickGraph(vis.P, SortOrder=0)
panel_21 = Panel("positions")
scale = Scale(Geometry=py_4.planes, Center=Point(0, 0, 0), Factor=0.001)  # -> Geometry, Transform
fraction = Panel(py_4.fraction)
graph = QuickGraph(vis.V, SortOrder=0)
graph_2 = QuickGraph(vis.A, SortOrder=0)
pline_8 = PolyLine(Vertices=scale.Geometry, Closed=False)
panel_22 = Panel("velocities")
start = Button()
reset_2 = Button()
step = Button()
counter = CountThroughList(L=py_4.full_configurations, start=start, step=step, reset=reset_2)  # -> item; inputs L: list, start: Boolean
# ---------- counter: Python ----------
from scriptcontext import sticky as st
from compas_ghpython.utilities import update_component


interval = 1

# store data in component
guid = str(ghenv.Component.InstanceGuid)
counter_key = "counter_" + guid
running_key = "running_" + guid

if counter_key not in st:
    st[counter_key] = 0

if running_key not in st:
    st[running_key] = False

if start:
    st[running_key] = True

if step:
    if st[counter_key] < len(L) - 1:
        st[counter_key] += 1
    
if len(L):
    item = L[st[counter_key]]

if st[running_key]:
    if st[counter_key] < len(L) - 1:
        st[counter_key] += 1
        update_component(ghenv, interval)
    else:
        st[counter_key] = 0
        st[running_key] = False
# ---------- end counter ----------
panel_23 = Panel("accelerations")
preview = CustomPreview(Geometry=scale.Geometry, Material=ColourSwatch(SwatchColor=RGB(59, 137, 161)))

# ----
multiplication = Multiplication(A=vis.time, B=4.25)
filter_4 = StreamFilter(Gate=state, Stream0=forward_kinematics, Stream1=counter)
visualize = PythonScript(
    mode=list_6,
    robot=robot.robot,
    robot_name=robot_name,
    configuration=filter_4,
    group=main_planning_group,
    scale_factor=units,
    show_visual=show_visual,
    show_axes=show_axes,
    show_end_effector_frame=show_end_effector_frame)  # -> visual, axes, axes_color, ee_frame_vis, ee_color, ee_frame, ee_plane
# ---------- visualize: Python ----------
from System.Drawing import Color
from compas_ghpython.utilities import draw_pipes
from compas_ghpython import draw_frame
from compas.geometry import Point
from compas.geometry import Vector
from compas.geometry import Translation

frames = []

size = .200 * scale_factor 
size_w = 2 * scale_factor 
radius = .008 * scale_factor
radius_w = .018 * scale_factor 

red = Color.FromArgb(255, 0, 0)
green = Color.FromArgb(0, 255, 0)
blue = Color.FromArgb(0, 0, 255)

frame_colors = [red, green, blue]


def pipes_from_frame(frame, size, radius): 
    pipes = []
    for axis in [frame.xaxis, frame.yaxis, frame.zaxis]:
        pipe = {}
        pipe['points'] = [list(frame.point), list(Point(*frame.point) + Vector(*axis) * size)]
        pipe['radius'] = radius
        pipes.append(pipe)
    return pipes


if robot and configuration and mode == 0:
    robot.update(configuration, visual=show_visual, collision=False)
    if show_visual:
        visual = robot.artist.draw_visual()
    if show_axes:
        pipes = []
        axes_color = []
        frames = robot.transformed_frames(configuration, group)
        for frame in frames:
            pipes += pipes_from_frame(frame, size, radius)
            axes_color += frame_colors
        axes = draw_pipes(pipes, cap=1)
    
    
    if show_end_effector_frame:
        frames = robot.transformed_frames(configuration, group)
        ee_frame = frames[8]
        ee_plane = draw_frame(ee_frame)
        print("End-effector", ee_frame)

        #Draw
        ee_pipes = pipes_from_frame(ee_frame, size, radius)
        ee_frame_vis = draw_pipes(ee_pipes, cap=1)
        ee_color = frame_colors
# ---------- end visualize ----------
preview_2 = CustomPreview(Geometry=visualize.axes, Shader=visualize.axes_color)
preview_3 = CustomPreview(Geometry=visualize.ee_frame_vis, Shader=visualize.ee_color)
preview_4 = CustomPreview(Geometry=visualize.visual, Shader=ColourSwatch(SwatchColor=RGB(105, 105, 105)))

# ---- group: cartesian motion (continued)
time_sec = Panel(multiplication)

# ----
division = Division(A=time_sec, B=60)
time_min = Panel(division)

# ==== cluster Cluster
swatch = ColourSwatch(SwatchColor=RGB(255, 170, 255))
swatch_2 = ColourSwatch(SwatchColor=RGB(255, 170, 119))
G = ClusterInput()
G_2 = ClusterInput()
G_3 = ClusterInput()
swatch_3 = ClusterOutput(swatch)
swatch_4 = ClusterOutput(swatch_2)
panel = ClusterOutput("3ds Light")
repeat = RepeatData(Data=swatch_2, Length=3)
repeat_2 = RepeatData(Data=swatch, Length=3)
move = Move(Geometry=G, Motion="{0,-50,0}")  # -> Geometry, Transform
move_2 = Move(Geometry=G_2, Motion="{0,-50,0}")  # -> Geometry, Transform
move_3 = Move(Geometry=G_3, Motion="{-50,-50,0}")  # -> Geometry, Transform
T = ClusterInput()
txt = Text(["UR Origin", "UR X", "UR Y", "Rh Origin", "Rh X", "Rh Y"])
D = ClusterOutput(repeat)
D_2 = ClusterOutput(repeat_2)
pt = Point([move.Geometry, move_3.Geometry, move_2.Geometry])
txt_2 = ClusterOutput(txt)
move_4 = Move(Geometry=pt, Motion=T)  # -> Geometry, Transform
merge = Merge(Data1=pt, Data2=move_4.Geometry)
R = ClusterOutput(merge)
