# Grasshopper definition 00_UR_basicSettings_Large.ghx (Grasshopper 1.0.7)

panel = Panel("""4mm nozzle

speed
8mm/17mm""")
layer_height = Slider(2.5, range=0.5..10)
offset_distance = Slider(3.8, range=0.5..50)
layer_count = Slider(2, range=1..10)
seg_length = Slider(2.9, range=0.1..10)

# ---- group: Safe_pt
pt = ConstructPoint(XCoordinate="504.56", YCoordinate="-496.20", ZCoordinate="-108.00")

# ---- group: Ori Pt
# Calibration
# UR10 Calibration Points & Work Area
# 
# Tool tip should just touch the ruler!!!
# 
# You should feel it's hardly to move the ruler
panel_2 = Panel("515.00")
pt_2 = ConstructPoint(XCoordinate=panel_2, YCoordinate="-180.00", ZCoordinate="-37.97")

# ---- group: xAxis_pt
pt_3 = ConstructPoint(XCoordinate="765.00", YCoordinate="-180.00", ZCoordinate="-38.40")

# ---- group: yAxis_pt
pt_4 = ConstructPoint(XCoordinate="515.00", YCoordinate="210", ZCoordinate="-37.66")

# ----
# Input Geo
brep = Brep(<brep referenced from the Rhino model>)

# ----
# Slicing Parameters
layer_height_2 = Slider(15, range=0.5..20)
layer_count_2 = Slider(1, range=1..10)
seg_length_2 = Slider(2.9, range=0.1..10)
offset_distance_2 = Slider(7, range=0.5..50)

# ----
# Robot Parameters
velocity = Slider(15, range=0..50)
acceleration = Slider(800, range=0..1000)

panel_3 = Panel("20")
# Robot safety position
list = ValueList({"Samll extruder": 0, "Large extruder": 1}, selected="Large extruder")

# ----
# End-effector installation position
robot_joint_angles = Panel("""-180.00
-55.00
125.00
-260.00
-90.00
180.00""")

# ---- group: Select Target Pt
list_2 = ValueList({"Origin Point": 0, "X Axis Point": 1, "Y Axis Point": 2, "Safe Point": 3}, selected="Y Axis Point")
filter = StreamFilter(Gate=list_2, Stream0=pt_2, Stream1=pt_3, Stream2=pt_4, Stream3=pt)

# ----
# Slicing + Support
contour = GhPythonScript(brep=brep, layer_height=layer_height_2, offset_distance=offset_distance_2, layer_count=layer_count_2)  # -> bbcs, contourCrvs, vis_contourCrvs, contourCrv_nList; inputs brep: Brep, layer_count: Int32
# ---------- contour: Python ----------
__author__ = "Fen"
import Rhino.Geometry as rg
import ghpythonlib.components as ghc
import ghpythonlib.treehelpers as th
from compas_ghpython import ghtree_to_list, list_to_ghtree 
"-------Import Library-------"
from compas_rhino import unload_modules
unload_modules('e2e_pathSlicer')
import e2e_pathSlicer as ps
"-------------------------------------"

def contour_XY(brep, layer_height, simplify):
    contour_crvs =[]
    bbox = rg.Brep.GetBoundingBox(brep, rg.Plane.WorldXY)
    lowest_pt = bbox.Min
    highest_pt = bbox.Max
    #print (bbox.Min)
    #print (bbox.Max)
    contour_range = int((highest_pt.Z-lowest_pt.Z)/layer_height) +1
    normal =  rg.Vector3d(0,0,1)
    #planes=[]

    for i in range(contour_range):
        plane_ori = lowest_pt + normal*layer_height*i
        intersection_plane = rg.Plane(plane_ori, rg.Vector3d.XAxis, rg.Vector3d.YAxis)
        #planes.append(intersection_plane)
        intersection_events = rg.Intersect.Intersection.BrepPlane(brep, intersection_plane,0.01)
        if intersection_events[0]:
            layer_crvs = intersection_events[1]
            if len(layer_crvs)>1:
                layer_crvs = rg.Curve.JoinCurves(layer_crvs)
            for crv in layer_crvs:
                if simplify:
                    crv.Simplify(rg.CurveSimplifyOptions.All, distanceTolerance=0.01, angleToleranceRadians=0.01)
                contour_crvs.append(crv)
    return contour_crvs

# get contour curves from a brep
contourCrvs = contour_XY(brep, layer_height, True)

contourCrv_nList =[]

bbcs=[]

if layer_count==1:
    contourCrv_nList = [[crv] for crv in contourCrvs]
elif layer_count !=1:
    for crv in contourCrvs:
        crvs = []
        for j in range(layer_count):
            if j ==0:
                crvs.append(crv)
            else:
                bb = crv.GetBoundingBox(rg.Vector3d(0,0,1))
                #to check curve center
                bbcs.append(bb.Center)
                offset_crv = crv.Offset(bb.Center, rg.Vector3d(0,0,1), offset_distance*-j, 0.01, rg.CurveOffsetCornerStyle.Sharp)[0]
    #            print type(offset_crv[0])
                crvs.append(offset_crv)
        contourCrv_nList.append(crvs)

vis_contourCrvs = list_to_ghtree(contourCrv_nList)
# ---------- end contour ----------
crv = Curve(contour.vis_contourCrvs)

# ---- group: Send to calibrate table
# Here we calibrate the printing table
# 1.
# "Click send_TCP"
# 2.
# Set "tcp_h" to "0" while calibrating
# Set "tcp_h" >20  after calibration for safety reason
# 3. Click "send"
send_tcp = Button()
send = Button()
conplane = GhPythonScript()  # -> plane; inputs pt: Point3d
# ---------- conplane: Python ----------
import Rhino.Geometry as rg

plane = rg.Plane(pt, rg.Vector3d.XAxis, rg.Vector3d.YAxis)
# ---------- end conplane ----------
tcp_h = Slider(30.04, range=0..300)
# Robot Parameters
sendtopoint = GhPythonScript(target_plane=conplane, tcp_height=tcp_h, send_TCP=send_tcp, send=send)  # -> rhino_base_way_planes, robot_planes, target_plane, script; inputs target_plane: Plane, send_TCP: Boolean
# ---------- sendtopoint: Python ----------
from compas_rhino import unload_modules
unload_modules('simple_ur_script')
unload_modules('simple_comm')

import simple_comm as c
import simple_ur_script as ur
import Rhino.Geometry as rg
import math as m

if send_TCP:
    script = ""
    script += ur.set_tcp_by_angles(float(-17.90), float(45.85), float(143.68), m.radians(0.0), m.radians(180.0), m.radians(90.0))
    script = c.concatenate_script(script)
    c.send_script(script,"192.168.10.10")

T = rg.Transform.Translation(0,0,tcp_height)
target_plane.Transform(T)

if send:
    script = ""
    script += ur.set_tcp_by_angles(float(-17.90), float(45.85), float(143.68), m.radians(0.0), m.radians(180.0), m.radians(90.0))
    velocity = 0.05
    acceleration = 0.02
    
    script += ur.move_l(target_plane, acceleration, velocity)
    script = c.concatenate_script(script)
    c.send_script(script,"192.168.10.10")
# ---------- end sendtopoint ----------

# ----
pt_5 = Point(contour.bbcs)
# Modify Geometry
# Note
# motor 2600, UR 10mm/s
# good quality
dividecrvs = GhPythonScript(contourCrv_nList=contour.contourCrv_nList, seg_length=seg_length_2)  # -> vis_wayPoints, wayPoint_nList; inputs contourCrv_nList: list
# ---------- dividecrvs: Python ----------
__author__ = "Fen"
import Rhino.Geometry as rg
import ghpythonlib.components as ghc
import ghpythonlib.treehelpers as th
from compas_ghpython import ghtree_to_list, list_to_ghtree 
from scriptcontext import sticky
"-------Import Personal Library-------"
from compas_rhino import unload_modules
unload_modules('e2e_pathSlicer')
import e2e_pathSlicer as ps
"-------------------------------------"

"""
check if there's only a single path on each layer, 
if not, reverse every second layer
"""
check = [crv for list in contourCrv_nList for crv in list]
if len(contourCrv_nList) == len(check):
    pass
else:
    for i,layer in enumerate(contourCrv_nList):
        if i%2==1:
            layer.reverse()

"""
creat robot waypoints
"""
wayPoint_nList=[]
for crvs in contourCrv_nList:
    wayPoints = []
    for crv in crvs:
        if crv.Degree ==1:
            crv_segs = crv.DuplicateSegments()
            for i,seg in enumerate(crv_segs):
                if i !=len(crv_segs)-1:
                    wayPoints.append(seg.PointAtStart)
                else:
                    wayPoints.append(seg.PointAtStart)
                    wayPoints.append(seg.PointAtEnd)
        elif crv.Degree !=1:
            print "curved"
            pts,_ = ps.divide_crv(crv, seg_length, True)
            wayPoints.extend(pts)
    wayPoint_nList.append(wayPoints)



print len(wayPoint_nList)

vis_wayPoints = list_to_ghtree(wayPoint_nList)
# ---------- end dividecrvs ----------
velocity_2 = Slider(300, range=0..1000)
# reg pressure 0.7
# 
# motor 2800, UR 15mm/s*85%
# good quality
# start 13:30
# 
# 4min for a layer(2 path)
# 
# change to 100% speed at 1:40
# 
# layer h =3
# 
# stop 14:30
# reg pressure 0.7
# 
# motor 2800, UR 30mm/s*85%
# good quality
# 100% speed startat 14:40
# 
# 
# 
# layer h =3.3
panel_4 = Panel("""pre 0.25, 0.2-0.3

v =15

lh=3.3""")
# Fabrication Data
# Rhino pt >>>target pt
python = GhPythonScript(
    ori_pt=pt_2,
    xAxis_pt=pt_3,
    yAxis_pt=pt_4,
    wayPoint_nList=dividecrvs.wayPoint_nList,
    velocity=velocity_2,
    acceleration=acceleration)  # -> vis, wayPlane_nList, vel_nList, accel_nList, blend_nList, extr_nList; inputs ori_pt: Point3d, xAxis_pt: Point3d, yAxis_pt: Point3d, wayPoint_nList: list
# ---------- python: Python ----------
__author__ = "Fen"
import Rhino.Geometry as rg
import ghpythonlib.components as ghc
import ghpythonlib.treehelpers as th
from compas_ghpython import ghtree_to_list, list_to_ghtree 
from scriptcontext import sticky
"-------Import Personal Library-------"
from compas_rhino import unload_modules
unload_modules('e2e_pathSlicer')
import e2e_pathSlicer as ps
import utils as ut
"-------------------------------------"

def set_robot_basePlane(ori_pt, xAxis_pt, yAxis_pt):
    """ This function constructs the robot base plane form 3 calibrated points.
    """
    robot_basePlane = rg.Plane(ori_pt, xAxis_pt - ori_pt, yAxis_pt - ori_pt)
    return robot_basePlane

def rhino_to_robot_space(rhino_plane, rhino_basePlane, robot_basePlane):
    """ this function translates planes from the rhino cordinate system to
        the robot cordinate system.
        It uses "inputBase_pt", which should use the bottom left corner point(from top view in Rhino)
        to construct a "rhino plane",
        and get a transform matrix from it to the "robot base plane"
    """
    robot_plane = rhino_plane.Clone()
    _matrix = rg.Transform.PlaneToPlane(rhino_basePlane, robot_basePlane)
    robot_plane.Transform(_matrix)
    return robot_plane


velocity = velocity/1000
acceleration = acceleration/1000
print velocity

"""Here we create robot way planes"""
rhino_basePlane = rg.Plane.WorldXY
robot_basePlane = rg.Plane(ori_pt, xAxis_pt - ori_pt, yAxis_pt - ori_pt)

wayPlane_nList = []
vis = []
for pts in wayPoint_nList:
    rhino_planes = [rg.Plane(pt, rg.Vector3d.ZAxis) for pt in pts]
    robot_planes = [rhino_to_robot_space(rhino_plane, rhino_basePlane, robot_basePlane) for rhino_plane in rhino_planes]
    wayPlane_nList.append(robot_planes)
    vis.extend(robot_planes)
    

"""Here we create other parameters for robot"""
vel_nList =[]
accel_nList =[]
blend_nList =[]
extr_nList =[]
for i,pts in enumerate(wayPoint_nList):
    vels = []
    accels = []
    #blends = ps.calc_blendRadius(pts, buffer=0.0001)
    blends = []
    extrs = []
    if i==0:
        for pt in pts:
            vels.append(velocity)
            accels.append(acceleration)
            extrs.append(True)
            blends.append(0.05)
    else:
        for pt in pts:
            vels.append(velocity)
            accels.append(acceleration)
            extrs.append(True)
            blends.append(0.05)
    vel_nList.append(vels)
    accel_nList.append(accels)
    blend_nList.append(blends)
    extr_nList.append(extrs)

print (vel_nList[1])
# ---------- end python ----------
# velocity = 0.012
# acceleration = 0.05
# blend_redious = 0.01
# layers = 50
# layer_height = 3.5
pl = GhPythonScript(pt=filter)  # -> plane; inputs pt: Point3d; same code as conplane

# ----
# Set robot to installation position
# BEFOR or AFTER printing.
installationpos = Button()

io_on = BooleanToggle(False)

# ----
# Move robot to a certain point
targetpt = Button()

# ----
# Robot TCP Adjustment
tcp_h_2 = Slider(434.39, range=0..500)

# ----
# False for Dry Run
# True for Print
io_on_2 = BooleanToggle(False)

# ----
# Run test print
send_2 = Button()

# ----
# velocity = 0.020
# acceleration = 0.05
# blend_redious = 0.01
# layers = 50
# layer_height = 3.5
send_to = GhPythonScript(
    joints=robot_joint_angles,
    target_plane=pl,
    tcp_height=tcp_h_2,
    installationPos=installationpos,
    IO_on=io_on,
    send=targetpt)  # -> script; inputs joints: list, target_plane: Plane, installationPos: Boolean, IO_on: Boolean
# ---------- send_to: Python ----------
from compas_rhino import unload_modules
unload_modules('simple_ur_script')
unload_modules('simple_comm')
import simple_comm as c
import simple_ur_script as ur
import Rhino.Geometry as rg
import math as m


#ed_x = 0
#ed_y = 80.00
#ed_z = 95.75

T = rg.Transform.Translation(0,0,tcp_height)
target_plane.Transform(T)
velocity = 0.05
acceleration = 0.05
blend_redious = 0.005

if installationPos:
    script = ""
    joints = [m.radians(joints[i]) for i in range(len(joints))]
    script += ur.move_j(joints, acceleration, velocity)
    script = c.concatenate_script("def sendToSafePos():",script)
    c.send_script(script,"192.168.10.10")

elif send:
    script = ""
    if IO_on:
        script += ur.set_digital_out(0, True)
        script += ur.set_standard_analog_out(0,0.28)

    else:
        script += ur.set_digital_out(0, False)
        script += ur.set_standard_analog_out(0,0)

#    script += ur.set_tcp_by_angles(ed_x, ed_y, ed_z, m.radians(-180.0), m.radians(0.0), m.radians(-90.0))
    script += ur.set_tcp_by_angles(0, 0, 0, m.radians(-90.0), m.radians(0.0), m.radians(-90.0))
    script += ur.move_l(target_plane, acceleration, velocity)
    script = c.concatenate_script("def sendToPt():",script)
    c.send_script(script,"192.168.10.10")
# ---------- end send_to ----------
toggle = BooleanToggle(True)

# ----
# Simulation
pt_6 = Point(python.vis)
pline = PolyLine(Vertices=pt_6, Closed=False)
points = PointList(Points=pt_6, Size=Slider(2.3, range=0.5..5))

# ----
# Send
test_print = GhPythonScript(
    target_plane=pl,
    wayPlane_nList=python.wayPlane_nList,
    vel_nList=python.vel_nList,
    accel_nList=python.accel_nList,
    blend_nList=python.blend_nList,
    extr_nList=python.extr_nList,
    IO_on=io_on_2,
    send=send_2)  # -> script, planTo; inputs target_plane: Plane, wayPlane_nList: list, vel_nList: list, accel_nList: list, blend_nList: list, extr_nList: list, send: Boolean
# ---------- test_print: Python ----------
from compas_rhino import unload_modules
unload_modules('simple_ur_script')
unload_modules('simple_comm')
import simple_comm as c
import simple_ur_script as ur
import Rhino.Geometry as rg
import math as m

ed_x = 0
ed_y = 80.00
ed_z = 95.75
tcp_height =0

T = rg.Transform.Translation(0,0,tcp_height)
#target_plane.Transform(T)

print vel_nList[2][2]
if send:
    script = ""
    script += ur.set_digital_out(0, False)#Turn off air
    script += ur.set_standard_analog_out(0,0)#Turn off motor
    
    script += ur.set_tcp_by_angles(0, 0, 0, m.radians(-90.0), m.radians(0.0), m.radians(-90.0))
    
    #change this plane to a safe plane above the bed
    planeTo = wayPlane_nList[0][0]
    safePlane = planeTo.Clone()
    safeT = rg.Transform.Translation(0, 100, 0)
    safePlane.Transform(safeT)
    
    script += ur.move_l(safePlane, 0.1, 0.05)
    
    for planes,vels,accels,blends,extrs in zip(wayPlane_nList,vel_nList,accel_nList,blend_nList,extr_nList):
        for j,(plane,vel,accel,blend,extr) in enumerate(zip(planes,vels,accels,blends,extrs)):
            #script += ur.move_l(plane, accel, vel)
            script += ur.move_l_blend(plane, accel, vel, 0.005)
            
            if extr and IO_on:
                script += ur.set_digital_out(0, True)#Turn on air
                script += ur.set_standard_analog_out(0,0.3)# = 2.8 Voltage
                
            elif j%5==0:
                print vel

    script += ur.set_digital_out(0, False)#Turn off air
    script += ur.set_standard_analog_out(0,0)#Turn off motor
    
    #change this plane to a safe plane above the bed
    #script += ur.move_l(target_plane, acceleration, velocity)
    
    script = c.concatenate_script("def testPrint():",script)
    c.send_script(script,"192.168.10.10")
# ---------- end test_print ----------
panel_5 = Panel(test_print.script)

# ----
# velocity = 0.015
# acceleration = 0.05
# blend_redious = 0.005
# layers = 50
# layer_height = 4.0
# velocity = 0.08
# acceleration = 0.05
# blend_redious = 0.005
# layers = 50
# layer_height = 3.0
panel_6 = Panel(send_to)
pt_7 = Point()
pln = Plane(test_print.planTo)
