# Grasshopper definition 01_e2e_UR_PCP.ghx (Grasshopper 1.0.7)
# plug-ins: Human

# ---- group: ori_pt
# Calibration
# UR10 Calibration Points & Work Area
# 
# Tool tip should just touch the ruler!!!
# 
# You should feel it's hardly to move the ruler
panel = Panel("570")
ori_pt = ConstructPoint(XCoordinate=panel, YCoordinate="-260", ZCoordinate=Slider(-279.4, range=-300..0))

# ---- group: xAxis_pt
xaxis_pt = ConstructPoint(XCoordinate="1170", YCoordinate="-260", ZCoordinate=Slider(-282.3, range=-300..0))

# ---- group: yAxis_pt
yaxis_pt = ConstructPoint(XCoordinate="570", YCoordinate="260", ZCoordinate=Slider(-280.6, range=-300..0))

# ---- group: diag_pt
diag_pt = ConstructPoint(XCoordinate="1170", YCoordinate="260", ZCoordinate=Slider(-284.9, range=-300..0))

# ----
# Input Brep
brep = Brep(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)

# ----
# Print Adjustment
number_slider = Slider(454.4, range=0..500)

# ----
# Slicing Parameters
layer_height = Slider(8, range=0.5..300)
offset_distance = Slider(7, range=0.5..50)
layer_count = Slider(1, range=1..10)
seg_length = Slider(25, range=5..200)

# ----
# Robot Parameters
velocity = Slider(140, range=0..999)
firstlayer_velocity = Slider(80, range=0..999)
travel_velocity = Slider(110, range=0..999)
acceleration = Slider(300, range=0..500)

# ----
# 1st Step Parameters
total_height = Slider(170, range=0..300)
total_width = Slider(120, range=0..300)
curb_height = Slider(115, range=0..300)
curb_width = Slider(70, range=0..300)
casting_depth = Slider(40, range=0..300)
pattern_start = Slider(11, range=0..100)
pattern_end = Slider(19, range=0..100)
skip_start = Slider(5, range=0..100)
skip_end = Slider(8, range=0..100)
block_width = Slider(300, range=0..500)
extend_width = Slider(80, range=0..500)

# ----
# Design Input Data
print_pts_array = Data()
pattern_bools_array = Data()

# ----
# End-effector installation position
robot_joint_angles = Panel("""-207.15
-19.71
44.50
-24.7
62.73
-0.32""")
robot_joint_angles_2 = Panel("""-213.5
-52.7
119.65
-66.43
56.21
-0.41""")
# Print Adjustment
list = ValueList({"Right Front": 0, "Right Back": 1}, selected="Right Front")
filter = StreamFilter(Gate=list, Stream0=robot_joint_angles, Stream1=robot_joint_angles_2)
j = GhPythonScript(joints=filter)  # -> joints; inputs joints: list
# ---------- j: Python ----------
__author__ = "Fen"
import math as m

print "brfore: ", joints
joints = [m.radians(joints[i]) for i in range(len(joints))]
print "after: ", joints
# ---------- end j ----------

python = GhPythonScript(rhino_oriPt=ori_pt, input_brep=brep, x_adjustment=number_slider, y_adjustment=Slider(0, range=0..500))  # -> out, rhino_boundary, moved_brep, T_rhino2UR, rhino_oriPt; inputs rhino_oriPt: Point3d, input_brep: Brep
# ---------- python: Python ----------
__author__ = "Fen"
import Rhino.Geometry as rg

input_bb = rg.Brep.GetBoundingBox(input_brep, rg.Plane.WorldXY)
T = rg.Point3d(rhino_oriPt.X+x_adjustment, rhino_oriPt.Y+y_adjustment, rhino_oriPt.Z) - input_bb.Min
moved_brep = input_brep.Duplicate()
moved_brep.Translate(T)
# ---------- end python ----------

# ----
# Brep Slicing
toggle = BooleanToggle(False)
contour = GhPythonScript(
    brep=python.moved_brep,
    layer_height=layer_height,
    offset_distance=offset_distance,
    layer_count=layer_count,
    reverse=toggle)  # -> vis_contourCrvs, contourCrv_nList; inputs brep: Brep, layer_count: Int32, reverse: Boolean
# ---------- contour: Python ----------
__author__ = "Fen"
import Rhino.Geometry as rg
import ghpythonlib.components as ghc
import ghpythonlib.treehelpers as th
from compas_ghpython import ghtree_to_list, list_to_ghtree 
"-------Import Library-------"
from compas_rhino import unload_modules
unload_modules('e2e_pathSlicer')
import e2e_pathSlicer as ps
"-------------------------------------"

# get contour curves from a brep
contourCrvs = ps.contour_XY(brep, layer_height, True)

contourCrv_nList =[]

bbcs=[]

if layer_count==1:
    for i,crv in enumerate(contourCrvs):
        if reverse:
            if i%2==1:
                crv.Reverse()
    contourCrv_nList = [[crv] for crv in contourCrvs]
elif layer_count !=1:
    for crv in contourCrvs:
        crvs = []
        for j in range(layer_count):
            if j ==0:
                crvs.append(crv)
            else:
                bb = crv.GetBoundingBox(rg.Vector3d(0,0,1))
                #to check curve center
                bbcs.append(bb.Center)
                offset_crv = crv.Offset(bb.Center, rg.Vector3d(0,0,1), offset_distance*-j, 0.01, rg.CurveOffsetCornerStyle.Sharp)[0]
                print type(offset_crv)
                crvs.append(offset_crv)
        contourCrv_nList.append(crvs)

vis_contourCrvs = list_to_ghtree(contourCrv_nList)
# ---------- end contour ----------
dividecrvs = GhPythonScript(contourCrv_nList=contour.contourCrv_nList, seg_length=seg_length)  # -> simplify(vis_targetPoints), targetPoint_nList; inputs contourCrv_nList: list
# ---------- dividecrvs: Python ----------
__author__ = "Fen"
import Rhino.Geometry as rg
import ghpythonlib.components as ghc
import ghpythonlib.treehelpers as th
from compas_ghpython import ghtree_to_list, list_to_ghtree 
from scriptcontext import sticky
"-------Import Personal Library-------"
from compas_rhino import unload_modules
unload_modules('e2e_pathSlicer')
import e2e_pathSlicer as ps
"-------------------------------------"

"""
check if there's only a single path on each layer, 
if not, reverse every second layer
"""
check = [crv for list in contourCrv_nList for crv in list]
if len(contourCrv_nList) == len(check):
    # one curve on each layer
    pass
else:
    # multiple curves on each layer
    for i,layer in enumerate(contourCrv_nList):
        if i%2==1:
            layer.reverse()
            
"""
creat robot target points
"""
targetPoint_nList=[]
for crvs in contourCrv_nList:
    targetPoints = []
    for crv in crvs:
        print crv
        pts,_ = ps.divide_crv(crv, seg_length, True)
    targetPoint_nList.append(pts)





vis_targetPoints = list_to_ghtree(targetPoint_nList)
# ---------- end dividecrvs ----------

# ----
# First Step
pt = Point(<point referenced from the Rhino model>)
curb_block = GhPythonScript(
    start_pt=pt,
    layer_height=layer_height,
    seg_length=seg_length,
    total_height=total_height,
    total_width=total_width,
    curb_height=curb_height,
    curb_width=curb_width,
    casting_depth=casting_depth,
    pattern_start=pattern_start,
    pattern_end=pattern_end,
    skip_start=skip_start,
    skip_end=skip_end)  # -> pts, pattern_attributes, skip_attributes; inputs start_pt: Point3d, pattern_start: Int32, pattern_end: Int32, skip_start: Int32, skip_end: Int32
# ---------- curb_block: Python ----------
__author__ = "Fen"
import Rhino.Geometry as rg
"-------Import Personal Library-------"
from compas_rhino import unload_modules
unload_modules('e2e_pathSlicer')
import e2e_pathSlicer as ps
"-------------------------------------"
tolerance = float(25)
total_height = total_height + tolerance
total_width = total_width + tolerance
curb_height = curb_height
curb_width = curb_width#60 originally
casting_depth = casting_depth
extend_width = total_width - curb_width
extend_height = total_height - casting_depth - curb_height

pt_1 = start_pt + rg.Vector3d.XAxis*(extend_width)
pt_2 = pt_1 + rg.Vector3d.YAxis*(curb_height)
pt_3 = pt_2 + rg.Vector3d.XAxis*(curb_width)
pt_4 = pt_3 + rg.Vector3d.YAxis*(extend_height)
pt_5 = pt_2 + rg.Vector3d.YAxis*(extend_height)
pt_6 = pt_5 + rg.Vector3d.YAxis*(casting_depth)
pt_7 = pt_6 + rg.Vector3d.XAxis*(extend_width*-1)

corner_pts = [pt_1, pt_2, pt_3, pt_4, pt_5, pt_6, pt_7,start_pt ]
"""            0     1      2    3     4     5     6    7    """
noJoint_pts = [pt_1, pt_6, pt_7, start_pt]


pts = []
for i,pt in enumerate(corner_pts):
    if  i != len(corner_pts)-1:
        dis = pt.DistanceTo(corner_pts[i+1])
        line = rg.Line(pt, corner_pts[i+1])
        line = line.ToNurbsCurve()
        if dis >= seg_length:
            extraPts,_ = ps.divide_crv(line, seg_length, False)
            pts.append(pt)
            pts.extend(extraPts)
        else:
            pts.append(pt)
            if i!=2 or i!=3 or i!=4:
                pts_type.append(True)
            else:
                pts_type.append(False)
    else:
        dis = pt.DistanceTo(corner_pts[0])
        line = rg.Line(pt, corner_pts[0])
        line = line.ToNurbsCurve()
        if dis >= seg_length:
            extraPts,_ = ps.divide_crv(line, seg_length, False)
            pts.append(pt)
            pts.extend(extraPts)
            T_lastPt = rg.Vector3d.XAxis*(seg_length/-2) + rg.Vector3d.ZAxis*(layer_height/2)
            pts.append(corner_pts[0]+T_lastPt)
        else:
            pts.append(pt)

pattern_indexes = range(pattern_start, pattern_end+1)
pattern_attributes =[]
for i, pt in enumerate(pts):
    if i not in pattern_indexes:
        pattern_attributes.append(False)
    elif i in pattern_indexes:
        pattern_attributes.append(True)
        
skip_indexes =  range(skip_start, skip_end+1)
skip_attributes =[]
for i, pt in enumerate(pts):
    if i not in skip_indexes:
        skip_attributes.append(False)
    elif i in skip_indexes:
        skip_attributes.append(True)
# ---------- end curb_block ----------
pt_2 = Point(curb_block.pts)
move = Move(Geometry=pt_2, Motion="{-10,10,0}")  # -> Geometry, Transform
pp_generator = GhPythonScript(
    layer_height=layer_height,
    block_width=block_width,
    extend_width=extend_width,
    base_pts=curb_block.pts,
    pattern_attributes=curb_block.pattern_attributes,
    skip_attributes=curb_block.skip_attributes)  # -> out, pt_nlist, attribute_nlist, vis; inputs base_pts: list of Point3d, pattern_attributes: list of Boolean, skip_attributes: list of Boolean
# ---------- pp_generator: Python ----------
__author__ = "Fen"
import Rhino.Geometry as rg
import math as m
from compas_ghpython import ghtree_to_list, list_to_ghtree 
"-------Import Personal Library-------"
from compas_rhino import unload_modules
unload_modules('e2e_data_structure')
import data_structure as ds
unload_modules('e2e_pathSlicer')
import e2e_pathSlicer as ps
"-------------------------------------"

layer_count = int(m.ceil(block_width/layer_height))
print layer_count ,layer_count * layer_height
#print int(m.trunc(layer_count))
layer_range = range(0, layer_count)
print layer_range, len(layer_range)

ext_count = int(m.ceil(extend_width/layer_height))
print ext_count ,ext_count * layer_height
#print int(m.trunc(layer_count))
ext_range = range(layer_range[-1]+1, layer_range[-1]+ext_count+1)
print ext_range, len(ext_range)

print layer_range+ext_range

pt_nlist =[]
attribute_nlist = []
for i in layer_range:
    pts = [rg.Point3d(pt.X, pt.Y, pt.Z + i*layer_height) for pt in base_pts]
    pt_nlist.append(pts)
    attribute_nlist.append(pattern_attributes)

if extend_width > 0:
    for j in ext_range:
        ext_pts =[]
        patterns = []
        for pt, pattern, skip in zip(base_pts,pattern_attributes,skip_attributes):
            if not skip:
                ext_pts.append(rg.Point3d(pt.X, pt.Y, pt.Z + j*layer_height))
                patterns.append(pattern)
        pt_nlist.append(ext_pts)
        attribute_nlist.append(patterns)
else:
    pass





vis = list_to_ghtree(pt_nlist)
# ---------- end pp_generator ----------
points = PointList(Points=move.Geometry, Size=8)

# ----
# Printing Area Visualization
boundary = PolyLine(Vertices=[ori_pt, xaxis_pt, diag_pt, yaxis_pt], Closed=True)
cluster = Cluster(G=ori_pt, print_boundary=boundary, G_2=xaxis_pt, G_3=yaxis_pt, ori=ori_pt)  # -> txt_2, D_2, swatch_3, D, swatch_4, panel, rhino_boundary, rhino_oript, R

# ---- group: UR model
mesh = Mesh([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])
preview = CustomPreview(Geometry=mesh, Shader=ColourSwatch(SwatchColor=RGB(0, 143, 117)))

# ---- group: Rhino Printing Area
custom_preview_lineweights = CustomPreviewLineweights(Geometry=cluster.rhino_boundary, Shader=cluster.swatch_4, Thickness=4, Absolute=False)

# ---- group: UR Printing Area
previewlw = CustomPreviewLineweights(Geometry=boundary, Shader=cluster.swatch_3, Thickness=4, Absolute=False)

# ---- group: Text
screentext = ScreenOrientedText(
    Text=cluster.txt_2,
    Font=cluster.panel,
    Justification=8,
    Location=cluster.R,
    SizeFactor=15,
    Color=[cluster.D_2, cluster.D],
    Depth=5,
    Absolute=False)

# ----
pt_3 = Point(pp_generator.vis)

# ----
# Data Filter
list_2 = ValueList({"Slicing Brep": 0, "First Step": 1, "David's": 2}, selected="First Step")
filter_2 = StreamFilter(Gate=list_2, Stream0=dividecrvs.targetPoint_nList, Stream1=pp_generator.pt_nlist, Stream2=print_pts_array)
filter_3 = StreamFilter(Gate=list_2, Stream0=dividecrvs.targetPoint_nList, Stream1=pp_generator.attribute_nlist, Stream2=pattern_bools_array)

# ---- group: Adjust tcp height
# Add Pattern and Slice Data
tcp_adjust = Slider(-5, range=-50..50)

# ---- group: Pattern Params
list_3 = ValueList({"no filter", "wait", "movement", "velocity", "combined"}, selected="movement")
wait_time = Slider(0.48, range=0..2)
lift_distance = Slider(10, range=0..15)

# ---- group: Slicing Data
slice = BooleanToggle(False)
start_layer = Slider(3, range=0..30)
end_layer = Slider(8, range=0..50)

# ---- group: Cap Layers
capped = BooleanToggle(True)
bottom_cap = Slider(2, range=0..10)
top_cap = Slider(0, range=0..10)

# ----
reset = Button()

# ---- group: Select Target Pt
list_4 = ValueList({"Origin Point": 0, "X Axis Point": 1, "Y Axis Point": 2, "Diagonal Point": 3, "Safe Point": 4}, selected="Y Axis Point")
filter_4 = StreamFilter(Gate=list_4, Stream0=ori_pt, Stream1=xaxis_pt, Stream2=yaxis_pt, Stream3=diag_pt)

# ----
# Fabrication Data
# Add Pattern
fabrication_data = GhPythonScript(
    printPoint_nList=filter_2,
    attribute_nList=filter_3,
    rhino_oriPt=cluster.rhino_oript,
    ori_pt=ori_pt,
    xAxis_pt=xaxis_pt,
    yAxis_pt=yaxis_pt,
    tcp_adjust=tcp_adjust,
    safe_joints=j,
    velocity=velocity,
    acceleration=acceleration,
    firstLayer_velocity=firstlayer_velocity,
    travel_velocity=travel_velocity,
    slice=slice,
    start_layer=start_layer,
    end_layer=end_layer,
    reset=reset)  # -> printPoint_nList, attribute_nList, vis; inputs printPoint_nList: list, attribute_nList: list, rhino_oriPt: Point3d, ori_pt: Point3d, xAxis_pt: Point3d, yAxis_pt: Point3d, safe_joints: list, slice: Boolean, start_layer: Int32, end_layer: Int32, reset: Boolean
# ---------- fabrication_data: Python ----------
__author__ = "Fen"
import Rhino.Geometry as rg
import ghpythonlib.components as ghc
import ghpythonlib.treehelpers as th
from compas_ghpython import ghtree_to_list, list_to_ghtree 
"-------Import Personal Library-------"
from compas_rhino import unload_modules
unload_modules('e2e_pathSlicer')
unload_modules('e2e_data_structure')
import e2e_pathSlicer as ps
import e2e_data_structure as ds
unload_modules('fab_data')
from scriptcontext import sticky as fab_data
"-------------------------------------"

def rhino_to_robot_space(rhino_plane, rhino_basePlane, robot_basePlane):
    """ this function translates planes from the rhino cordinate system to
        the robot cordinate system.
        It uses "inputBase_pt", which should use the bottom left corner point(from top view in Rhino)
        to construct a "rhino plane",
        and get a transform matrix from it to the "robot base plane"
    """
    robot_plane = rhino_plane.Clone()
    _matrix = rg.Transform.PlaneToPlane(rhino_basePlane, robot_basePlane)
    robot_plane.Transform(_matrix)
    return robot_plane

""" Change volicity unit from m to mm """
velocity = velocity/1000
acceleration = acceleration/1000
firstLayer_velocity = firstLayer_velocity/1000
travel_velocity = travel_velocity/1000

#""" Here we create a robot base plane """
#rhino_basePlane = rg.Plane(rhino_basePt, rg.Vector3d.ZAxis)
#robot_basePlane = rg.Plane(ori_pt, xAxis_pt - ori_pt, yAxis_pt - ori_pt)

""" Slice if needed """
if slice:
    printPoint_nList = printPoint_nList[start_layer:end_layer+1]
    attribute_nList =attribute_nList[start_layer:end_layer+1]
else:
    pass

""" Set / Reset data """
tcp_v = rg.Vector3d.ZAxis*tcp_adjust
if reset:
    fab_data.clear()
else:
    fab_data['planes'] = []
    fab_data['waits'] = []
    fab_data['velocities'] = []
    fab_data['accelerations'] =[]
    fab_data['blend_radiuses'] =[]
    
    fab_data['ed_x'] = 0
    fab_data['ed_y'] = 0
    fab_data['ed_z'] = 0
    fab_data['safe_joints'] = safe_joints
    fab_data['robot_points'] = [ori_pt + tcp_v, xAxis_pt + tcp_v, yAxis_pt + tcp_v]
    fab_data['rhino_points'] = [rhino_oriPt]
    fab_data['firstLayer_velocity'] = [firstLayer_velocity]
    fab_data['travel_velocity'] = [travel_velocity]

""" Here we create other parameters for the robot """
for i,pts in enumerate(printPoint_nList):
    vels = []
    accels = []
    if i==0:
        for pt in pts:
            vels.append(fab_data['firstLayer_velocity'][0])
            accels.append(acceleration)
    else:
        for pt in pts:
            vels.append(velocity)
            accels.append(acceleration)
    fab_data['velocities'].append(vels)
    fab_data['accelerations'].append(accels)


vis = list_to_ghtree(printPoint_nList)
# ---------- end fabrication_data ----------
pattern_filter = GhPythonScript(
    printPoint_nList=fabrication_data.printPoint_nList,
    attribute_nList=fabrication_data.attribute_nList,
    type=list_3,
    capped=capped,
    bottom_cap=bottom_cap,
    top_cap=top_cap,
    wait_time=wait_time,
    lift_distance=lift_distance)  # -> vis, visPlane_nList; inputs printPoint_nList: list, attribute_nList: list, capped: Boolean, bottom_cap: Int32, top_cap: Int32
# ---------- pattern_filter: Python ----------
__author__ = "Fen"
import Rhino.Geometry as rg
import ghpythonlib.components as ghc
import ghpythonlib.treehelpers as th
from compas_ghpython import ghtree_to_list, list_to_ghtree 

"-------Import Personal Library-------"
from compas_rhino import unload_modules
unload_modules('data_structure')
import e2e_data_structure as ds
unload_modules('fab_data')
from scriptcontext import sticky as fab_data
unload_modules('e2e_pathSlicer')
import e2e_pathSlicer as ps
"-------------------------------------"

def rhino_to_robot_space(rhino_plane, rhino_basePlane, robot_basePlane):
    """ this function translates planes from the rhino cordinate system to
        the robot cordinate system.
        It uses "inputBase_pt", which should use the bottom left corner point(from top view in Rhino)
        to construct a "rhino plane",
        and get a transform matrix from it to the "robot base plane" """
    robot_plane = rhino_plane.Clone()
    _matrix = rg.Transform.PlaneToPlane(rhino_basePlane, robot_basePlane)
    robot_plane.Transform(_matrix)
    return robot_plane
    
def patternIndex_list(bottom_cap, top_cap, list_length):
    index_list = range(list_length)
    if bottom_cap==0 and top_cap !=0:
        return index_list[:top_cap*-1]
    elif bottom_cap!=0 and top_cap ==0:
        return index_list[bottom_cap:]
    elif bottom_cap==0 and top_cap ==0:
        return index_list
    else:
        return index_list[bottom_cap:top_cap*-1]


        
#if reset:
#    fab_data.clear()
#    fab_data['planes'] = None
#else:
#    fab_data['planes'] = targetPlane_nList
#    fab_data['waits'] = []
#    fab_data['velocities'] = []
#    fab_data['accelerations'] =[]
#    fab_data['blend_radiuses'] =[]

""" Here we create a robot base plane """
rhino_basePlane = rg.Plane(fab_data['rhino_points'][0], rg.Vector3d.ZAxis)
robot_basePlane = rg.Plane(fab_data['robot_points'][0], fab_data['robot_points'][1] - fab_data['robot_points'][0], fab_data['robot_points'][2] - fab_data['robot_points'][0])
print fab_data['robot_points'][0][2]
#""" Create print planes from points """
#targetPlane_nList = []
#vis = []
#for pts in printPoint_nList:
#    rhino_planes = [rg.Plane(pt, rg.Vector3d.ZAxis) for pt in pts]
#    target_planes = [rhino_to_robot_space(rhino_plane, rhino_basePlane, robot_basePlane) for rhino_plane in rhino_planes]
#    targetPlane_nList.append(target_planes)
#    vis.extend(target_planes)

if type =="no filter":
    print "No pattern"
    fab_data['waits'] = ds.duplicateData_nlist(printPoint_nList, 0)
    for i,pts in enumerate(printPoint_nList):
        blends = ps.calc_blendRadius(pts, buffer=0.001*0.4)
        fab_data['blend_radiuses'].append(blends)
        rhino_planes = [rg.Plane(pt, rg.Vector3d.ZAxis) for pt in pts]
        print_planes = [rhino_to_robot_space(rhino_plane, rhino_basePlane, robot_basePlane) for rhino_plane in rhino_planes]
        fab_data['planes'].append(print_planes)
    visPlane_nList = fab_data['planes']
    vis=list_to_ghtree (visPlane_nList)

elif type =="wait":
    print "pattern from delaying"
    vis = []
    for i, pts in enumerate(printPoint_nList):
        blends = ps.calc_blendRadius(pts, buffer=0.001*0.4)
        fab_data['blend_radiuses'].append(blends)
        rhino_planes = [rg.Plane(pt, rg.Vector3d.ZAxis) for pt in pts]
        target_planes = [rhino_to_robot_space(rhino_plane, rhino_basePlane, robot_basePlane) for rhino_plane in rhino_planes]
        fab_data['planes'].append(target_planes)
        
        waits = []
        for j,pt in enumerate(pts):
            if i==0:
                waits.append(0)
            else:
                if i%2==1:
                    if j%2==0:
                        waits.append(wait_time)
                    else:
                        waits.append(0)
                elif i%2==0:
                    if j%2==0:
                        waits.append(0)
                    else:
                        waits.append(wait_time)
        fab_data['waits'] = [].append(waits)
        
    visPlane_nList = fab_data['planes']
    vis=list_to_ghtree (visPlane_nList)
    
elif type == "movement":
    print "pattern from movement"
    if capped:
        pattern_layer = patternIndex_list(bottom_cap,top_cap, len(printPoint_nList))
        print "capped, layer with pattern", pattern_layer
    else:
        pattern_layer = patternIndex_list(1,0, len(printPoint_nList))
        print "not capped, layer with pattern", pattern_layer
        
    new_printPoint_nList = []
    for i, (pts, attributes) in enumerate(zip(printPoint_nList,attribute_nList)):
        new_pts = []
        for j,(pt,attri) in enumerate(zip(pts,attributes)):
            if i not in pattern_layer:
                new_pts.append(pt)
            else :
                if attri:
                    if i%2==1:
                        if j%2==0:
                            new_pts.append(pt+rg.Vector3d(0,0,-lift_distance))
                        else:
                            new_pts.append(pt+rg.Vector3d(0,0,lift_distance))
                    elif i%2==0:
                        if j%2==0:
                            new_pts.append(pt+rg.Vector3d(0,0,lift_distance))
                        else:
                            new_pts.append(pt+rg.Vector3d(0,0,-lift_distance))
                else:
                    new_pts.append(pt)

        new_printPoint_nList.append(new_pts)
    
    fab_data['waits'] = ds.duplicateData_nlist(printPoint_nList, 0)
    vis = []
    for i,pts in enumerate(new_printPoint_nList):
        blends = ps.calc_blendRadius(pts, buffer=0.001*0.4)
        fab_data['blend_radiuses'].append(blends)
        rhino_planes = [rg.Plane(pt, rg.Vector3d.ZAxis) for pt in pts]
        target_planes = [rhino_to_robot_space(rhino_plane, rhino_basePlane, robot_basePlane) for rhino_plane in rhino_planes]
        fab_data['planes'].append(target_planes)
        
    visPlane_nList = fab_data['planes']
    vis=list_to_ghtree (visPlane_nList)

elif type == "velocity":
    print "pattern from velocity"
    pass
else:
    pass
# ---------- end pattern_filter ----------

# ----
# Robot TCP Adjustment
tcp_h = Slider(154.01, range=0..500)

# ----
# Set robot to installation position
# BEFOR or AFTER printing.
installation = Button()

# ----
# Move robot to a certain point
send = Button()

# ----
# Target Plane
pl = GhPythonScript(pt=filter_4)  # -> plane; inputs pt: Point3d
# ---------- pl: Python ----------
import Rhino.Geometry as rg

plane = rg.Plane(pt, rg.Vector3d.XAxis, rg.Vector3d.YAxis)
# ---------- end pl ----------
send_to = GhPythonScript(joints=j, target_plane=pl, tcp_height=tcp_h, installationPos=installation, send=send)  # -> script; inputs joints: list, target_plane: Plane, installationPos: Boolean
# ---------- send_to: Python ----------
from compas_rhino import unload_modules
unload_modules('simple_ur_script')
unload_modules('simple_comm')
import simple_comm as c
import simple_ur_script as ur
import Rhino.Geometry as rg
import math as m

# End-effector dimension
ed_x = 0
ed_y = 0
ed_z = 0

T = rg.Transform.Translation(0,0,tcp_height)
target_plane.Transform(T)
velocity = 0.10
acceleration = 0.05
blend_redious = 0.005

if installationPos:
    script = ""
    script += ur.set_tcp_by_angles(0, 0, 0, m.radians(-90.0), m.radians(0.0), m.radians(-90.0))#BIG!!!!
    script += ur.move_j(joints, acceleration, velocity)
    script = c.concatenate_script("def sendToSafePos():",script)
    c.send_script(script,"192.168.10.10")

elif send:
    script = ""
    script += ur.set_tcp_by_angles(0, 0, 0, m.radians(-90.0), m.radians(0.0), m.radians(-90.0))#BIG!!!!
    script += ur.move_l(target_plane, acceleration, velocity)
    script = c.concatenate_script("def sendToPt():",script)
    c.send_script(script,"192.168.10.10")
# ---------- end send_to ----------

# ---- group: total layer count
lng = ListLength(List=filter_2)
panel_2 = Panel(lng)

# ---- group: sliced layer count
lng_2 = ListLength(List=fabrication_data.printPoint_nList)
panel_3 = Panel(lng_2)

# ---- group: checking data length
check_data_length = GhPythonScript()  # -> out
# ---------- check_data_length: Python ----------
__author__ = "Fen"
"-------Import Personal Library-------"
from compas_rhino import unload_modules
unload_modules('fab_data')
from scriptcontext import sticky as fab_data
"-------------------------------------"

if  len(fab_data['planes']) == len(fab_data['waits']) == len(fab_data['velocities']) == len(fab_data['accelerations']) == len(fab_data['blend_radiuses']):
    print ("data matches")
else:
    print ("data doesn't match")
    print 'planes:', len(fab_data['planes'])
    print 'waits:', len(fab_data['waits'])
    print 'velocities:', len(fab_data['velocities'])
    print 'accelerations:', len(fab_data['accelerations'])
    print 'blend_radiuses:', len(fab_data['blend_radiuses'])
# ---------- end check_data_length ----------
panel_4 = Panel(check_data_length)

# ----
pt_4 = Point(pattern_filter.vis)
pt_5 = Point(fabrication_data.vis)
pline = PolyLine(Vertices=pt_4, Closed=False)
points_2 = PointList(Points=pt_5, Size="10")

# ---- group: Send to a plane
send_2 = Button()

# ----
# Add a note to the name
panel_5 = Panel("mockUP2")
panel_6 = Panel("step_1_A")
panel_7 = Panel("step_2_A")

# ----
# Export fab data as a json file
export = Button()

# ----
# Send a plane to UR
test_print = GhPythonScript(send=send_2)  # -> script; inputs send: Boolean
# ---------- test_print: Python ----------
from compas_rhino import unload_modules
unload_modules('simple_ur_script')
unload_modules('simple_comm')
import simple_comm as c
import simple_ur_script as ur
import Rhino.Geometry as rg
import math as m

from scriptcontext import sticky as fab_data

#ed_x = 0
#ed_y = 80.00
#ed_z = 95.75
tcp_height =10
T = rg.Transform.Translation(0,0,tcp_height)
#target_plane.Transform(T)

if send:
    script = ""
    script += ur.set_tcp_by_angles(fab_data['ed_x'], fab_data['ed_y'], fab_data['ed_z'], m.radians(-90.0), m.radians(0.0), m.radians(-90.0))#BIG!!!!
    
    
    for i,(planes,vels,accels,blends,extrs) in enumerate(zip(fab_data['planes'],fab_data['velocities'],fab_data['accelerations'],fab_data['blend_radiuses'])):
        for j,(plane,vel,accel,blend,extr) in enumerate(zip(planes,vels,accels,blends,extrs)):
            if i==0 and j ==0:
                planeTo = plane.Clone()
                safeT = rg.Transform.Translation(0,-100,0)
                planeTo.Transform(safeT)
                script += ur.move_l(planeTo, 0.03, 0.2)
            else:
                script += ur.move_l_blend(plane, accel, vel, blend)
    
    script += ur.move_j(fab_data['safe_joints'], 0.03, 0.2)
    script = c.concatenate_script("def testPrint():",script)
    c.send_script(script,"192.168.10.10")
# ---------- end test_print ----------

panel_8 = Panel("""0
-1""")

# ----
# Data visualization
slicedata = GhPythonScript(visPlane_nList=pattern_filter.visPlane_nList, slice=slice, start_layer=start_layer, end_layer=end_layer)  # -> out, simulation_planes; inputs visPlane_nList: list, slice: Boolean, start_layer: Int32, end_layer: Int32
# ---------- slicedata: Python ----------
__author__ = "Fen"



if slice and len(visPlane_nList)<end_layer:
    if start_layer ==0:
        raise IndexError("last layer is set out of the range")  


if slice:
    print len(visPlane_nList)
    simulation_planes = [plane for planes in visPlane_nList for plane in planes]
    print ("%s layers of planes will be simulated "%(len(visPlane_nList)))
    print ("planes from %s to %s layer will be simulated"%(start_layer, end_layer))
else:
    simulation_planes = [plane for planes in visPlane_nList for plane in planes]
    print ("%s layers of all planes will be simulated")%(len(visPlane_nList))
# ---------- end slicedata ----------
pt_6 = Point(slicedata.simulation_planes)
move_2 = Move(Geometry=pt_6, Motion="{0,0,4}")  # -> Geometry, Transform
panel_9 = Panel(slicedata.out)
pline_2 = PolyLine(Vertices=pt_6, Closed=False)
item = ListItem(List=pt_6, Index=panel_8, Wrap=True)
points_3 = PointList(Points=move_2.Geometry, Size=Slider(3, range=0..10))

restart = Button()
connect = Button()
disconnect = Button()
list_5 = ValueList({"simulation": 0, "real_robot": 1}, selected="simulation")
robot_name = ValueList({"ur10_2m"}, selected="ur10_2m")
ros = PythonScript(restart=restart, ip=list_5)  # -> ros_client
# ---------- ros: Python ----------
import time
import logging
import scriptcontext as sc

from compas_fab.backends import RosClient
from System import TimeSpan
from System.Threading import ManualResetEventSlim


LOGGER = logging.getLogger('roslibpy')

guid = str(ghenv.Component.InstanceGuid)
ros_client_key = "rosclient_" + guid

previous_client = sc.sticky.get(ros_client_key, None)
if previous_client:
    previous_client.terminate()

if ip == 0: #local
    ros_client = RosClient('127.0.0.1', 9090) #local, own laptop
elif ip == 1: #real robot
    ros_client = RosClient('127.0.0.1', 9090) #place holder

waitLock = ManualResetEventSlim(False)
ros_client.on_ready(lambda: waitLock.Set())

if not waitLock.Wait(TimeSpan.FromSeconds(5)):
    raise Exception('Unable to connect to ROS')

LOGGER.info('Connected to ROS')
# ---------- end ros ----------
connect_2 = PythonScript(ros_client=ros, connect=connect, disconnect=disconnect)  # -> out, ros_client
# ---------- connect_2: Python ----------
import logging
from System import TimeSpan
from System.Threading import ManualResetEventSlim

LOGGER = logging.getLogger('roslibpy')

if connect:
    if not ros_client.is_connected:
        LOGGER.debug('Connecting...')
        waitLock = ManualResetEventSlim(False)
        ros_client.on_ready(lambda: waitLock.Set())
        ros_client.connect()

        if not waitLock.Wait(TimeSpan.FromSeconds(5)):
            raise Exception('Unable to connect to ROS')
        LOGGER.debug('Reconnected')

if disconnect:
    if ros_client.is_connected:
        ros_client.terminate()
        LOGGER.debug('Terminated')
# ---------- end connect_2 ----------

# ---- group: release Data
dam = DataDam(DataA=pt_6, BufferDelay=10000000, BufferMode=0)

# ----
# Load Robot from urdf
py = GhPythonScript()  # -> urdf_source
# ---------- py: Python ----------
import os
import sys

filepath = ghenv.Component.Attributes.Owner.OnPingDocument().FilePath
path = os.path.abspath(os.path.join(filepath, "..", ".."))
print(path)

urdf_source = os.path.abspath(os.path.join(path,"01_docs", "robot_description"))
# ---------- end py ----------
panel_10 = Panel(py)
path = PythonScript(path=panel_10, robot_name=robot_name)  # -> urdf_source
# ---------- path: Python ----------
import os

urdf_source = os.path.join(os.path.abspath(path), robot_name)

assert(os.path.isdir(urdf_source))
# ---------- end path ----------

# ---- group: Send json to UR
send_3 = Button()

# ----
# Export Json
# Json to UR
export_json = GhPythonScript(note="firstStep_extension_30cm", export=export)  # -> attri, json_name, file_path
# ---------- export_json: Python ----------
import Rhino.Geometry as rg
import json
import os
from datetime import datetime
from scriptcontext import sticky as fab_data


""" TCP configuration needs to be implemented """
ed_x = 0
ed_y = 80.00
ed_z = 95.75
tcp_height =10
T = rg.Transform.Translation(0,0,tcp_height)


""" generating fabrication data """
data = {}
count = 0
for i,(planes,vels,accels,blends,waits) in enumerate(zip(fab_data['planes'],fab_data['velocities'],fab_data['accelerations'],fab_data['blend_radiuses'],fab_data['waits'])):
    for j,(plane,vel,accel,blend,wait) in enumerate(zip(planes,vels,accels,blends,waits)):
        point = {
        'frame' : {
            'point' : [plane.OriginX, plane.OriginY, plane.OriginZ],
            'xAxis' : [1.0, 0.0, 0.0],
            'yAxis' : [0.0, 1.0, 0.0]
            },
        'velocity' : vel,
        'acceleration' : accel,
        'blend_radus' : blend,
        'waits': wait,
        'layer' : i,
        'item' :j,
        
        'type' : 'print point'
        }
        data[count] = point
        count+=1

""" get location of GH fle"""
ghComp = ghenv.Component
ghDoc = ghComp.OnPingDocument()

""" the full path of the folder to save gh file """
current_path = ghDoc.FilePath
""" the target directory to dump json """
folder_path = os.path.abspath(os.path.join(current_path,"..","..","00_data","json"))

""" add time to the name """
now = datetime.today()
#currentDate = now.strftime("%y%m%d_")
currentDate = now.strftime("%y%m%d")
currentTime = now.strftime("%H%M")
print "time hhmm: ",currentTime

""" add a note to the name """
addNote = bool(note and not note.isspace())
if addNote:
    #attri =  "%s_"%(note) + currentDate + currentTime
    attri =  "%s_"%(note) + currentDate
else:
    #attri = currentDate + currentTime
    attri = currentDate

""" combining directory with file name """
json_name = 'e2e_printpoints_%s.json'%(attri)
print "json name: ", json_name
file_path = os.path.join(folder_path, json_name)
print "file path and name: ",file_path

""" exort json"""
if export:
    with open(file_path, 'w') as f:
            f.write(json.dumps(data, indent=3, sort_keys=True))
# ---------- end export_json ----------
panel_11 = Panel(export_json.json_name)
panel_12 = Panel(export_json.attri)
panel_13 = Panel(export_json.file_path)
recompute = Button()
py_2 = PythonScript()  # -> folder_path
# ---------- py_2: Python ----------
import sys
import os

ghComp = ghenv.Component
ghDoc = ghComp.OnPingDocument()

# the full path of the gh file
current_path = ghDoc.FilePath
# the current directory 
folder_path = os.path.abspath(os.path.join(current_path,"..","..","00_data","json"))

print folder_path
# ---------- end py_2 ----------
panel_14 = Panel(py_2)

# ---- group: Release Data
dam_2 = DataDam(DataUpdate=panel_11, BufferDelay=10000000, BufferMode=0)

# ----
panel_15 = Panel(dam_2)
python_2 = GhPythonScript(recompute=recompute, json_name=panel_15, folder_path=py_2, send=send_3)  # -> out, script; inputs send: Boolean
# ---------- python_2: Python ----------
import os
import json
import Rhino.Geometry as rg
import math as m
import simple_comm as c
import simple_ur_script as ur
from compas.geometry import Frame

from scriptcontext import sticky as fab_data

def compasFrame_toRhinoPlane(data):
    x=data['frame']['point'][0]
    y=data['frame']['point'][1]
    z=data['frame']['point'][2]
    return rg.Plane(rg.Point3d(x,y,z), rg.Vector3d.ZAxis)


filename = os.path.join(folder_path,json_name)
print filename

with open(filename, 'r') as f:
    fabrication_data = json.load(f)

#ed_x = 0
#ed_y = 80.00
#ed_z = 95.75
#tcp_height =10
#T = rg.Transform.Translation(0,0,tcp_height)

print fab_data['firstLayer_velocity'][0]
vis=[]


if send:
    script = ""
    script += ur.set_tcp_by_angles(0, 0, 0, m.radians(-90.0), m.radians(0.0), m.radians(-90.0))
    
    for i in range(len(fabrication_data)):
        pl_data = fabrication_data[str(i)]


        if pl_data['layer'] ==0:
            """ first layer will be printed slower """
            if  pl_data['item'] ==0:
                """ construct a rhino target plane """
                plane = compasFrame_toRhinoPlane(pl_data)
                
                vis.append(plane)
                
                """
#                construct a start plane
                start_plane = plane.Clone()
                safeT = rg.Transform.Translation(0,-100,0)#this has to be visualized
                start_plane.Transform(safeT)
#                 move to safe plane
                script += ur.move_l_blend(start_plane, pl_data['acceleration'],  fab_data['travel_velocity'][0],pl_data['blend_radus'])
                """
                
                """ move to the first plane """
                script += ur.move_l_blend(plane, pl_data['acceleration'],  pl_data['velocity'],pl_data['blend_radus'])
            else:
                plane = compasFrame_toRhinoPlane(pl_data)
                """ move to the rest of planes on 1st layer """
                script += ur.move_l_blend(plane, pl_data['acceleration'],  fab_data['firstLayer_velocity'][0],pl_data['blend_radus'])
        else:
            """ the other layers """
            """ construct a rhino target plane """
            plane = compasFrame_toRhinoPlane(pl_data)
            

            """ move to target plane """
            script += ur.move_l_blend(plane, pl_data['acceleration'],  pl_data['velocity'],pl_data['blend_radus'])
            
            if  pl_data['waits'] !=0:
                script += ur.sleep(pl_data['waits'])
            
            if i != len(fabrication_data)-1:
                current_item = pl_data['item']
                next_item = fabrication_data[str(i+1)]['item']
                if next_item < current_item:
                    script += ur.textmsg(int(pl_data['layer']), ' layer is finished')
                    
            elif i == len(fabrication_data)-1:
                    script += ur.textmsg(int(pl_data['layer']), ' layer is finished, print is DONE')
                    script += ur.textmsg('move to safe position! ', 'happy printing!')
                    """ move to safe config """
                    script += ur.move_j(fab_data['safe_joints'], 0.03, 0.2)
    
    script = c.concatenate_script("def testPrint():",script)
    c.send_script(script,"192.168.10.10")
# ---------- end python_2 ----------
panel_16 = Panel(python_2.out)

# ----
# ROS Connection
# Robot Simulation
# Plan Cartesian Motion
units = ValueList({"m": 1, "mm": 1000}, selected="mm")
load = BooleanToggle(True)
robot = PythonScript(urdf_source=path, ros_client=connect_2.ros_client, scale_factor=units, load=load)  # -> out, robot
# ---------- robot: Python ----------
import os
from scriptcontext import sticky as st
import compas


from compas.robots import RobotModel
from compas.robots import LocalPackageMeshLoader
from compas_fab.ghpython import RobotArtist
from compas_fab.robots import RobotSemantics as RobotSemantics

from compas_fab.robots import Robot as Robot
from compas_fab.backends import RosClient

# Set high precision to import meshes defined in meters
compas.PRECISION = '12f'

# store data in component
guid = str(ghenv.Component.InstanceGuid)
robot_key = "robot_" + guid


if robot_key not in st:
    st[robot_key] = None


if ros_client and ros_client.is_connected and load == True:
    
    model = RobotModel.from_urdf_file(os.path.join(urdf_source, 'robot_description.urdf'))
    model.load_geometry(LocalPackageMeshLoader(urdf_source, 'robot_description'))
    semantics = RobotSemantics.from_srdf_file(os.path.join(urdf_source, 'robot_description.srdf'), model)
    artist = RobotArtist(model)
    robot = Robot(model, artist, semantics)
    
    robot.scale(scale_factor)
    st[robot_key] = robot

robot = st[robot_key]

if robot:
    robot.client = ros_client
# ---------- end robot ----------
info = PythonScript(robot=robot.robot)  # -> out, main_group_name
# ---------- info: Python ----------
if robot:
    robot.info()
    main_group_name = robot.main_group_name
# ---------- end info ----------
main_planning_group = Text(info.main_group_name)
panel_17 = Panel(info.out)
Y = UnitY(Factor=1)
Z = UnitZ(Factor=1)
pl_2 = ConstructPlane(Origin=dam, XAxis=Y, YAxis=Z)
py_3 = PythonScript(robot=robot.robot)  # -> configuration
# ---------- py_3: Python ----------
from compas_fab.robots import Configuration

if robot:
    types = robot.get_configurable_joint_types()
    values = [0] * len(types)

    configuration = Configuration(values, types)
    print configuration
# ---------- end py_3 ----------
pln = Plane(pl_2)
list_6 = ValueList({"0", "1"}, selected="0")
reverse = BooleanToggle(False)
compute = BooleanToggle(True)
iteration = Slider(1, range=0..10)
number_slider_2 = Slider(437, range=0..900)
panel_18 = Panel("positions")
panel_19 = Panel("velocities")
start = Button()
reset_2 = Button()
step = Button()
panel_20 = Panel("accelerations")
state = ValueList({"forward_kinematics": 0, "plan_cartesian_motion": 1}, selected="plan_cartesian_motion")
show_end_effector_frame = BooleanToggle(True)
show_visual = BooleanToggle(True)
show_axes = BooleanToggle(False)

# ----
# Configuration
show = ValueList({"scan_pose": 0, "safe_pose": 1, "slider": 2}, selected="slider")
j1 = Slider(-229, range=-360..360)
j2 = Slider(-45, range=-360..360)
j3 = Slider(129, range=-360..360)
j4 = Slider(-83, range=-360..360)
j5 = Slider(40, range=-360..360)
j6 = Slider(0, range=-360..360)
forward_kinematics = PythonScript(robot=robot.robot, group=main_planning_group, show=show, j1=j1, j2=j2, j3=j3, j4=j4, j5=j5, j6=j6)  # -> configuration
# ---------- forward_kinematics: Python ----------
import math
from compas_fab.robots import Configuration

if robot:
    if show == 0:
        joint_positions = [-10 + math.degrees(3.14159), -105, 165, 120, -80, 0]
    if show == 1:
        joint_positions = [35 + math.degrees(3.14159), -35, 125, 90, -90, 0]
    if show == 2:
        joint_positions = [j1 + math.degrees(3.14159), j2, j3, j4, j5, j6]
    joint_positions = [math.radians(a) for a in joint_positions]
    types = robot.get_configurable_joint_types(group)
    configuration = Configuration(joint_positions, types)
    print configuration
# ---------- end forward_kinematics ----------

filter_5 = StreamFilter(Gate=list_6, Stream0=forward_kinematics, Stream1=py_3)
plan_cartesian_motion = PythonScript(
    robot=robot.robot,
    group=main_planning_group,
    start_configuration=filter_5,
    planes=pln,
    iteration=iteration,
    reverse_list=reverse,
    max_step=10,
    compute=compute)  # -> out, robot, group, trajectory; inputs planes: list, iteration: Int32, reverse_list: Boolean
# ---------- plan_cartesian_motion: Python ----------
import logging
import scriptcontext as sc
from compas.geometry import Frame
from compas.geometry import Translation
import math
from compas_fab.robots import Configuration

guid = str(ghenv.Component.InstanceGuid)
response_key = "response_" + guid
translation_vector_key = "translation_vector" + guid
if response_key not in sc.sticky:
    sc.sticky[response_key] = None

if robot:
    if robot.client:
        if robot.client.is_connected:
            if start_configuration and compute:
                joint_positions = [math.radians(a) for a in [0, 0, 0, 0, 0, 0]]
                types = robot.get_configurable_joint_types(group)
                configuration = Configuration(joint_positions, types)
                frames_temp = robot.transformed_frames(configuration, group)
                f1 = frames_temp[8]
                f2 = frames_temp[9]
                translation_vector = [f1[0][1] - f2[0][1], 0, f1[0][2] - f2[0][2]]
                print translation_vector
                sc.sticky["translation_vector_key"] = translation_vector
                
                frames = []
                
                for i in range(iteration):
                    if reverse_list and i > 0:
                        planes.reverse()
                    for j, plane in enumerate(planes):
                        frame = Frame(plane.Origin, plane.ZAxis, -plane.XAxis)
#                        frame = Frame(plane.Origin, plane.ZAxis, plane.XAxis)
#                        x = Translation.from_vector(frame.xaxis.unitized() * -translation_vector[0])
#                        z = Translation.from_vector(frame.zaxis.unitized() * translation_vector[2])
#                        t_frame = frame.transformed(x)
#                        t_frame.transform(z)
#                        frames.append(t_frame)
                        frames.append(frame)
                        if j<2:
                            print frames
                
                options = {'max_step':float(max_step)}
                response = robot.plan_cartesian_motion(frames, start_configuration=start_configuration, group=group, options=options)
                sc.sticky[response_key] = response
        else:
            print("Robot is not connected")
            sc.sticky[response_key] = None

trajectory = sc.sticky[response_key]
# ---------- end plan_cartesian_motion ----------
vis = PythonScript(trajectory=plan_cartesian_motion.trajectory)  # -> P, V, A, time
# ---------- vis: Python ----------
from compas_ghpython import list_to_ghtree

if trajectory:

    positions = []
    velocities = []
    accelerations = []
    time_from_start = []

    for p in trajectory.points:
        positions.append(p.positions)
        velocities.append(p.velocities)
        accelerations.append(p.accelerations)
        time_from_start.append(p.time_from_start.seconds)

    P = list_to_ghtree(list(zip(*positions)))
    V = list_to_ghtree(list(zip(*velocities)))
    A = list_to_ghtree(list(zip(*accelerations)))
    time = time_from_start[-1]
# ---------- end vis ----------
multiplication = Multiplication(A=vis.time, B=4.25)
time_sec = Panel(multiplication)
panel_21 = Panel(plan_cartesian_motion.out)
py_4 = PythonScript(robot=plan_cartesian_motion.robot, group=plan_cartesian_motion.group, trajectory=plan_cartesian_motion.trajectory)  # -> start_configuration, configurations, full_configurations, frames, planes, fraction
# ---------- py_4: Python ----------
from compas_ghpython import draw_frame

joint_positions = []

if trajectory:
    configurations = trajectory.points
    start_configuration = trajectory.start_configuration
    fraction = trajectory.fraction
    time = trajectory.time_from_start
    full_configurations = [robot.merge_group_with_full_configuration(c, trajectory.start_configuration, group) for c in configurations]
    frames = [robot.forward_kinematics(c, group, options=dict(solver='model')) for c in full_configurations]
    planes = [draw_frame(frame) for frame in frames]
    P = [plane.Origin for plane in planes]
# ---------- end py_4 ----------
prismatic = QuickGraph(vis.P, SortOrder=0)
division = Division(A=time_sec, B=60)
time_min = Panel(division)
fraction = Panel(py_4.fraction)
scale = Scale(Geometry=py_4.planes, Center=Point(0, 0, 0), Factor=0.001)  # -> Geometry, Transform
graph = QuickGraph(vis.V, SortOrder=0)
graph_2 = QuickGraph(vis.A, SortOrder=0)
pline_3 = PolyLine(Vertices=scale.Geometry, Closed=False)
preview_2 = CustomPreview(Geometry=scale.Geometry, Material=ColourSwatch(SwatchColor=RGB(59, 137, 161)))
counter = CountThroughList(L=py_4.full_configurations, start=start, step=step, reset=reset_2)  # -> item; inputs L: list, start: Boolean
# ---------- counter: Python ----------
from scriptcontext import sticky as st
from compas_ghpython.utilities import update_component


interval = 1

# store data in component
guid = str(ghenv.Component.InstanceGuid)
counter_key = "counter_" + guid
running_key = "running_" + guid

if counter_key not in st:
    st[counter_key] = 0

if running_key not in st:
    st[running_key] = False

if start:
    st[running_key] = True

if step:
    if st[counter_key] < len(L) - 1:
        st[counter_key] += 1
    
if len(L):
    item = L[st[counter_key]]

if st[running_key]:
    if st[counter_key] < len(L) - 1:
        st[counter_key] += 1
        update_component(ghenv, interval)
    else:
        st[counter_key] = 0
        st[running_key] = False
# ---------- end counter ----------
filter_6 = StreamFilter(Gate=state, Stream0=forward_kinematics, Stream1=counter)
visualize = PythonScript(
    mode=list_5,
    robot=robot.robot,
    robot_name=robot_name,
    configuration=filter_6,
    group=main_planning_group,
    scale_factor=units,
    show_visual=show_visual,
    show_axes=show_axes,
    show_end_effector_frame=show_end_effector_frame)  # -> visual, axes, axes_color, ee_frame_vis, ee_color, ee_frame, ee_plane
# ---------- visualize: Python ----------
from System.Drawing import Color
from compas_ghpython.utilities import draw_pipes
from compas_ghpython import draw_frame
from compas.geometry import Point
from compas.geometry import Vector
from compas.geometry import Translation

frames = []

size = .200 * scale_factor 
size_w = 2 * scale_factor 
radius = .008 * scale_factor
radius_w = .018 * scale_factor 

red = Color.FromArgb(255, 0, 0)
green = Color.FromArgb(0, 255, 0)
blue = Color.FromArgb(0, 0, 255)

frame_colors = [red, green, blue]


def pipes_from_frame(frame, size, radius): 
    pipes = []
    for axis in [frame.xaxis, frame.yaxis, frame.zaxis]:
        pipe = {}
        pipe['points'] = [list(frame.point), list(Point(*frame.point) + Vector(*axis) * size)]
        pipe['radius'] = radius
        pipes.append(pipe)
    return pipes


if robot and configuration and mode == 0:
    robot.update(configuration, visual=show_visual, collision=False)
    if show_visual:
        visual = robot.artist.draw_visual()
    if show_axes:
        pipes = []
        axes_color = []
        frames = robot.transformed_frames(configuration, group)
        for frame in frames:
            pipes += pipes_from_frame(frame, size, radius)
            axes_color += frame_colors
        axes = draw_pipes(pipes, cap=1)
    
    
    if show_end_effector_frame:
        frames = robot.transformed_frames(configuration, group)
        ee_frame = frames[8]
        ee_plane = draw_frame(ee_frame)
        print("End-effector", ee_frame)

        #Draw
        ee_pipes = pipes_from_frame(ee_frame, size, radius)
        ee_frame_vis = draw_pipes(ee_pipes, cap=1)
        ee_color = frame_colors
# ---------- end visualize ----------
preview_3 = CustomPreview(Geometry=visualize.axes, Shader=visualize.axes_color)
preview_4 = CustomPreview(Geometry=visualize.ee_frame_vis, Shader=visualize.ee_color)
preview_5 = CustomPreview(Geometry=visualize.visual, Shader=ColourSwatch(SwatchColor=RGB(105, 105, 105)))

# ==== cluster Cluster
ori = ClusterInput()
swatch = ColourSwatch(SwatchColor=RGB(255, 170, 255))
swatch_2 = ColourSwatch(SwatchColor=RGB(255, 170, 119))
boundary_visualization = GhPythonScript(ori=ori)  # -> T_rhino2UR; inputs ori: Point3d
# ---------- boundary_visualization: Python ----------
__author__ = "Fen"
import Rhino.Geometry as rg

T_rhino2UR = rg.Point3d(ori.X,ori.Y+1500,0) - ori
# ---------- end boundary_visualization ----------
G = ClusterInput()
G_2 = ClusterInput()
G_3 = ClusterInput()
swatch_3 = ClusterOutput(swatch)
swatch_4 = ClusterOutput(swatch_2)
repeat = RepeatData(Data=swatch_2, Length=3)
repeat_2 = RepeatData(Data=swatch, Length=3)
move = Move(Geometry=G, Motion="{0,-50,0}")  # -> Geometry, Transform
move_2 = Move(Geometry=G_2, Motion="{0,-50,0}")  # -> Geometry, Transform
move_3 = Move(Geometry=G_3, Motion="{-50,-50,0}")  # -> Geometry, Transform
txt = Text(["UR Origin", "UR Y", "UR X", "Rh Origin", "Rh Y", "Rh X"])
D = ClusterOutput(repeat)
D_2 = ClusterOutput(repeat_2)
pt = Point([move.Geometry, move_3.Geometry, move_2.Geometry])
txt_2 = ClusterOutput(txt)
move_4 = Move(Geometry=pt, Motion=boundary_visualization)  # -> Geometry, Transform
print_boundary = ClusterInput()
merge = Merge(Data1=pt, Data2=move_4.Geometry)
boundary_visualization_2 = GhPythonScript(T_rhino2UR=boundary_visualization, print_boundary=print_boundary)  # -> rhino_boundary, rhino_oriPt; inputs print_boundary: Curve
# ---------- boundary_visualization_2: Python ----------
__author__ = "Fen"
import Rhino.Geometry as rg
rhino_boundary = print_boundary.Duplicate()
rhino_boundary.Translate(T_rhino2UR)
rhino_boundary_bb = rhino_boundary.GetBoundingBox( rg.Plane.WorldXY)
rhino_oriPt = rhino_boundary_bb.Min
# ---------- end boundary_visualization_2 ----------
panel = ClusterOutput("3ds Light")
R = ClusterOutput(merge)
rhino_boundary = ClusterOutput(boundary_visualization_2.rhino_boundary)
rhino_oript = ClusterOutput(boundary_visualization_2.rhino_oriPt)
