# Grasshopper definition curbBlock.ghx (Grasshopper 1.0.7)

curb_height = Slider(0, range=0..300)
casting_depth = Slider(0, range=0..300)
curb_height_2 = Slider(0, range=0..300)
curb_height_3 = Slider(0, range=0..300)
curb_width = Slider(0, range=0..300)
curb_height_4 = Slider(0, range=0..300)
curb_block = GhPythonScript(seg_length="30")  # -> out, pts, attributes
# ---------- curb_block: Python ----------
__author__ = "Fen"
import Rhino.Geometry as rg
import ghpythonlib.components as ghc
import ghpythonlib.treehelpers as th
from compas_ghpython import ghtree_to_list, list_to_ghtree 
from scriptcontext import sticky
"-------Import Personal Library-------"
from compas_rhino import unload_modules
unload_modules('data_structure')
import data_structure as ds
unload_modules('e2e_pathSlicer')
import e2e_pathSlicer as ps
"-------------------------------------"

total_height = float(200)
total_width = float(150)

curb_height = float(120)
curb_width = float(80)


casting_depth = float(50)
extend_width = float(80)

extend_height = total_height - casting_depth

start_pt = rg.Point3d(0,0,0)


pt_1 = start_pt + rg.Vector3d.XAxis*extend_width
pt_2 = pt_1 + rg.Vector3d.YAxis*curb_height
pt_3 = pt_2 + rg.Vector3d.XAxis*curb_width
pt_4 = pt_3 + rg.Vector3d.YAxis*extend_height
pt_5 = pt_2 + rg.Vector3d.YAxis*extend_height
pt_6 = pt_5 + rg.Vector3d.YAxis*casting_depth
pt_7 = pt_6 + rg.Vector3d.XAxis*extend_width*-1
corner_pts = [start_pt, pt_1, pt_2, pt_3, pt_4, pt_5, pt_6, pt_7]

#lines = []
#for i,pt in enumerate(pts):
#    if i!=len(pts)-1:
#        line = rg.Line(pt, pts[i+1])
#        lines.append(line)
#    else:
#        line = rg.Line(pt, pts[0])
#        lines.append(line)

#patternLine_index = 

pts = []
attributes =[]
for i,pt in enumerate(corner_pts):
    if  i != len(corner_pts)-1:
        dis = pt.DistanceTo(corner_pts[i+1])
        line = rg.Line(pt, corner_pts[i+1])
        line = line.ToNurbsCurve()
        if dis >= seg_length:
            extraPts,_ = ps.divide_crv(line, seg_length, False)
            pts.append(pt)
            pts.extend(extraPts)
        else:
            pts.append(pt)
    else:
        dis = pt.DistanceTo(corner_pts[0])
        line = rg.Line(pt, corner_pts[0])
        line = line.ToNurbsCurve()
        if dis >= seg_length:
            extraPts,_ = ps.divide_crv(line, seg_length, False)
            pts.append(pt)
            pts.extend(extraPts)
        else:
            pts.append(pt)

pattern_start = int(18)
pattern_end = int(27)
pattern_indexes = range(pattern_start, pattern_end+1)
attributes =[]
for i, pt in enumerate(pts):
    if i not in pattern_indexes:
        attributes.append(False)
    elif i in pattern_indexes:
        attributes.append(True)
# ---------- end curb_block ----------
pp_generator = GhPythonScript(layer_height="1.4", block_width="22", base_pts=curb_block.pts, attributes=curb_block.attributes)  # -> out, pt_nlist, attribute_nlist; inputs base_pts: list of Point3d, attributes: list of Boolean
# ---------- pp_generator: Python ----------
__author__ = "Fen"
import Rhino.Geometry as rg
import math as m

"-------Import Personal Library-------"
from compas_rhino import unload_modules
unload_modules('e2e_data_structure')
import data_structure as ds
unload_modules('e2e_pathSlicer')
import e2e_pathSlicer as ps
"-------------------------------------"

layer_count = int(m.trunc(block_width/layer_height))
print layer_count
print int(m.trunc(layer_count))

pt_nlist =[]
attribute_nlist = []
layer_range = range(0, layer_count-1,1)
for i in layer_range:
    pts = [rg.Point3d(pt.X, pt.Y, pt.Z + i*layer_height) for pt in base_pts]
    pt_nlist.append(pts)
    attribute_nlist.append(attributes)
# ---------- end pp_generator ----------
pt = Point(curb_block.pts)
move = Move(Geometry=pt, Motion="{-10,10,0}")  # -> Geometry, Transform
points = PointList(Points=move.Geometry, Size=8)
