# Grasshopper definition diagrams.ghx (Grasshopper 1.0.7)
# plug-ins: Human

number_slider = Slider(20, range=0.1..20)  # disabled
number_slider_2 = Slider(2.5, range=0.1..5)  # disabled
crv = Curve([<curve referenced from the Rhino model> x8])  # disabled
crv_2 = Curve([<curve referenced from the Rhino model> x664])
swatch = ColourSwatch(SwatchColor=RGB(176, 0, 0))  # disabled
lt_table = LinetypeTable(Update=crv)  # -> Linetypes, LinetypePattern; disabled
lt_table_2 = LinetypeTable(Update=crv_2)  # -> Linetypes, LinetypePattern
dash = DashPattern(Curve=crv, Pattern=number_slider)  # -> Dashes, Gaps; disabled
dash_2 = DashPattern(Curve=crv_2, Pattern=Slider(9, range=0.1..20))  # -> Dashes, Gaps
previewlw = CustomPreviewLineweights(Geometry=dash.Gaps, Shader=swatch, Thickness=number_slider_2, Absolute=False)  # disabled
previewlw_2 = CustomPreviewLineweights(Geometry=crv_2, Shader=ColourSwatch(SwatchColor=RGB(0, 0, 0)), Thickness=Slider(1, range=0.1..5), Absolute=False)
number_slider_3 = Slider(9, range=0.1..20)  # disabled
number_slider_4 = Slider(2.5, range=0.1..5)  # disabled
crv_3 = Curve([<curve referenced from the Rhino model> x8])  # disabled
swatch_2 = ColourSwatch(SwatchColor=RGB(0, 0, 0))  # disabled
lt_table_3 = LinetypeTable(Update=crv_3)  # -> Linetypes, LinetypePattern; disabled
dash_3 = DashPattern(Curve=crv_3, Pattern=number_slider_3)  # -> Dashes, Gaps; disabled
previewlw_3 = CustomPreviewLineweights(Geometry=dash_3.Gaps, Shader=swatch_2, Thickness=number_slider_4, Absolute=False)  # disabled
